# Grasshopper definition 0 总电池（复杂）.gh (Grasshopper 1.0.7)
# plug-ins: RhinoCodePluginGH, BodyAnalytics

serverconnector = ServerConnector(Host="127.0.0.1", Port="8899", Run=Toggle(False))

# ----
# 动作一地贴
point = Point(<point referenced from the Rhino model>)

# ---- group: 筛选ID
# 动作一地贴
point_2 = Point(<point referenced from the Rhino model>)

# ---- group: 获取帷幔序列
brep = Brep([<brep referenced from the Rhino model> x5])
list_length = ListLength(List=brep)
起始号 = Slider(1, range=0..1)
步数 = Slider(1, range=0..1)
series = Series(Start=起始号, Step=步数, Count=list_length)

# ----
curve = Curve(<curve referenced from the Rhino model>)
list_item = ListItem(List=curve, Index=0, Wrap=True)
divide_curve = DivideCurve(Curve=list_item, Count=Slider(2, range=0..10), Kinks=False)  # -> Points, Tangents, Parameters
panel = Panel(divide_curve.Points)

# ----
# （4）一整片切分为Y米一片，
# 若无法整除，则最后一片取余数
# （2）9、16点在3秒内位置变动小于X
# （1）9、16的高度超过18，触发单元尺寸修改
# 这颗电池负责按一定刷新率激活
# 每次激活将最新数据传递给后面的gh电池。
# 输出为等分后最后一片的宽度（余数）
# b为每一小片单元的宽度
number_slider = Slider(250, range=100..5000)
receive = Receive(Interval=number_slider)  # -> Timestamp, Body, PyMessage, RCSLocation
panel_2 = Panel(receive.Timestamp)
panel_3 = Panel(receive.PyMessage)
deconstruct_body = DeconstructBody(Body=receive.Body)  # -> Id, UniqueObjectId, ActionState, Position, Velocity, PositionCovariance, Confidence, HeadPosition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
panel_4 = Panel(deconstruct_body.Position)
division = Division(A=Slider(3000, range=0..10000), B=number_slider)
point_3 = Point(<point referenced from the Rhino model>)
point_4 = Point(<point referenced from the Rhino model>)
distance = Distance(PointA=point_4, PointB=point_3)

# ----
# 第一个人
# 第二个人
list_item_2 = ListItem(List=deconstruct_body.Position, Index=0, Wrap=True)  # -> Item, Item1

# ----
# #决定序列规模（单位时间抽几帧）
回溯多少毫秒之前的帧数 = Slider(1000, range=0..10000)
division_2 = Division(A=回溯多少毫秒之前的帧数, B=number_slider)

# ---- group: 筛选ID
deconstruct_body_2 = DeconstructBody(Body=receive.Body)  # -> Id, UniqueObjectId, ActionState, Position, Velocity, PositionCovariance, Confidence, HeadPosition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
panel_5 = Panel(deconstruct_body_2.Position)

# 第一个人
# 第二个人
list_item_3 = ListItem(List=deconstruct_body_2.Position, Index=0, Wrap=True)  # -> Item, Item1

distance_2 = Distance(PointA=list_item_3.Item1, PointB=point_2)
distance_3 = Distance(PointA=list_item_3.Item, PointB=point_2)
panel_6 = Panel(distance_3)
script = Script(distanceA=distance_3, distanceB=distance_2)  # -> out, result; inputs distanceA: Double, distanceB: Double
# ---------- script: Python ----------
def compare_distances(distanceA, distanceB):
    """
    比较两个距离值，返回对应的文本格式编号：
    - distanceA < distanceB 时返回 "{0;0;0}"
    - distanceB < distanceA 时返回 "{0;0;1}"
    """
    if distanceA < distanceB:
        return "{0;0;0}"
    elif distanceB < distanceA:
        return "{0;0;1}"
    else:
        return "{0;0;0}"  # 相等时默认返回"{0;0;0}"，可按需修改

# 主执行逻辑
try:
    # 获取输入参数（注意参数名需与Grasshopper组件中设置的一致）
    a = distanceA
    b = distanceB
    
    # 执行比较并获取结果
    result = compare_distances(a, b)
    
except Exception as e:
    # 错误处理（返回错误信息文本）
    result = "错误: " + str(e)

# 输出结果
result
# ---------- end script ----------
split_tree = SplitTree(Data=deconstruct_body_2.Keypoints, Masks=flatten(script.result))  # -> Positive, Negative

# ----
distance_4 = Distance(PointA=list_item_2.Item1, PointB=point)
distance_5 = Distance(PointA=list_item_2.Item, PointB=point)
panel_7 = Panel(distance_5)
script_2 = Script(distanceA=distance_5, distanceB=distance_4)  # -> out, result; inputs distanceA: Double, distanceB: Double; same code as script
panel_8 = Panel(script_2.result)
split_tree_2 = SplitTree(Data=deconstruct_body.Keypoints, Masks=flatten(script_2.result))  # -> Positive, Negative
panel_9 = Panel(split_tree_2.Positive)
deconstructkeypoints34 = DeconstructKeypoints34(Keypoints=split_tree_2.Positive)  # -> PELVIS, NAVAL_SPINE, CHEST_SPINE, NECK, LEFT_CLAVICLE, LEFT_SHOULDER, LEFT_ELBOW, LEFT_WRIST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

# ----
# 右腕
右手指尖 = ListItem(List=deconstructkeypoints34.RIGHT_WRIST, Index=0, Wrap=True)

# ----
# 左腕
右手指尖_2 = ListItem(List=deconstructkeypoints34.LEFT_WRIST, Index=0, Wrap=True)

# ----
# 脊椎（胸部）
右髋 = ListItem(List=deconstructkeypoints34.NAVAL_SPINE, Index=0, Wrap=True)

deconstruct = Deconstruct(Point=右手指尖_2)  # -> XComponent, YComponent, ZComponent
deconstruct_2 = Deconstruct(Point=右髋)  # -> XComponent, YComponent, ZComponent
deconstruct_3 = Deconstruct(Point=右手指尖)  # -> XComponent, YComponent, ZComponent
larger_than = LargerThan(FirstNumber=deconstruct_3.ZComponent, SecondNumber=deconstruct_2.ZComponent)  # -> LargerThan, OrEqualTo
larger_than_2 = LargerThan(FirstNumber=deconstruct.ZComponent, SecondNumber=deconstruct_2.ZComponent)  # -> LargerThan, OrEqualTo
dataqueue = DataQueue(Data=右手指尖_2, RecordCount=division)  # -> flatten(OutputData), OldestPath, NewestPath
deconstruct_4 = Deconstruct(Point=dataqueue.OutputData)  # -> XComponent, YComponent, ZComponent
script_3 = Script(input_list=deconstruct_4.ZComponent)  # -> out, result; inputs input_list: list of Double
# ---------- script_3: Python ----------
# 直接计算12元素列表的首尾差值绝对值
data = input_list

# 确保输入是包含12个元素的列表
if data is not None and len(data) == 12:
    result = abs(data[11] - data[0])  # 使用固定索引11（第12个元素）
else:
    result = None  # 不符合条件时返回None，表示不输出

# 输出结果
result
# ---------- end script_3 ----------
smaller_than = SmallerThan(FirstNumber=script_3.result, SecondNumber=Slider(0.02, range=0..1))  # -> SmallerThan, OrEqualTo
script_4 = Script(Result=smaller_than.SmallerThan)  # -> out, result; inputs Result: Boolean
# ---------- script_4: Python ----------
# 初始化历史记录列表（使用全局变量保持状态）
if 'history' not in globals():
    history = []

# 获取当前帧的布尔值
current_value = Result

# 添加当前值到历史记录
if current_value is not None:
    history.append(current_value)

# 检查是否存在连续两个及以上的True
result = False
if len(history) >= 2:
    for i in range(len(history) - 1):
        if history[i] and history[i+1]:
            result = True
            break

# 输出结果
result
# ---------- end script_4 ----------
gate_and = GateAnd(A=larger_than_2.LargerThan, B=larger_than.LargerThan)
gate_and_2 = GateAnd(A=script_4.result, B=gate_and)
data_recorder = DataRecorder(gate_and_2, DataLimit=-10, RecordData=True)
panel_10 = Panel(data_recorder)
distance_6 = Distance(PointA=右手指尖_2, PointB=右手指尖)
script_5 = Script(Result=gate_and_2)  # -> out, result; inputs Result: Boolean
# ---------- script_5: Python ----------
# 初始化存储历史结果的列表（使用全局变量保持状态）
if 'history' not in globals():
    history = []

# 获取当前帧的布尔值
current_value = Result

# 添加当前值到历史记录
if current_value is not None:
    history.append(current_value)

# 确保历史记录至少有两个值
if len(history) >= 2:
    # 获取最后两个值
    last_value = history[-1]
    second_last_value = history[-2]
    
    # 判断是否一个为True，另一个为False
    result = (last_value != second_last_value)
else:
    # 历史记录不足时返回False
    result = False

# 输出结果
result
# ---------- end script_5 ----------
script_6 = Script(distance=distance_6)  # -> out, result; inputs distance: Double
# ---------- script_6: Python ----------
def limit_min_distance(distance):
    """
    限制距离的最小值为0.2：
    - 若distance ≤ 0.2，返回0.2
    - 若distance > 0.2，返回原数
    """
    return max(0.2, distance)

# 主执行逻辑
try:
    # 获取输入参数
    d = distance
    
    # 应用最小值限制
    result = limit_min_distance(d)
    
except Exception as e:
    # 错误处理
    result = "错误: " + str(e)
    print(result)

# 输出结果
result
# ---------- end script_6 ----------
gate_and_3 = GateAnd(A=gate_and_2, B=script_5.result)
data_recorder_2 = DataRecorder(gate_and_3, DataLimit=-10, RecordData=True)
script_7 = Script(Distance=script_6.result, Result=gate_and_3)  # -> a, b; inputs Distance: Double, Result: Boolean
# ---------- script_7: Python ----------
# 导入必要的库
import rhinoscriptsyntax as rs

# 获取输入参数
result = Result  # 前一个电池组的布尔输出
distance = Distance  # 距离值

# 根据result的值决定是否输出distance
if result:
    b = distance  # 将distance赋值给输出参数a
else:
    b = None  # 不输出任何值
# ---------- end script_7 ----------
panel_11 = Panel(data_recorder_2)
script_8 = Script(b=script_7.b)  # -> out, a; inputs b: Double
# ---------- script_8: Python ----------
import math

# 输入参数
b = float(b)  # 将输入转换为浮点数

# 执行计算
if b == 0:
    a = 0  # 处理除以零的情况
else:
    result = 4 / b
    if result.is_integer():
        a = int(result)
    else:
        a = math.floor(result) + 1

# 输出结果
a = a
# ---------- end script_8 ----------
data_recorder_3 = DataRecorder(script_7.b, DataLimit=-10, RecordData=True)
panel_12 = Panel(script_8.a)
series_2 = Series(Start=Slider(0, range=0..1), Step=Slider(1, range=0..1), Count=script_8.a)
modulus = Modulus(A=distance, B=script_7.b)
panel_13 = Panel(data_recorder_3)
multiplication = Multiplication(A=script_7.b, B=series_2)
series_3 = Series(Start=Slider(0, range=0..1), Step=script_7.b, Count=script_8.a)
panel_14 = Panel(series_3)

pt = ConstructPoint(XCoordinate=Slider(0, range=0..10), YCoordinate=Slider(10.154, range=0..20), ZCoordinate=Slider(7.077, range=0..20))  # -> flatten(Point)
pt_2 = ConstructPoint(XCoordinate=Slider(0, range=0..10), YCoordinate=Slider(7.422, range=0..10), ZCoordinate=Slider(2, range=0..10))  # -> flatten(Point)
pt_3 = ConstructPoint(XCoordinate=Slider(0, range=0..10), YCoordinate=Slider(5, range=0..10), ZCoordinate=Slider(1.422, range=0..10))  # -> flatten(Point)
unit_vector = UnitVector(Vector=Vector(10, 0, 0))
merge = Merge(Data1=pt_3, Data2=pt_2, Data3=pt)
multiplication_2 = Multiplication(A=unit_vector, B=series_3)
move = Move(Geometry=graft(merge), Motion=multiplication_2)  # -> Geometry, Transform
points = PointList(Points=move.Geometry)
number_slider_2 = Slider(2, range=0..10)
flip = FlipMatrix(Data=move.Geometry)
points_2 = PointList(Points=flip)
script_9 = Script(x=flip)  # -> out, simplify(A); inputs x: tree
# ---------- script_9: Python ----------
import Rhino.Geometry as rg
import Grasshopper.Kernel.Data as gh_d
import Grasshopper.Kernel.Types as gh_t

# 输入参数
points_tree = x  # 树状结构的点集合

# 输出曲线集合
curves = gh_d.GH_Structure[gh_t.GH_Curve]()

# 遍历树的每个分支
for i in range(points_tree.BranchCount):
    branch_path = points_tree.Path(i)
    points = points_tree.Branch(i)
    
    # 验证点数量
    if len(points) != 3:
        print(f"警告：分支 {branch_path} 包含 {len(points)} 个点（需要3个）")
        continue
    
    # 转换为Rhino点（根据实际类型处理）
    rhino_points = []
    for p in points:
        if isinstance(p, gh_t.GH_Point):
            rhino_points.append(p.Value)  # GH_Point需要.Value
        elif isinstance(p, rg.Point3d):
            rhino_points.append(p)  # 直接使用Point3d
        else:
            print(f"错误：分支 {branch_path} 包含无效类型 {type(p)}")
            break  # 跳过当前分支
    
    # 确保转换成功
    if len(rhino_points) == 3:
        # 创建插值曲线
        curve = rg.Curve.CreateInterpolatedCurve(rhino_points, 3)
        gh_curve = gh_t.GH_Curve(curve)
        curves.Append(gh_curve, branch_path)

# 输出结果
A = curves
# ---------- end script_9 ----------
item = ListItem(List=flip, Index=Slider(8, range=0..100), Wrap=True)
curve_2 = Curve(script_9.A)
panel_15 = Panel(script_9.A)

# ----
# 右脚踝z轴在某时间内位移超过某值，
# 且xy平面位移小于某值，
# 触发单元选择切换
# 替换成左上方的length
# 输出跺脚后选中的序列号
# ##不存在触发两次的问题：
# 点【22】坐标变化很快时（跺脚），
# 第二个布尔门会从False变成True（变换一次，第三个布尔门变True），
# 并且可能会连着输出好几个True
# 但此时没发生布尔变换），所以第三个布尔门变回False
# 
# 当跺脚结束，第二个布尔门变False（变换一次）
# 但不满足前一个点【22】坐标变化的条件
# 所以第三个布尔门还是False
deconstructkeypoints34_2 = DeconstructKeypoints34(Keypoints=split_tree.Positive)  # -> PELVIS, NAVAL_SPINE, CHEST_SPINE, NECK, LEFT_CLAVICLE, LEFT_SHOULDER, LEFT_ELBOW, LEFT_WRIST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
左手指尖 = ListItem(List=deconstructkeypoints34_2.RIGHT_ANKLE, Index=0, Wrap=True)
deconstruct_5 = Deconstruct(Point=左手指尖)  # -> XComponent, YComponent, ZComponent

receive_2 = Receive(Interval=Slider(250, range=100..5000))  # -> Timestamp, Body, PyMessage, RCSLocation
receive_3 = Receive(Interval=Slider(250, range=100..5000))  # -> Timestamp, Body, PyMessage, RCSLocation
panel_16 = Panel(receive_2.Timestamp)
panel_17 = Panel(receive_2.PyMessage)
panel_18 = Panel(receive_3.Timestamp)
panel_19 = Panel(receive_3.PyMessage)
deconstruct_body_3 = DeconstructBody(Body=receive_2.Body)  # -> Id, UniqueObjectId, ActionState, Position, Velocity, PositionCovariance, Confidence, HeadPosition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
deconstruct_body_4 = DeconstructBody(Body=receive_3.Body)  # -> Id, UniqueObjectId, ActionState, Position, Velocity, PositionCovariance, Confidence, HeadPosition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
panel_20 = Panel(deconstruct_body_3.Position)
panel_21 = Panel(deconstruct_body_4.Position)
point_5 = Point(<point referenced from the Rhino model>)
list_item_4 = ListItem(List=deconstruct_body_3.Position, Index=0, Wrap=True)  # -> Item, Item1
point_6 = Point(<point referenced from the Rhino model>)
list_item_5 = ListItem(List=deconstruct_body_4.Position, Index=0, Wrap=True)  # -> Item, Item1
deconstruct_6 = Deconstruct(Point=point_6)  # -> XComponent, YComponent, ZComponent
distance_7 = Distance(PointA=list_item_4.Item1, PointB=point_5)
distance_8 = Distance(PointA=list_item_4.Item, PointB=point_5)
distance_9 = Distance(PointA=list_item_5.Item1, PointB=point_6)
distance_10 = Distance(PointA=list_item_5.Item, PointB=point_6)
panel_22 = Panel(distance_8)
script_10 = Script(distanceA=distance_8, distanceB=distance_7)  # -> out, result; inputs distanceA: Double, distanceB: Double; same code as script
panel_23 = Panel(distance_10)
script_11 = Script(distanceA=distance_10, distanceB=distance_9)  # -> out, result; inputs distanceA: Double, distanceB: Double; same code as script
split_tree_3 = SplitTree(Data=deconstruct_body_3.Keypoints, Masks=flatten(script_10.result))  # -> Positive, Negative
split_tree_4 = SplitTree(Data=deconstruct_body_4.Keypoints, Masks=flatten(script_11.result))  # -> Positive, Negative
panel_24 = Panel(split_tree_3.Positive)
panel_25 = Panel(split_tree_4.Positive)
deconstructkeypoints34_3 = DeconstructKeypoints34(Keypoints=split_tree_4.Positive)  # -> PELVIS, NAVAL_SPINE, CHEST_SPINE, NECK, LEFT_CLAVICLE, LEFT_SHOULDER, LEFT_ELBOW, LEFT_WRIST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
deconstructkeypoints34_4 = DeconstructKeypoints34(Keypoints=split_tree_3.Positive)  # -> PELVIS, NAVAL_SPINE, CHEST_SPINE, NECK, LEFT_CLAVICLE, LEFT_SHOULDER, LEFT_ELBOW, LEFT_WRIST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
unit_z = UnitZ(Factor=1)
unit_z_2 = UnitZ(Factor=1)
unit_z_3 = UnitZ(Factor=1)
vector_2pt = Vector2Pt(PointA=deconstructkeypoints34_3.LEFT_ELBOW, PointB=deconstructkeypoints34_3.LEFT_WRIST, Unitize=False)  # -> Vector, Length
vector_2pt_2 = Vector2Pt(PointA=deconstructkeypoints34_4.LEFT_ELBOW, PointB=deconstructkeypoints34_4.LEFT_WRIST, Unitize=False)  # -> Vector, Length
vector_2pt_3 = Vector2Pt(PointA=deconstructkeypoints34_4.RIGHT_ELBOW, PointB=deconstructkeypoints34_4.RIGHT_WRIST, Unitize=False)  # -> Vector, Length
vector_2pt_4 = Vector2Pt(PointA=deconstructkeypoints34_3.RIGHT_ELBOW, PointB=deconstructkeypoints34_3.RIGHT_WRIST, Unitize=False)  # -> Vector, Length
number_slider_3 = Slider(1.5, range=0..10)
number_slider_4 = Slider(1, range=0..1)
angle = Angle(VectorA=vector_2pt_4.Vector, VectorB=unit_z_3)  # -> Angle, Reflex
angle_2 = Angle(VectorA=vector_2pt.Vector, VectorB=unit_z_2)  # -> Angle, Reflex
angle_3 = Angle(VectorA=vector_2pt_3.Vector, VectorB=unit_z)  # -> Angle, Reflex
angle_4 = Angle(VectorA=vector_2pt_2.Vector, VectorB=unit_z)  # -> Angle, Reflex
vector_2pt_5 = Vector2Pt(PointA=deconstructkeypoints34_4.RIGHT_ELBOW, PointB=deconstructkeypoints34_4.RIGHT_HANDTIP, Unitize=False)  # -> Vector, Length
vector_2pt_6 = Vector2Pt(PointA=deconstructkeypoints34_3.RIGHT_ELBOW, PointB=deconstructkeypoints34_3.RIGHT_HANDTIP, Unitize=False)  # -> Vector, Length
larger_than_3 = LargerThan(FirstNumber=angle_2.Angle, SecondNumber=Slider(1, range=0..1))  # -> LargerThan, OrEqualTo
smaller_than_2 = SmallerThan(FirstNumber=angle_2.Angle, SecondNumber=Slider(1.5, range=0..10))  # -> SmallerThan, OrEqualTo
smaller_than_3 = SmallerThan(FirstNumber=angle.Angle, SecondNumber=Slider(0.2, range=0..1))  # -> SmallerThan, OrEqualTo
larger_than_4 = LargerThan(FirstNumber=angle_3.Angle, SecondNumber=number_slider_4)  # -> LargerThan, OrEqualTo
larger_than_5 = LargerThan(FirstNumber=angle_4.Angle, SecondNumber=number_slider_4)  # -> LargerThan, OrEqualTo
smaller_than_4 = SmallerThan(FirstNumber=angle_3.Angle, SecondNumber=number_slider_3)  # -> SmallerThan, OrEqualTo
smaller_than_5 = SmallerThan(FirstNumber=angle_4.Angle, SecondNumber=number_slider_3)  # -> SmallerThan, OrEqualTo
panel_26 = Panel(angle_2.Angle)
panel_27 = Panel(angle.Angle)
panel_28 = Panel(angle_4.Angle)
panel_29 = Panel(angle_3.Angle)
gate_and_4 = GateAnd(A=larger_than_5.LargerThan, B=larger_than_4.LargerThan, C=smaller_than_5.SmallerThan, D=smaller_than_4.SmallerThan)
gate_and_5 = GateAnd(A=larger_than_3.LargerThan, B=smaller_than_3.SmallerThan, C=smaller_than_2.SmallerThan)
deconstruct_7 = Deconstruct(Point=deconstructkeypoints34_3.RIGHT_HANDTIP)  # -> XComponent, YComponent, ZComponent
deconstruct_8 = Deconstruct(Point=deconstructkeypoints34_3.LEFT_HANDTIP)  # -> XComponent, YComponent, ZComponent
两手指尖距离 = Vector2Pt(PointA=deconstructkeypoints34_4.LEFT_HANDTIP, PointB=deconstructkeypoints34_4.RIGHT_HANDTIP, Unitize=False)  # -> Vector, Length
number_slider_5 = Slider(0, range=0..10)
panel_30 = Panel(gate_and_5)
panel_31 = Panel(gate_and_4)
subtraction = Subtraction(A=deconstruct_7.ZComponent, B=deconstruct_8.ZComponent)
absolute = Absolute(Value=subtraction)
panel_32 = Panel(两手指尖距离.Length)
list_item_6 = ListItem(List=absolute, Index=0, Wrap=True)
panel_33 = Panel(absolute)
list_item_7 = ListItem(List=两手指尖距离.Length, Index=0, Wrap=True)
panel_34 = Panel(list_item_7)
number_slider_6 = Slider(8, range=0..10)
dataqueue_2 = DataQueue(Data=list_item_7, RecordCount=number_slider_6)  # -> flatten(OutputData), OldestPath, NewestPath
number_slider_7 = Slider(8, range=0..10)
dataqueue_3 = DataQueue(Data=list_item_6, RecordCount=number_slider_7)  # -> flatten(OutputData), OldestPath, NewestPath
script_12 = Script(z_values=dataqueue_2.OutputData)  # -> out, result; inputs z_values: list of Double
# ---------- script_12: Python ----------
def calculate_differences(z_values):
    """
    计算数列绝对值的差分（后一个元素减去前一个元素）
    输入：包含12个数值的列表
    输出：包含11个差分结果的列表
    """
    if len(z_values) < 2:
        return []  # 处理输入不足的情况
    
    # 先对所有元素取绝对值，再计算差分
    abs_values = [abs(z) for z in z_values]
    return [abs_values[i+1] - abs_values[i] for i in range(len(abs_values)-1)]

# 主执行逻辑
try:
    # 获取输入参数
    z = z_values
    
    # 计算绝对值差分
    result = calculate_differences(z)
    
except Exception as e:
    # 错误处理
    result = "错误: " + str(e)
    print(result)

# 输出结果
result
# ---------- end script_12 ----------
subtraction_2 = Subtraction(A=number_slider_6, B=Slider(1, range=0..1))
absolute_2 = Absolute(Value=script_12.result)
mass_addition = MassAddition(Input=absolute_2)  # -> Result, PartialResults
script_13 = Script(z_values=dataqueue_3.OutputData)  # -> out, result; inputs z_values: list of Double; same code as script_12
division_3 = Division(A=mass_addition.Result, B=subtraction_2)
subtraction_3 = Subtraction(A=number_slider_7, B=Slider(1, range=0..1))
absolute_3 = Absolute(Value=script_13.result)
mass_addition_2 = MassAddition(Input=absolute_3)  # -> Result, PartialResults
subtraction_4 = Subtraction(A=absolute_2, B=division_3)
panel_35 = Panel(absolute_2)
square = Square(Value=subtraction_4)
division_4 = Division(A=mass_addition_2.Result, B=subtraction_3)
mass_addition_3 = MassAddition(Input=square)  # -> Result, PartialResults
division_5 = Division(A=mass_addition_3.Result, B=subtraction_2)
subtraction_5 = Subtraction(A=absolute_3, B=division_4)
panel_36 = Panel(absolute_3)
square_root = SquareRoot(Value=division_5)
square_2 = Square(Value=subtraction_5)
smaller_than_6 = SmallerThan(FirstNumber=square_root, SecondNumber=Slider(0.08, range=0..0.1))  # -> SmallerThan, OrEqualTo
mass_addition_4 = MassAddition(Input=square_2)  # -> Result, PartialResults
division_6 = Division(A=mass_addition_4.Result, B=subtraction_3)
panel_38 = Panel(square_root)
square_root_2 = SquareRoot(Value=division_6)
panel_40 = Panel(square_root_2)
smaller_than_7 = SmallerThan(FirstNumber=square_root_2, SecondNumber=Slider(0.03, range=0..1))  # -> SmallerThan, OrEqualTo
panel_41 = Panel(smaller_than_6.SmallerThan)
gate_and_6 = GateAnd(A=smaller_than_6.SmallerThan, B=gate_and_4)
gate_and_7 = GateAnd(A=smaller_than_7.SmallerThan, B=gate_and_5)
panel_42 = Panel(smaller_than_7.SmallerThan)
panel_43 = Panel(gate_and_7)
panel_44 = Panel(gate_and_6)

# ----
# #求极差
# x坐标幅度满足要求
# #缓存右脚踝的历史x坐标序列
# #波动幅度判断
dataqueue_4 = DataQueue(Data=deconstruct_5.XComponent, RecordCount=division_2)  # -> OutputData, OldestPath, NewestPath

# ----
# y坐标幅度满足要求
# #求极差
dataqueue_5 = DataQueue(Data=deconstruct_5.YComponent, RecordCount=division_2)  # -> OutputData, OldestPath, NewestPath

# ----
# y坐标幅度满足要求
# #求极差
# z坐移动是否大于某值？
dataqueue_6 = DataQueue(Data=deconstruct_5.ZComponent, RecordCount=division_2)  # -> OutputData, OldestPath, NewestPath

split_tree_5 = SplitTree(Data=dataqueue_4.OutputData, Masks=dataqueue_4.OldestPath)  # -> Positive, Negative
split_tree_6 = SplitTree(Data=dataqueue_4.OutputData, Masks=dataqueue_4.NewestPath)  # -> Positive, Negative
split_tree_7 = SplitTree(Data=dataqueue_5.OutputData, Masks=dataqueue_5.NewestPath)  # -> Positive, Negative
split_tree_8 = SplitTree(Data=dataqueue_5.OutputData, Masks=dataqueue_5.OldestPath)  # -> Positive, Negative
split_tree_9 = SplitTree(Data=dataqueue_6.OutputData, Masks=dataqueue_6.NewestPath)  # -> Positive, Negative
split_tree_10 = SplitTree(Data=dataqueue_6.OldestPath, Masks=dataqueue_6.OldestPath)  # -> Positive, Negative

subtraction_6 = Subtraction(A=split_tree_6.Positive, B=split_tree_5.Positive)

subtraction_7 = Subtraction(A=split_tree_9.Positive, B=split_tree_10.Positive)

subtraction_8 = Subtraction(A=split_tree_7.Positive, B=split_tree_8.Positive)

absolute_4 = Absolute(Value=subtraction_7)
absolute_5 = Absolute(Value=subtraction_8)
absolute_6 = Absolute(Value=subtraction_6)

larger_than_6 = LargerThan(FirstNumber=absolute_4, SecondNumber=Slider(0.05, range=0..1))  # -> LargerThan, OrEqualTo

smaller_than_8 = SmallerThan(FirstNumber=absolute_6, SecondNumber=Slider(0.023, range=0..1))  # -> SmallerThan, OrEqualTo

smaller_than_9 = SmallerThan(FirstNumber=absolute_5, SecondNumber=Slider(0.023, range=0..1))  # -> SmallerThan, OrEqualTo

gate_and_8 = GateAnd(A=smaller_than_8.SmallerThan, B=smaller_than_9.SmallerThan)
gate_and_9 = GateAnd(A=gate_and_8, B=larger_than_6.LargerThan)

# ---- group: 布尔脉冲
script_14 = Script(Result=gate_and_9)  # -> out, result; inputs Result: Boolean; same code as script_5

# ----
# #同时满足点【22】坐标变化，
# 和一次布尔脉冲，
# 才可触发切换选择
gate_and_10 = GateAnd(A=gate_and_9, B=script_14.result)

script_15 = Script(UnitCount=Slider(10, range=0..10), Toggle=gate_and_10)  # -> out, flatten(result); inputs UnitCount: Int32, Toggle: Boolean
# ---------- script_15: Python ----------
# 初始化当前选中的单元序号（从1开始）
if 'current_index' not in globals():
    current_index = 0

# 获取输入参数
unit_count = UnitCount  # 单元总数
toggle = Toggle         # True/False输入

# 确保单元数量有效
if unit_count is not None and unit_count > 0:
    # 当接收到True时，增加选中的单元序号
    if toggle is True:
        current_index += 1
        
        # 处理循环：当超过总数时从头开始
        if current_index > unit_count:
            current_index = (current_index - 1) % unit_count + 1
    
    # 输出当前选中的单元序号
    result = current_index
else:
    # 单元数量无效时返回None
    result = None

# 输出结果
result
# ---------- end script_15 ----------
data_recorder_4 = DataRecorder(gate_and_10, DataLimit=-10, RecordData=True)
data_recorder_5 = DataRecorder(script_15.result, DataLimit=-10, RecordData=True)
panel_46 = Panel(data_recorder_4)
panel_47 = Panel(data_recorder_5)

# ---- group: 分流，赋颜色
equality = Equality(FirstNumber=series, SecondNumber=script_15.result)  # -> Equality, Inequality
选中_未选中 = Dispatch(List=brep, DispatchPattern=equality.Equality)  # -> ListA, ListB
被选中 = ColourSwatch(SwatchColor=RGB(255, 43, 43))
未被选中 = ColourSwatch(SwatchColor=RGB(237, 237, 237))
mesh_colours = MeshColours(Mesh=选中_未选中.ListA, Colours=被选中)
mesh_colours_2 = MeshColours(Mesh=选中_未选中.ListB, Colours=未被选中)

# ----
relay = Relay([mesh_colours_2, mesh_colours])

# ----
# 接动作三、四的初始点
# 接动作三、四的变化后的点
# 0-23（24-1）
list_item_8 = ListItem(List=flatten(script_9.A), Index=script_15.result, Wrap=True)
panel_48 = Panel(list_item_8)
divide_curve_2 = DivideCurve(Curve=list_item_8, Count=Slider(2, range=0..100), Kinks=False)  # -> Points, Tangents, Parameters
number_slider_8 = Slider(1, range=0..10)
number_slider_9 = Slider(2, range=0..10)
cull_index = CullIndex(List=divide_curve_2.Points, Indices=[number_slider_8, number_slider_9], Wrap=True)
list_item_9 = ListItem(List=flatten(divide_curve_2.Points), Index=number_slider_8, Wrap=True)
list_item_10 = ListItem(List=flatten(divide_curve_2.Points), Index=number_slider_9, Wrap=True)
deconstruct_9 = Deconstruct(Point=list_item_10)  # -> XComponent, YComponent, ZComponent
deconstruct_10 = Deconstruct(Point=list_item_9)  # -> XComponent, YComponent, ZComponent
deconstruct_11 = Deconstruct(Point=cull_index)  # -> XComponent, YComponent, ZComponent
subtraction_9 = Subtraction(A=deconstruct_9.YComponent, B=deconstruct_10.YComponent)
panel_49 = Panel(subtraction_9)

subtraction_10 = Subtraction(A=deconstruct_11.ZComponent, B=deconstruct_6.ZComponent)

construct_domain = ConstructDomain(DomainStart=Slider(0, range=0..100), DomainEnd=subtraction_9)
construct_domain_2 = ConstructDomain(DomainStart=Slider(0, range=0..100), DomainEnd=subtraction_10)
remap_numbers = RemapNumbers(Value=absolute, Source=vector_2pt_6.Length, Target=construct_domain_2)  # -> Mapped, Clipped
panel_50 = Panel(remap_numbers.Mapped)
remap_numbers_2 = RemapNumbers(Value=两手指尖距离.Length, Source=vector_2pt_5.Length, Target=construct_domain)  # -> Mapped, Clipped
panel_52 = Panel(remap_numbers_2.Mapped)
script_16 = Script(x=remap_numbers.Mapped, trigger=gate_and_7)  # -> out, a; inputs x: Double, trigger: Boolean
# ---------- script_16: Python ----------
# 使用全局字典实现持久化存储
if "position_tracker" not in globals():
    global position_tracker
    position_tracker = {}

# 获取当前组件的唯一ID
comp_id = str(ghenv.Component.InstanceGuid)

# 初始化存储值（仅在第一次运行时执行）
if comp_id not in position_tracker:
    position_tracker[comp_id] = 0.0  # 初始值设为0.0

# 主逻辑处理
if trigger:
    # 布尔值为True：使用新值并更新存储
    position_tracker[comp_id] = x
    a = x
else:
    # 布尔值为False：使用存储的上一个值
    a = position_tracker[comp_id]
# ---------- end script_16 ----------
script_17 = Script(x=remap_numbers_2.Mapped, trigger=gate_and_6)  # -> out, a; inputs x: Double, trigger: Boolean; same code as script_16
negative = Negative(Value=script_16.a)
negative_2 = Negative(Value=script_17.a)
panel_53 = Panel(script_16.a)
panel_54 = Panel(script_17.a)
unit_z_4 = UnitZ(Factor=negative)
unit_y = UnitY(Factor=negative_2)

move_2 = Move(Geometry=list_item_9, Motion=unit_z_4)  # -> Geometry, Transform
move_3 = Move(Geometry=list_item_10, Motion=unit_y)  # -> Geometry, Transform
merge_2 = Merge(Data1=cull_index, Data2=move_2.Geometry, Data3=move_3.Geometry)  # -> flatten(Result)
panel_55 = Panel(merge_2)
interpolate = Interpolate(Vertices=merge_2, Degree=3, Periodic=False, KnotStyle=1)  # -> Curve, Length, Domain

cull_index_2 = CullIndex(List=flatten(script_9.A), Indices=script_15.result, Wrap=True)  # -> flatten(List)
insert_items = InsertItems(List=cull_index_2, Item=interpolate.Curve, Wrap=True)

panel_56 = Panel(cull_index_2)

# ----
# 帷幔变色切换
number_slider_10 = Slider(63, range=0..100)
divide = DivideCurve(Curve=insert_items, Count=number_slider_10, Kinks=False)  # -> Points, Tangents, Parameters
X = UnitX(Factor=Slider(1.5, range=0..10))
panel_57 = Panel(divide.Points)
move_4 = Move(Geometry=divide.Points, Motion=X)  # -> Geometry, Transform
ln = Line(StartPoint=divide.Points, EndPoint=move_4.Geometry)
Z = UnitZ(Factor=Slider(0.2, range=0..1))
extr = Extrude(Base=ln, Direction=Z)
brep_2 = Brep(extr)
Y = UnitY(Factor=Slider(0.2, range=0..1))
Y_2 = UnitY(Factor=Slider(0, range=0..0.1))
extr_2 = Extrude(Base=brep_2, Direction=Y)
move_5 = Move(Geometry=extr_2, Motion=Y_2)  # -> Geometry, Transform

multiplication_3 = Multiplication(A=divide.Parameters, B=Slider(3, range=0..10))
bounds = Bounds(Numbers=multiplication_3)
deconstruct_domain = DeconstructDomain(Domain=bounds)  # -> Start, End

gradient = Gradient(
    LowerLimit=deconstruct_domain.Start,
    UpperLimit=deconstruct_domain.End,
    Parameter=multiplication_3,
    stops=[0: RGB(243, 57, 0), 0.1: RGB(236, 27, 60), 0.2: RGB(210, 0, 118), 0.3: RGB(103, 0, 120), 0.4: RGB(39, 72, 161), 0.5: RGB(1, 192, 229), 0.6: RGB(18, 178, 90), 0.7: RGB(79, 186, 8), 0.8: RGB(220, 237, 32), 0.9: RGB(247, 159, 20), 1: RGB(243, 57, 0)])
preview = CustomPreview(Geometry=move_5.Geometry, Material=gradient)

panel_58 = Panel(bounds)

brep_3 = Brep(move_5.Geometry)
mesh = Mesh(brep_3)
send = Send(Timestamp=receive.Timestamp, Meshes=[mesh, relay])
