# Grasshopper definition questdemo.gh (Grasshopper 1.0.7)
# plug-ins: BodyAnalytics, RhinoCodePluginGH

# 这颗电池负责按一定刷新率激活
# 每次激活将最新数据传递给后面的gh电池。
number_slider = Slider(250, range=100..5000)
receive = Receive(Interval=Slider(250, range=0..1000))  # -> Timestamp, Body, PyMessage, RCSLocation

# ---- group: 下一个动作
characters = Characters(Text=receive.PyMessage)  # -> Result, Unicode
list_item = ListItem(List=characters.Result, Index=-1, Wrap=True)
panel = Panel(list_item)

# ----
receive_2 = Receive(Interval=number_slider)  # -> Timestamp, Body, PyMessage, RCSLocation
panel_2 = Panel(receive.PyMessage)
serverconnector = ServerConnector(Host="127.0.0.1", Port="8899", Run=Toggle(False))
panel_3 = Panel(receive_2.Timestamp)
body = Body(receive.Body)
panel_4 = Panel(receive_2.PyMessage)
body_2 = Body(receive_2.Body)
keypointsparser34 = KeypointsParser34()  # -> Pelvis, NavalSpine, ChestSpine, Neck, LeftClavicle, LeftShoulder, LeftElbow, LeftWrist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
keypointsparser34_2 = KeypointsParser34()  # -> Pelvis, NavalSpine, ChestSpine, Neck, LeftClavicle, LeftShoulder, LeftElbow, LeftWrist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

# ----
# Level 1 General Body
body_to_generalbody = BodyToGeneralBody()
generalbody = GeneralBody(body_to_generalbody)
deconstructgeneralbody = DeconstructGeneralBody(GeneralBody=generalbody)  # -> Id, UniqueObjectId, Position, Velocity, CenterAxis, BoundingBox, Dimensions, BoundingColumn, Radius, Orientation
line = Line(deconstructgeneralbody.CenterAxis)
brep = Brep(deconstructgeneralbody.BoundingColumn)

# ----
# L2 Macro Body
body_to_macrobody = BodyToMacroBody(Body=body)
macrobody = MacroBody(body_to_macrobody)
deconstructmacrobody = DeconstructMacroBody(MacroBody=macrobody)  # -> Id, UniqueObjectId, Keypoints, LocalPositionPerJoint, LocalOrientationPerJoint, GlobalRootOrientation
deconstructkeypoints34 = DeconstructKeypoints34(Keypoints=deconstructmacrobody.Keypoints)  # -> PELVIS, NAVAL_SPINE, CHEST_SPINE, NECK, LEFT_CLAVICLE, LEFT_SHOULDER, LEFT_ELBOW, LEFT_WRIST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
point = Point(deconstructkeypoints34.RIGHT_CLAVICLE)

list_item_2 = ListItem(List=body_2, Index=0, Wrap=True)
relay = Relay()
deconstruct_body = DeconstructBody(Body=list_item_2)  # -> Id, UniqueObjectId, ActionState, Position, Velocity, PositionCovariance, Confidence, HeadPosition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
_9_右手指尖 = ListItem(List=relay, Index=0, Wrap=True)
_16_左手指尖 = ListItem(List=relay, Index=1, Wrap=True)

# ----
# Level 0 Data Body
deconstruct_body_2 = DeconstructBody()  # -> Id, UniqueObjectId, ActionState, Position, Velocity, PositionCovariance, Confidence, HeadPosition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

# ----
# （1）9、16的高度超过18，
# 触发单元尺寸修改
deconstructkeypoints34_2 = DeconstructKeypoints34(Keypoints=deconstruct_body.Keypoints)  # -> PELVIS, NAVAL_SPINE, CHEST_SPINE, NECK, LEFT_CLAVICLE, LEFT_SHOULDER, LEFT_ELBOW, LEFT_WRIST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
右髋 = ListItem(List=deconstructkeypoints34_2.RIGHT_HIP, Index=0, Wrap=True)
右手指尖 = ListItem(List=deconstructkeypoints34_2.RIGHT_HANDTIP, Index=0, Wrap=True)
左手指尖 = ListItem(List=deconstructkeypoints34_2.LEFT_HANDTIP, Index=0, Wrap=True)
panel_5 = Panel(左手指尖)
deconstruct = Deconstruct(Point=右髋)  # -> XComponent, YComponent, ZComponent
deconstruct_2 = Deconstruct(Point=右手指尖)  # -> XComponent, YComponent, ZComponent
deconstruct_3 = Deconstruct(Point=左手指尖)  # -> XComponent, YComponent, ZComponent
larger_than = LargerThan(FirstNumber=deconstruct_2.ZComponent, SecondNumber=deconstruct.ZComponent)  # -> LargerThan, OrEqualTo
larger_than_2 = LargerThan(FirstNumber=deconstruct_3.ZComponent, SecondNumber=deconstruct.ZComponent)  # -> LargerThan, OrEqualTo
constructbody = ConstructBody()
constructgeneralbody = ConstructGeneralBody()
division = Division(A=Slider(3000, range=0..10000), B=number_slider)
# （2）9、16点在3秒内位置变动小于X
dataqueue = DataQueue(Data=左手指尖, RecordCount=division)  # -> OutputData, OldestPath, NewestPath
# （3）测量9与16之间的距离Y
mass_addition = MassAddition(Input=dataqueue.OutputData)  # -> Result, PartialResults
constructgeneralbody_2 = ConstructGeneralBody()

merge = Merge(Data1=Slider(4.11, range=0..10), Data2=Slider(3.21, range=0..10))  # -> graft(Result)
dataqueue_2 = DataQueue(Data=merge, RecordCount=Slider(10, range=0..10))  # -> OutputData, OldestPath, NewestPath
panel_6 = Panel(merge)
split_tree = SplitTree(Data=dataqueue_2.OutputData, Masks=flatten(dataqueue_2.OldestPath))  # -> Positive, Negative
panel_7 = Panel(dataqueue_2.OldestPath)
panel_8 = Panel(dataqueue_2.NewestPath)
panel_9 = Panel(dataqueue_2.OutputData)
panel_10 = Panel(split_tree.Positive)

division_2 = Division(A=mass_addition.Result, B=division)
subtraction = Subtraction(A=dataqueue.OutputData, B=division_2)
square = Square(Value=subtraction)
constructkeypoints = ConstructKeypoints()
# （4）一整片切分为Y米一片，
# 若无法整除，则最后一片取余数
mass_addition_2 = MassAddition(Input=square)  # -> Result, PartialResults
division_3 = Division(A=mass_addition_2.Result, B=division)
square_root = SquareRoot(Value=division_3)
larger_than_3 = LargerThan(FirstNumber=square_root, SecondNumber=Slider(0, range=0..10))  # -> LargerThan, OrEqualTo
gate_and = GateAnd(A=larger_than_2.LargerThan, B=larger_than.LargerThan)
distance = Distance(PointA=左手指尖, PointB=右手指尖)
gate_and_2 = GateAnd(A=larger_than_3.LargerThan, B=gate_and)
script = Script(Distance=Slider(5, range=0..10), Result=Toggle(False))  # -> a; inputs Distance: Int32, Result: Boolean
# ---------- script: Python ----------
# 导入必要的库
import rhinoscriptsyntax as rs

# 获取输入参数
result = Result  # 前一个电池组的布尔输出
distance = Distance  # 距离值

# 根据result的值决定是否输出distance
if result:
    b = distance  # 将distance赋值给输出参数a
else:
    b = None  # 不输出任何值
# ---------- end script ----------
brep_2 = Brep(<brep referenced from the Rhino model>)
mesh = Mesh(brep_2)
panel_11 = Panel(script)
mesh_colours = MeshColours(Mesh=mesh, Colours=ColourSwatch(SwatchColor=RGB(142, 20, 255)))
send = Send(Timestamp=receive.Timestamp, Meshes=mesh_colours)  # disabled
