# Grasshopper definition teststrides.gh (Grasshopper 1.0.7)
# plug-ins: BodyAnalytics, Wallacei

# ----
# 提取文件中的关节点
file_path = FilePath("E:\研究生\研1\15 设计课\0522实验\切分数据处理\1523_87.5.csv")
keypointsextract = KeypointsExtract(FilePath=file_path)  # -> Status, FileKeypoints
keypointsparser17 = KeypointsParser17()  # -> Hip, RHip, RKnee, RFoot, LHip, LKnee, LFoot, Spine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
keypointsparser18 = KeypointsParser18()  # -> Nose, Neck, RightShoulder, RightElbow, RightWrist, LeftShoulder, LeftElbow, LeftWrist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
keypointsparser34 = KeypointsParser34(FileKeypoints=keypointsextract.FileKeypoints)  # -> Pelvis, NavalSpine, ChestSpine, Neck, LeftClavicle, LeftShoulder, LeftElbow, LeftWrist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
keypointsparser38 = KeypointsParser38()  # -> Pelvis, Spine1, Spine2, Spine3, Neck, Nose, LeftEye, RightEye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

# ----
# 按照ID分割保存的文件
file_path_2 = FilePath("E:\研究生\研1\15 设计课\0522实验\切分数据处理\1523_87.5.csv")
splitcsvbyid = SplitCsvById(FilePath=file_path_2)

splitcsvbyid_2 = SplitCsvById()
panel = Panel(splitcsvbyid)
merge = Merge(Data1=Slider(1.97, range=0..10), Data2=Slider(4.2, range=0..10))  # -> graft(Result)
dataqueue = DataQueue(Data=merge, RecordCount=Slider(5, range=0..10))  # -> OutputData, OldestPath, NewestPath
panel_2 = Panel(merge)
split_tree = SplitTree(Data=dataqueue.OutputData, Masks=flatten(dataqueue.NewestPath))  # -> Positive, Negative
panel_3 = Panel(dataqueue.OldestPath)
panel_4 = Panel(dataqueue.NewestPath)
panel_5 = Panel(dataqueue.OutputData)
panel_6 = Panel(split_tree.Positive)
item = ListItem(List=keypointsparser34.LeftHand, Index=Slider(20, range=0..100), Wrap=True)
panel_7 = Panel(item)

# ----
# 解析文件 分析数据
# 计算步态指标 可视化
number_slider = Slider(0.044, range=-0.9..0.1)
file_path_3 = FilePath("D:\_档案\_行为研究\20240423PPS实验\perspective_csv\perspective_void\1.01_1_perspective.csv")
stridesanalyze = StridesAnalyze(FilePath=file_path_3, ZThreshold=number_slider, FrameIndex=0, FrameInterval=1)  # -> Status, Strides, StrideIndices, LeftZ, RightZ, PoseLines, DoubleSupportFrames, SingleFrameLines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
doublesupporttimevisualizer = DoubleSupportTimeVisualizer(PoseLines=stridesanalyze.PoseLines, DoubleSupportFrames=stridesanalyze.DoubleSupportFrames, FrameRate=30)  # -> VisualizedLines, Durations
stridewidthvisualizer = StrideWidthVisualizer(
    StrideIndices=stridesanalyze.StrideIndices,
    PoseLines=stridesanalyze.PoseLines,
    StrideFootPoints=stridesanalyze.StrideFootPoints,
    StrideOrientations=stridesanalyze.StrideOrientations)  # -> StrideWidths, VisualLines
stridelengthvisualizer = StrideLengthVisualizer(
    StrideIndices=stridesanalyze.StrideIndices,
    PoseLines=stridesanalyze.PoseLines,
    StrideFootPoints=stridesanalyze.StrideFootPoints,
    StrideOrientations=stridesanalyze.StrideOrientations)  # -> StrideLengths, VisualLines
stridevelocityvisualizer = StrideVelocityVisualizer(
    StrideIndices=stridesanalyze.StrideIndices,
    PoseLines=stridesanalyze.PoseLines,
    StrideLengths=stridelengthvisualizer.StrideLengths,
    FrameRate=30)  # -> StrideVelocities, VisualLines
negative = Negative(Value=stridesanalyze.Strides)
panel_8 = Panel(stridesanalyze.Strides)
wlc_maxstrides111 = Number(negative)

average = Average(Input=stridelengthvisualizer.StrideLengths)
subtraction = Subtraction(A=stridelengthvisualizer.StrideLengths, B=average)
square = Square(Value=subtraction)
mass_addition = MassAddition(Input=square)  # -> Result, PartialResults

wlc_minslvariety222 = Number(mass_addition.Result)
wallacei_x = WallaceiX(
    Genes=number_slider,
    Objectives=[wlc_maxstrides111, wlc_minslvariety222],
    Phenotype=stridesanalyze.PoseLines,
    allFitness="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",
    allFrontIdx="3|0;5|1;7|2;10|3;10|4;14|5;17|6;17|7",
    allGenomes="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",
    curFrontIdx="19|0;19|1;19|2;19|3;19|4;19|5;19|6;19|7",
    curFrontIdxSave="0|6;1|0;2|0;2|1;2|2;3|0;4|0;5|0;5|1;6|0;6|1;7|0;7|1;7|2;8|0;8|1;8|2;9|0;9|1;9|2;10|0;10|1;10|2;10|3;10|4;11|0;11|1;11|2;11|3;11|4;12|0;12|1;12|2;12|3;12|4;13|0;13|1;13|2;13|3;13|4;14|0;14|1;14|2;14|3;14|4;14|5;15|0;15|1;15|2;15|3;15|4;15|5;16|0;16|1;16|2;16|3;16|4;16|5;17|0;17|1;17|2;17|3;17|4;17|5;17|6;17|7;18|0;18|1;18|2;18|3;18|4;18|5;18|6;18|7;19|0;19|1;19|2;19|3;19|4;19|5;19|6;19|7",
    popGen="10,20",
    total="5813",
    wlcDone=True)  # -> WallaceiGenomes, FitnessValues, Data, Phenotypes
decode_genome = DecodeGenome(WallaceiGenome=wallacei_x.WallaceiGenomes)
panel_9 = Panel(decode_genome)
distribute_to_grid = DistributeToGrid(
    FitnessValues=wallacei_x.FitnessValues,
    WallaceiPhenotypes=wallacei_x.Phenotypes,
    SizeOfTheGridInTheXDirection=Slider(5, range=0..10),
    SizeOfTheGridInTheYDirection=Slider(10, range=0..10),
    OutputOptions=0)  # -> DistributedFitnessValues, DistributedData, DistributedGeometries, DistributedMeshes, DistributedNumbers, GridLocations
panel_10 = Panel(wallacei_x.FitnessValues)
