# Grasshopper definition 动作1-定单元宽度.gh (Grasshopper 1.0.7)
# plug-ins: BodyAnalytics, RhinoCodePluginGH

serverconnector = ServerConnector(Host="127.0.0.1", Port="8899", Run=Toggle(False))
# 这颗电池负责按一定刷新率激活
# 每次激活将最新数据传递给后面的gh电池。
number_slider = Slider(250, range=100..5000)
receive = Receive(Interval=number_slider)  # -> Timestamp, Body, PyMessage, RCSLocation
panel = Panel(receive.Timestamp)
panel_2 = Panel(receive.PyMessage)
deconstruct_body = DeconstructBody(Body=receive.Body)  # -> Id, UniqueObjectId, ActionState, Position, Velocity, PositionCovariance, Confidence, HeadPosition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
panel_3 = Panel(deconstruct_body.Position)

# ----
# 动作一地贴
point = Point(<point referenced from the Rhino model>)

# ----
# 第一个人
# 第二个人
list_item = ListItem(List=deconstruct_body.Position, Index=0, Wrap=True)  # -> Item, Item1

distance = Distance(PointA=list_item.Item1, PointB=point)
distance_2 = Distance(PointA=list_item.Item, PointB=point)
panel_4 = Panel(distance_2)
script = Script(distanceA=distance_2, distanceB=distance)  # -> out, result; inputs distanceA: Double, distanceB: Double
# ---------- script: Python ----------
def compare_distances(distanceA, distanceB):
    """
    比较两个距离值，返回对应的文本格式编号：
    - distanceA < distanceB 时返回 "{0;0;0}"
    - distanceB < distanceA 时返回 "{0;0;1}"
    """
    if distanceA < distanceB:
        return "{0;0;0}"
    elif distanceB < distanceA:
        return "{0;0;1}"
    else:
        return "{0;0;0}"  # 相等时默认返回"{0;0;0}"，可按需修改

# 主执行逻辑
try:
    # 获取输入参数（注意参数名需与Grasshopper组件中设置的一致）
    a = distanceA
    b = distanceB
    
    # 执行比较并获取结果
    result = compare_distances(a, b)
    
except Exception as e:
    # 错误处理（返回错误信息文本）
    result = "错误: " + str(e)

# 输出结果
result
# ---------- end script ----------
panel_5 = Panel(script.result)
split_tree = SplitTree(Data=deconstruct_body.Keypoints, Masks=flatten(script.result))  # -> Positive, Negative
panel_6 = Panel(split_tree.Positive)
deconstructkeypoints34 = DeconstructKeypoints34(Keypoints=split_tree.Positive)  # -> PELVIS, NAVAL_SPINE, CHEST_SPINE, NECK, LEFT_CLAVICLE, LEFT_SHOULDER, LEFT_ELBOW, LEFT_WRIST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

# ----
# 右腕
右手指尖 = ListItem(List=deconstructkeypoints34.RIGHT_WRIST, Index=0, Wrap=True)

# ----
# 左腕
右手指尖_2 = ListItem(List=deconstructkeypoints34.LEFT_WRIST, Index=0, Wrap=True)

# ----
# 脊椎（胸部）
右髋 = ListItem(List=deconstructkeypoints34.NAVAL_SPINE, Index=0, Wrap=True)

# ----
# （1）9、16的高度超过18，触发单元尺寸修改
deconstruct = Deconstruct(Point=右手指尖_2)  # -> XComponent, YComponent, ZComponent
deconstruct_2 = Deconstruct(Point=右髋)  # -> XComponent, YComponent, ZComponent
deconstruct_3 = Deconstruct(Point=右手指尖)  # -> XComponent, YComponent, ZComponent
division = Division(A=Slider(3000, range=0..10000), B=number_slider)
larger_than = LargerThan(FirstNumber=deconstruct_3.ZComponent, SecondNumber=deconstruct_2.ZComponent)  # -> LargerThan, OrEqualTo
larger_than_2 = LargerThan(FirstNumber=deconstruct.ZComponent, SecondNumber=deconstruct_2.ZComponent)  # -> LargerThan, OrEqualTo
dataqueue = DataQueue(Data=右手指尖_2, RecordCount=division)  # -> flatten(OutputData), OldestPath, NewestPath
# （2）9、16点在3秒内位置变动小于X
deconstruct_4 = Deconstruct(Point=dataqueue.OutputData)  # -> XComponent, YComponent, ZComponent
script_2 = Script(input_list=deconstruct_4.ZComponent)  # -> out, result; inputs input_list: list of Double
# ---------- script_2: Python ----------
# 直接计算12元素列表的首尾差值绝对值
data = input_list

# 确保输入是包含12个元素的列表
if data is not None and len(data) == 12:
    result = abs(data[11] - data[0])  # 使用固定索引11（第12个元素）
else:
    result = None  # 不符合条件时返回None，表示不输出

# 输出结果
result
# ---------- end script_2 ----------
smaller_than = SmallerThan(FirstNumber=script_2.result, SecondNumber=Slider(0.02, range=0..1))  # -> SmallerThan, OrEqualTo
data_recorder = DataRecorder(script_2.result, DataLimit=-10, RecordData=True)
script_3 = Script(Result=smaller_than.SmallerThan)  # -> out, result; inputs Result: Boolean
# ---------- script_3: Python ----------
# 初始化历史记录列表（使用全局变量保持状态）
if 'history' not in globals():
    history = []

# 获取当前帧的布尔值
current_value = Result

# 添加当前值到历史记录
if current_value is not None:
    history.append(current_value)

# 检查是否存在连续两个及以上的True
result = False
if len(history) >= 2:
    for i in range(len(history) - 1):
        if history[i] and history[i+1]:
            result = True
            break

# 输出结果
result
# ---------- end script_3 ----------
gate_and = GateAnd(A=larger_than_2.LargerThan, B=larger_than.LargerThan)
# （3）测量9与16之间的距离Y
panel_7 = Panel(data_recorder)
data_recorder_2 = DataRecorder(gate_and, DataLimit=-10, RecordData=True)
data_recorder_3 = DataRecorder(script_3.result, DataLimit=-10, RecordData=True)
gate_and_2 = GateAnd(A=script_3.result, B=gate_and)
data_recorder_4 = DataRecorder(gate_and_2, DataLimit=-10, RecordData=True)
panel_8 = Panel(data_recorder_2)
panel_9 = Panel(data_recorder_3)
panel_10 = Panel(data_recorder_4)
distance_3 = Distance(PointA=右手指尖_2, PointB=右手指尖)
script_4 = Script(Result=gate_and_2)  # -> out, result; inputs Result: Boolean
# ---------- script_4: Python ----------
# 初始化存储历史结果的列表（使用全局变量保持状态）
if 'history' not in globals():
    history = []

# 获取当前帧的布尔值
current_value = Result

# 添加当前值到历史记录
if current_value is not None:
    history.append(current_value)

# 确保历史记录至少有两个值
if len(history) >= 2:
    # 获取最后两个值
    last_value = history[-1]
    second_last_value = history[-2]
    
    # 判断是否一个为True，另一个为False
    result = (last_value != second_last_value)
else:
    # 历史记录不足时返回False
    result = False

# 输出结果
result
# ---------- end script_4 ----------
data_recorder_5 = DataRecorder(script_4.result, DataLimit=-10, RecordData=True)
script_5 = Script(distance=distance_3)  # -> out, result; inputs distance: Double
# ---------- script_5: Python ----------
def limit_min_distance(distance):
    """
    限制距离的最小值为0.2：
    - 若distance ≤ 0.2，返回0.2
    - 若distance > 0.2，返回原数
    """
    return max(0.2, distance)

# 主执行逻辑
try:
    # 获取输入参数
    d = distance
    
    # 应用最小值限制
    result = limit_min_distance(d)
    
except Exception as e:
    # 错误处理
    result = "错误: " + str(e)
    print(result)

# 输出结果
result
# ---------- end script_5 ----------
panel_11 = Panel(data_recorder_5)
gate_and_3 = GateAnd(A=gate_and_2, B=script_4.result)
panel_12 = Panel(gate_and_3)
data_recorder_6 = DataRecorder(gate_and_3, DataLimit=-10, RecordData=True)
script_6 = Script(Distance=script_5.result, Result=gate_and_3)  # -> a, b; inputs Distance: Double, Result: Boolean
# ---------- script_6: Python ----------
# 导入必要的库
import rhinoscriptsyntax as rs

# 获取输入参数
result = Result  # 前一个电池组的布尔输出
distance = Distance  # 距离值

# 根据result的值决定是否输出distance
if result:
    b = distance  # 将distance赋值给输出参数a
else:
    b = None  # 不输出任何值
# ---------- end script_6 ----------
# b为每一小片单元的宽度
panel_13 = Panel(data_recorder_6)
panel_14 = Panel(script_6.b)
point_2 = Point(<point referenced from the Rhino model>)
point_3 = Point(<point referenced from the Rhino model>)
data_recorder_7 = DataRecorder(script_6.b, DataLimit=-10, RecordData=True)
# （4）一整片切分为Y米一片，
# 若无法整除，则最后一片取余数
distance_4 = Distance(PointA=point_3, PointB=point_2)
panel_15 = Panel(data_recorder_7)
modulus = Modulus(A=distance_4, B=script_6.b)
# 输出为等分后最后一片的宽度（余数）
data_recorder_8 = DataRecorder(modulus, DataLimit=-10, RecordData=True)
panel_16 = Panel(data_recorder_8)
brep = Brep(<brep referenced from the Rhino model>)
mesh = Mesh(brep)
send = Send(Timestamp=receive.Timestamp, Message="我是GH", Meshes=mesh)

number_slider_2 = Slider(1, range=0..1)  # disabled
script_7 = Script()  # -> out, result; inputs z_values: list of Double; disabled
# ---------- script_7: Python ----------
def calculate_differences(z_values):
    """
    计算数列绝对值的差分（后一个元素减去前一个元素）
    输入：包含12个数值的列表
    输出：包含11个差分结果的列表
    """
    if len(z_values) < 2:
        return []  # 处理输入不足的情况
    
    # 先对所有元素取绝对值，再计算差分
    abs_values = [abs(z) for z in z_values]
    return [abs_values[i+1] - abs_values[i] for i in range(len(abs_values)-1)]

# 主执行逻辑
try:
    # 获取输入参数
    z = z_values
    
    # 计算绝对值差分
    result = calculate_differences(z)
    
except Exception as e:
    # 错误处理
    result = "错误: " + str(e)
    print(result)

# 输出结果
result
# ---------- end script_7 ----------
absolute = Absolute(Value=script_7.result)  # disabled
subtraction = Subtraction(B=number_slider_2)  # disabled
mass_addition = MassAddition(Input=absolute)  # -> Result, PartialResults; disabled
panel_17 = Panel(absolute)  # disabled
division_2 = Division(A=mass_addition.Result, B=subtraction)  # disabled
subtraction_2 = Subtraction(A=absolute, B=division_2)  # disabled
square = Square(Value=subtraction_2)  # disabled
mass_addition_2 = MassAddition(Input=square)  # -> Result, PartialResults; disabled
division_3 = Division(A=mass_addition_2.Result, B=subtraction)  # disabled
square_root = SquareRoot(Value=division_3)  # disabled
