# Grasshopper definition 动作2-右脚跺脚选择.gh (Grasshopper 1.0.7)
# plug-ins: BodyAnalytics, RhinoCodePluginGH

# 这颗电池负责按一定刷新率激活
# 每次激活将最新数据传递给后面的gh电池。
多少毫秒抽一帧 = Slider(250, range=100..5000)
receive = Receive(Interval=多少毫秒抽一帧)  # -> Timestamp, Body, PyMessage, RCSLocation
serverconnector = ServerConnector(Host="127.0.0.1", Port="8899", Run=Toggle(False))

# ---- group: 筛选ID
# 动作一地贴
point = Point(<point referenced from the Rhino model>)

# ----
# #决定序列规模（单位时间抽几帧）
回溯多少毫秒之前的帧数 = Slider(1000, range=0..10000)
division = Division(A=回溯多少毫秒之前的帧数, B=多少毫秒抽一帧)

# ---- group: 获取帷幔序列
brep = Brep([<brep referenced from the Rhino model> x5])
list_length = ListLength(List=brep)
起始号 = Slider(1, range=0..1)
步数 = Slider(1, range=0..1)
series = Series(Start=起始号, Step=步数, Count=list_length)

# ----
# 替换成左上方的length
number_slider = Slider(10, range=0..10)

# ---- group: 筛选ID
deconstruct_body = DeconstructBody(Body=receive.Body)  # -> Id, UniqueObjectId, ActionState, Position, Velocity, PositionCovariance, Confidence, HeadPosition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
panel = Panel(deconstruct_body.Position)

# 第一个人
# 第二个人
list_item = ListItem(List=deconstruct_body.Position, Index=0, Wrap=True)  # -> Item, Item1

distance = Distance(PointA=list_item.Item1, PointB=point)
distance_2 = Distance(PointA=list_item.Item, PointB=point)
panel_2 = Panel(distance_2)
script = Script(distanceA=distance_2, distanceB=distance)  # -> out, result; inputs distanceA: Double, distanceB: Double
# ---------- script: Python ----------
def compare_distances(distanceA, distanceB):
    """
    比较两个距离值，返回对应的文本格式编号：
    - distanceA < distanceB 时返回 "{0;0;0}"
    - distanceB < distanceA 时返回 "{0;0;1}"
    """
    if distanceA < distanceB:
        return "{0;0;0}"
    elif distanceB < distanceA:
        return "{0;0;1}"
    else:
        return "{0;0;0}"  # 相等时默认返回"{0;0;0}"，可按需修改

# 主执行逻辑
try:
    # 获取输入参数（注意参数名需与Grasshopper组件中设置的一致）
    a = distanceA
    b = distanceB
    
    # 执行比较并获取结果
    result = compare_distances(a, b)
    
except Exception as e:
    # 错误处理（返回错误信息文本）
    result = "错误: " + str(e)

# 输出结果
result
# ---------- end script ----------
split_tree = SplitTree(Data=deconstruct_body.Keypoints, Masks=flatten(script.result))  # -> Positive, Negative

# ----
deconstructkeypoints34 = DeconstructKeypoints34(Keypoints=split_tree.Positive)  # -> PELVIS, NAVAL_SPINE, CHEST_SPINE, NECK, LEFT_CLAVICLE, LEFT_SHOULDER, LEFT_ELBOW, LEFT_WRIST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
左手指尖 = ListItem(List=deconstructkeypoints34.RIGHT_ANKLE, Index=0, Wrap=True)
deconstruct = Deconstruct(Point=左手指尖)  # -> XComponent, YComponent, ZComponent

# ----
# 右脚踝z轴在某时间内位移超过某值，
# 且xy平面位移小于某值，
# 触发单元选择切换
# #求极差
# x坐标幅度满足要求
# #缓存右脚踝的历史x坐标序列
# #波动幅度判断
dataqueue = DataQueue(Data=deconstruct.XComponent, RecordCount=division)  # -> OutputData, OldestPath, NewestPath

split_tree_2 = SplitTree(Data=dataqueue.OutputData, Masks=dataqueue.OldestPath)  # -> Positive, Negative
split_tree_3 = SplitTree(Data=dataqueue.OutputData, Masks=dataqueue.NewestPath)  # -> Positive, Negative

# ----
# y坐标幅度满足要求
# #求极差
dataqueue_2 = DataQueue(Data=deconstruct.YComponent, RecordCount=division)  # -> OutputData, OldestPath, NewestPath

split_tree_4 = SplitTree(Data=dataqueue_2.OutputData, Masks=dataqueue_2.NewestPath)  # -> Positive, Negative
split_tree_5 = SplitTree(Data=dataqueue_2.OutputData, Masks=dataqueue_2.OldestPath)  # -> Positive, Negative

# ----
# y坐标幅度满足要求
# #求极差
# z坐移动是否大于某值？
dataqueue_3 = DataQueue(Data=deconstruct.ZComponent, RecordCount=division)  # -> OutputData, OldestPath, NewestPath

split_tree_6 = SplitTree(Data=dataqueue_3.OutputData, Masks=dataqueue_3.NewestPath)  # -> Positive, Negative
split_tree_7 = SplitTree(Data=dataqueue_3.OldestPath, Masks=dataqueue_3.OldestPath)  # -> Positive, Negative

subtraction = Subtraction(A=split_tree_3.Positive, B=split_tree_2.Positive)

absolute = Absolute(Value=subtraction)
data_recorder = DataRecorder(absolute, DataLimit=-10, RecordData=True)

smaller_than = SmallerThan(FirstNumber=absolute, SecondNumber=Slider(0.023, range=0..1))  # -> SmallerThan, OrEqualTo

panel_3 = Panel(data_recorder)

subtraction_2 = Subtraction(A=split_tree_6.Positive, B=split_tree_7.Positive)

absolute_2 = Absolute(Value=subtraction_2)

larger_than = LargerThan(FirstNumber=absolute_2, SecondNumber=Slider(0.05, range=0..1))  # -> LargerThan, OrEqualTo

data_recorder_2 = DataRecorder(absolute_2, DataLimit=-10, RecordData=True)
panel_4 = Panel(data_recorder_2)

subtraction_3 = Subtraction(A=split_tree_4.Positive, B=split_tree_5.Positive)

absolute_3 = Absolute(Value=subtraction_3)

smaller_than_2 = SmallerThan(FirstNumber=absolute_3, SecondNumber=Slider(0.023, range=0..1))  # -> SmallerThan, OrEqualTo

data_recorder_3 = DataRecorder(absolute_3, DataLimit=-10, RecordData=True)
gate_and = GateAnd(A=smaller_than.SmallerThan, B=smaller_than_2.SmallerThan)
data_recorder_4 = DataRecorder(gate_and, DataLimit=-10, RecordData=True)
panel_5 = Panel(data_recorder_3)
gate_and_2 = GateAnd(A=gate_and, B=larger_than.LargerThan)
data_recorder_5 = DataRecorder(gate_and_2, DataLimit=-10, RecordData=True)
panel_6 = Panel(data_recorder_4)
panel_7 = Panel(data_recorder_5)

# ---- group: 布尔脉冲
script_2 = Script(Result=gate_and_2)  # -> out, result; inputs Result: Boolean
# ---------- script_2: Python ----------
# 初始化存储历史结果的列表（使用全局变量保持状态）
if 'history' not in globals():
    history = []

# 获取当前帧的布尔值
current_value = Result

# 添加当前值到历史记录
if current_value is not None:
    history.append(current_value)

# 确保历史记录至少有两个值
if len(history) >= 2:
    # 获取最后两个值
    last_value = history[-1]
    second_last_value = history[-2]
    
    # 判断是否一个为True，另一个为False
    result = (last_value != second_last_value)
else:
    # 历史记录不足时返回False
    result = False

# 输出结果
result
# ---------- end script_2 ----------

# ----
# #同时满足点【22】坐标变化，
# 和一次布尔脉冲，
# 才可触发切换选择
# ##不存在触发两次的问题：
# 点【22】坐标变化很快时（跺脚），
# 第二个布尔门会从False变成True（变换一次，第三个布尔门变True），
# 并且可能会连着输出好几个True
# 但此时没发生布尔变换），所以第三个布尔门变回False
# 
# 当跺脚结束，第二个布尔门变False（变换一次）
# 但不满足前一个点【22】坐标变化的条件
# 所以第三个布尔门还是False
gate_and_3 = GateAnd(A=gate_and_2, B=script_2.result)

# ----
# 输出跺脚后选中的序列号
script_3 = Script(UnitCount=number_slider, Toggle=gate_and_3)  # -> out, result; inputs UnitCount: Int32, Toggle: Boolean
# ---------- script_3: Python ----------
# 初始化当前选中的单元序号（从1开始）
if 'current_index' not in globals():
    current_index = 0

# 获取输入参数
unit_count = UnitCount  # 单元总数
toggle = Toggle         # True/False输入

# 确保单元数量有效
if unit_count is not None and unit_count > 0:
    # 当接收到True时，增加选中的单元序号
    if toggle is True:
        current_index += 1
        
        # 处理循环：当超过总数时从头开始
        if current_index > unit_count:
            current_index = (current_index - 1) % unit_count + 1
    
    # 输出当前选中的单元序号
    result = current_index
else:
    # 单元数量无效时返回None
    result = None

# 输出结果
result
# ---------- end script_3 ----------
data_recorder_6 = DataRecorder(gate_and_3, DataLimit=-10, RecordData=True)
data_recorder_7 = DataRecorder(script_3.result, DataLimit=-10, RecordData=True)
panel_8 = Panel(data_recorder_6)
panel_9 = Panel(data_recorder_7)

# ---- group: 分流，赋颜色
equality = Equality(FirstNumber=series, SecondNumber=script_3.result)  # -> Equality, Inequality
选中_未选中 = Dispatch(List=brep, DispatchPattern=equality.Equality)  # -> ListA, ListB
被选中 = ColourSwatch(SwatchColor=RGB(255, 43, 43))
未被选中 = ColourSwatch(SwatchColor=RGB(237, 237, 237))
mesh_colours = MeshColours(Mesh=选中_未选中.ListA, Colours=被选中)
mesh_colours_2 = MeshColours(Mesh=选中_未选中.ListB, Colours=未被选中)

# ----
send = Send(Timestamp=receive.Timestamp, Meshes=mesh_colours_2)  # disabled
send_2 = Send(Timestamp=receive.Timestamp, Meshes=mesh_colours)  # disabled
