# Grasshopper definition 动作3-4控制点移动02.gh (Grasshopper 1.0.7)
# plug-ins: BodyAnalytics, RhinoCodePluginGH

# 这颗电池负责按一定刷新率激活
# 每次激活将最新数据传递给后面的gh电池。
number_slider = Slider(250, range=100..5000)
# 这颗电池负责按一定刷新率激活
# 每次激活将最新数据传递给后面的gh电池。
number_slider_2 = Slider(250, range=100..5000)
receive = Receive(Interval=number_slider)  # -> Timestamp, Body, PyMessage, RCSLocation
receive_2 = Receive(Interval=number_slider_2)  # -> Timestamp, Body, PyMessage, RCSLocation
serverconnector = ServerConnector(Host="127.0.0.1", Port="8899", Run=Toggle(False))
panel = Panel(receive.Timestamp)
panel_2 = Panel(receive.PyMessage)
panel_3 = Panel(receive_2.Timestamp)
panel_4 = Panel(receive_2.PyMessage)
deconstruct_body = DeconstructBody(Body=receive.Body)  # -> Id, UniqueObjectId, ActionState, Position, Velocity, PositionCovariance, Confidence, HeadPosition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
deconstruct_body_2 = DeconstructBody(Body=receive_2.Body)  # -> Id, UniqueObjectId, ActionState, Position, Velocity, PositionCovariance, Confidence, HeadPosition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
panel_5 = Panel(deconstruct_body.Position)
panel_6 = Panel(deconstruct_body_2.Position)

# ----
# 动作三地贴
point = Point(<point referenced from the Rhino model>)

# ----
# 第一个人
# 第二个人
list_item = ListItem(List=deconstruct_body.Position, Index=0, Wrap=True)  # -> Item, Item1

# ----
# 动作四地贴
point_2 = Point(<point referenced from the Rhino model>)

# ----
# 第一个人
# 第二个人
list_item_2 = ListItem(List=deconstruct_body_2.Position, Index=0, Wrap=True)  # -> Item, Item1

distance = Distance(PointA=list_item.Item1, PointB=point)
distance_2 = Distance(PointA=list_item.Item, PointB=point)
distance_3 = Distance(PointA=list_item_2.Item1, PointB=point_2)
distance_4 = Distance(PointA=list_item_2.Item, PointB=point_2)
panel_7 = Panel(distance_2)
script = Script(distanceA=distance_2, distanceB=distance)  # -> out, result; inputs distanceA: Double, distanceB: Double
# ---------- script: Python ----------
def compare_distances(distanceA, distanceB):
    """
    比较两个距离值，返回对应的文本格式编号：
    - distanceA < distanceB 时返回 "{0;0;0}"
    - distanceB < distanceA 时返回 "{0;0;1}"
    """
    if distanceA < distanceB:
        return "{0;0;0}"
    elif distanceB < distanceA:
        return "{0;0;1}"
    else:
        return "{0;0;0}"  # 相等时默认返回"{0;0;0}"，可按需修改

# 主执行逻辑
try:
    # 获取输入参数（注意参数名需与Grasshopper组件中设置的一致）
    a = distanceA
    b = distanceB
    
    # 执行比较并获取结果
    result = compare_distances(a, b)
    
except Exception as e:
    # 错误处理（返回错误信息文本）
    result = "错误: " + str(e)

# 输出结果
result
# ---------- end script ----------
panel_8 = Panel(distance_4)
script_2 = Script(distanceA=distance_4, distanceB=distance_3)  # -> out, result; inputs distanceA: Double, distanceB: Double; same code as script
split_tree = SplitTree(Data=deconstruct_body.Keypoints, Masks=flatten(script.result))  # -> Positive, Negative
split_tree_2 = SplitTree(Data=deconstruct_body_2.Keypoints, Masks=flatten(script_2.result))  # -> Positive, Negative
panel_9 = Panel(split_tree.Positive)
panel_10 = Panel(split_tree_2.Positive)
deconstructkeypoints34 = DeconstructKeypoints34(Keypoints=split_tree_2.Positive)  # -> PELVIS, NAVAL_SPINE, CHEST_SPINE, NECK, LEFT_CLAVICLE, LEFT_SHOULDER, LEFT_ELBOW, LEFT_WRIST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
deconstructkeypoints34_2 = DeconstructKeypoints34(Keypoints=split_tree.Positive)  # -> PELVIS, NAVAL_SPINE, CHEST_SPINE, NECK, LEFT_CLAVICLE, LEFT_SHOULDER, LEFT_ELBOW, LEFT_WRIST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
unit_z = UnitZ(Factor=1)

# ---- group: 锚点调整状态机
vector_2pt = Vector2Pt(PointA=deconstructkeypoints34_2.LEFT_ELBOW, PointB=deconstructkeypoints34_2.LEFT_WRIST, Unitize=False)  # -> Vector, Length
vector_2pt_2 = Vector2Pt(PointA=deconstructkeypoints34_2.RIGHT_ELBOW, PointB=deconstructkeypoints34_2.RIGHT_WRIST, Unitize=False)  # -> Vector, Length
number_slider_3 = Slider(1, range=0..1)
angle = Angle(VectorA=vector_2pt_2.Vector, VectorB=unit_z)  # -> Angle, Reflex
angle_2 = Angle(VectorA=vector_2pt.Vector, VectorB=unit_z)  # -> Angle, Reflex

# ----
number_slider_4 = Slider(1.5, range=0..10)

# ---- group: 锚点调整状态机
unit_z_2 = UnitZ(Factor=1)
unit_z_3 = UnitZ(Factor=1)
vector_2pt_3 = Vector2Pt(PointA=deconstructkeypoints34.LEFT_ELBOW, PointB=deconstructkeypoints34.LEFT_WRIST, Unitize=False)  # -> Vector, Length
vector_2pt_4 = Vector2Pt(PointA=deconstructkeypoints34.RIGHT_ELBOW, PointB=deconstructkeypoints34.RIGHT_WRIST, Unitize=False)  # -> Vector, Length
angle_3 = Angle(VectorA=vector_2pt_4.Vector, VectorB=unit_z_3)  # -> Angle, Reflex
angle_4 = Angle(VectorA=vector_2pt_3.Vector, VectorB=unit_z_2)  # -> Angle, Reflex
larger_than = LargerThan(FirstNumber=angle_4.Angle, SecondNumber=Slider(1, range=0..1))  # -> LargerThan, OrEqualTo
smaller_than = SmallerThan(FirstNumber=angle_3.Angle, SecondNumber=Slider(0.2, range=0..1))  # -> SmallerThan, OrEqualTo

# ----
vector_2pt_5 = Vector2Pt(PointA=deconstructkeypoints34.RIGHT_ELBOW, PointB=deconstructkeypoints34.RIGHT_HANDTIP, Unitize=False)  # -> Vector, Length
smaller_than_2 = SmallerThan(FirstNumber=angle_4.Angle, SecondNumber=Slider(1.5, range=0..10))  # -> SmallerThan, OrEqualTo
smaller_than_3 = SmallerThan(FirstNumber=angle.Angle, SecondNumber=number_slider_4)  # -> SmallerThan, OrEqualTo
smaller_than_4 = SmallerThan(FirstNumber=angle_2.Angle, SecondNumber=number_slider_4)  # -> SmallerThan, OrEqualTo

vector_2pt_6 = Vector2Pt(PointA=deconstructkeypoints34_2.RIGHT_ELBOW, PointB=deconstructkeypoints34_2.RIGHT_HANDTIP, Unitize=False)  # -> Vector, Length
larger_than_2 = LargerThan(FirstNumber=angle.Angle, SecondNumber=number_slider_3)  # -> LargerThan, OrEqualTo
larger_than_3 = LargerThan(FirstNumber=angle_2.Angle, SecondNumber=number_slider_3)  # -> LargerThan, OrEqualTo
panel_11 = Panel(angle_2.Angle)
panel_12 = Panel(angle.Angle)
gate_and = GateAnd(A=larger_than_3.LargerThan, B=larger_than_2.LargerThan, C=smaller_than_4.SmallerThan, D=smaller_than_3.SmallerThan)
两手指尖距离 = Vector2Pt(PointA=deconstructkeypoints34_2.LEFT_HANDTIP, PointB=deconstructkeypoints34_2.RIGHT_HANDTIP, Unitize=False)  # -> Vector, Length

panel_13 = Panel(angle_4.Angle)
panel_14 = Panel(angle_3.Angle)
gate_and_2 = GateAnd(A=larger_than.LargerThan, B=smaller_than.SmallerThan, C=smaller_than_2.SmallerThan)

# ---- group: 移动距离
deconstruct = Deconstruct(Point=deconstructkeypoints34.RIGHT_HANDTIP)  # -> XComponent, YComponent, ZComponent
deconstruct_2 = Deconstruct(Point=deconstructkeypoints34.LEFT_HANDTIP)  # -> XComponent, YComponent, ZComponent
subtraction = Subtraction(A=deconstruct.ZComponent, B=deconstruct_2.ZComponent)
absolute = Absolute(Value=subtraction)

# ----
number_slider_5 = Slider(0, range=0..10)
panel_15 = Panel(gate_and_2)
panel_16 = Panel(gate_and)
panel_18 = Panel(两手指尖距离.Length)
list_item_3 = ListItem(List=absolute, Index=0, Wrap=True)
panel_19 = Panel(absolute)
list_item_4 = ListItem(List=两手指尖距离.Length, Index=0, Wrap=True)
panel_20 = Panel(list_item_4)
number_slider_6 = Slider(12, range=0..100)
number_slider_7 = Slider(12, range=0..100)

dataqueue = DataQueue(Data=list_item_4, RecordCount=number_slider_6)  # -> flatten(OutputData), OldestPath, NewestPath
script_3 = Script(z_values=dataqueue.OutputData)  # -> out, result; inputs z_values: list of Double
# ---------- script_3: Python ----------
def calculate_differences(z_values):
    """
    计算数列绝对值的差分（后一个元素减去前一个元素）
    输入：包含12个数值的列表
    输出：包含11个差分结果的列表
    """
    if len(z_values) < 2:
        return []  # 处理输入不足的情况
    
    # 先对所有元素取绝对值，再计算差分
    abs_values = [abs(z) for z in z_values]
    return [abs_values[i+1] - abs_values[i] for i in range(len(abs_values)-1)]

# 主执行逻辑
try:
    # 获取输入参数
    z = z_values
    
    # 计算绝对值差分
    result = calculate_differences(z)
    
except Exception as e:
    # 错误处理
    result = "错误: " + str(e)
    print(result)

# 输出结果
result
# ---------- end script_3 ----------
subtraction_2 = Subtraction(A=number_slider_6, B=Slider(1, range=0..1))
absolute_2 = Absolute(Value=script_3.result)
mass_addition = MassAddition(Input=absolute_2)  # -> Result, PartialResults
division = Division(A=mass_addition.Result, B=subtraction_2)
subtraction_3 = Subtraction(A=absolute_2, B=division)
panel_21 = Panel(absolute_2)
square = Square(Value=subtraction_3)
mass_addition_2 = MassAddition(Input=square)  # -> Result, PartialResults
division_2 = Division(A=mass_addition_2.Result, B=subtraction_2)
square_root = SquareRoot(Value=division_2)
smaller_than_5 = SmallerThan(FirstNumber=square_root, SecondNumber=Slider(0.1, range=0..0.1))  # -> SmallerThan, OrEqualTo
gate_and_3 = GateAnd(A=smaller_than_5.SmallerThan, B=gate_and)

dataqueue_2 = DataQueue(Data=list_item_3, RecordCount=number_slider_7)  # -> flatten(OutputData), OldestPath, NewestPath
script_4 = Script(z_values=dataqueue_2.OutputData)  # -> out, result; inputs z_values: list of Double; same code as script_3
subtraction_4 = Subtraction(A=number_slider_7, B=Slider(1, range=0..1))
absolute_3 = Absolute(Value=script_4.result)
mass_addition_3 = MassAddition(Input=absolute_3)  # -> Result, PartialResults
division_3 = Division(A=mass_addition_3.Result, B=subtraction_4)
subtraction_5 = Subtraction(A=absolute_3, B=division_3)
panel_22 = Panel(absolute_3)
square_2 = Square(Value=subtraction_5)
mass_addition_4 = MassAddition(Input=square_2)  # -> Result, PartialResults
division_4 = Division(A=mass_addition_4.Result, B=subtraction_4)
square_root_2 = SquareRoot(Value=division_4)
smaller_than_6 = SmallerThan(FirstNumber=square_root_2, SecondNumber=Slider(0.02, range=0..0.1))  # -> SmallerThan, OrEqualTo
gate_and_4 = GateAnd(A=smaller_than_6.SmallerThan, B=gate_and_2)

panel_24 = Panel(square_root)
panel_26 = Panel(square_root_2)
panel_27 = Panel(smaller_than_5.SmallerThan)
panel_28 = Panel(smaller_than_6.SmallerThan)
panel_29 = Panel(gate_and_4)
panel_30 = Panel(gate_and_3)
number_slider_8 = Slider(10, range=0..10)
number_slider_9 = Slider(0, range=0..100)
number_slider_10 = Slider(2, range=0..10)
number_slider_11 = Slider(0, range=0..100)
pt = ConstructPoint(XCoordinate=number_slider_9, YCoordinate=number_slider_8, ZCoordinate=number_slider_8)
pt_2 = ConstructPoint(XCoordinate=Slider(0, range=0..100), YCoordinate=number_slider_10, ZCoordinate=number_slider_10)
pt_3 = ConstructPoint(XCoordinate=number_slider_11, YCoordinate=number_slider_11, ZCoordinate=Slider(5, range=0..10))  # -> flatten(Point)
panel_31 = Panel(pt_3)
X = UnitX(Factor=Slider(5, range=0..10))
Z = UnitZ(Factor=Slider(0.4, range=0..1))
series = Series(Start=0, Step=Slider(10, range=0..100), Count=10)
Y = UnitY(Factor=Slider(0, range=0..0.1))
bnd = Bounds(Numbers=series)
Y_2 = UnitY(Factor=Slider(0.2, range=0..1))
remap = RemapNumbers(Value=series, Source=bnd, Target=Domain(0, 1))  # -> Mapped, Clipped
gradient = Gradient(
    LowerLimit=0,
    UpperLimit=1,
    Parameter=remap.Mapped,
    stops=[0: RGB(255, 0, 0), 0.603: RGB(255, 228, 225), 1: RGB(255, 0, 0)])

# ---- group: 映射
锚点基点 = Slider(27, range=0..100)
construct_domain = ConstructDomain(DomainStart=锚点基点, DomainEnd=number_slider_9)
remap_numbers = RemapNumbers(Value=两手指尖距离.Length, Source=vector_2pt_6.Length, Target=construct_domain)  # -> Mapped, Clipped
panel_32 = Panel(remap_numbers.Mapped)

# ----
python_3_script = Python3Script(Distance=remap_numbers.Mapped, Result=gate_and_2)  # -> a, b; inputs Distance: Double, Result: Boolean
# ---------- python_3_script: Python ----------
# 导入必要的库
import rhinoscriptsyntax as rs

# 获取输入参数
result = Result  # 前一个电池组的布尔输出
distance = Distance  # 距离值

# 根据result的值决定是否输出distance
if result:
    b = distance  # 将distance赋值给输出参数a
else:
    b = None  # 不输出任何值
# ---------- end python_3_script ----------
script_5 = Script(x=remap_numbers.Mapped, trigger=gate_and_3)  # -> out, a; inputs x: Double, trigger: Boolean
# ---------- script_5: Python ----------
# 使用全局字典实现持久化存储
if "position_tracker" not in globals():
    global position_tracker
    position_tracker = {}

# 获取当前组件的唯一ID
comp_id = str(ghenv.Component.InstanceGuid)

# 初始化存储值（仅在第一次运行时执行）
if comp_id not in position_tracker:
    position_tracker[comp_id] = 0.0  # 初始值设为0.0

# 主逻辑处理
if trigger:
    # 布尔值为True：使用新值并更新存储
    position_tracker[comp_id] = x
    a = x
else:
    # 布尔值为False：使用存储的上一个值
    a = position_tracker[comp_id]
# ---------- end script_5 ----------

# ---- group: 移动距离
negative = Negative(Value=script_5.a)

# ---- group: 映射 (continued)
panel_33 = Panel(script_5.a)

# ----
unit_y = UnitY(Factor=negative)
move = Move(Geometry=pt, Motion=unit_y)  # -> flatten(Geometry), Transform
panel_34 = Panel(move.Geometry)

construct_domain_2 = ConstructDomain(DomainStart=number_slider_11, DomainEnd=number_slider_8)
remap_numbers_2 = RemapNumbers(Value=absolute, Source=vector_2pt_5.Length, Target=construct_domain_2)  # -> Mapped, Clipped
panel_35 = Panel(remap_numbers_2.Mapped)

python_3_script_2 = Python3Script(Distance=remap_numbers_2.Mapped)  # -> a, b; inputs Distance: Double, Result: Boolean; same code as python_3_script
script_6 = Script(x=remap_numbers_2.Mapped, trigger=gate_and_4)  # -> out, a; inputs x: Double, trigger: Boolean; same code as script_5

negative_2 = Negative(Value=script_6.a)
unit_z_4 = UnitZ(Factor=negative_2)

panel_37 = Panel(script_6.a)
move_2 = Move(Geometry=pt_2, Motion=unit_z_4)  # -> flatten(Geometry), Transform
merge = Merge(Data1=pt_3, Data2=move_2.Geometry, Data3=move.Geometry)
panel_38 = Panel(move_2.Geometry)
intcrv_t = InterpolateT(Vertices=merge, TangentStart=Vector(0, 0, 0), TangentEnd=Vector(0, 0, 0), KnotStyle=1)  # -> Curve, Length, Domain
panel_39 = Panel(merge)
divide = DivideCurve(Curve=intcrv_t.Curve, Count=Slider(24, range=0..100), Kinks=False)  # -> Points, Tangents, Parameters
panel_40 = Panel(divide.Points)
move_3 = Move(Geometry=divide.Points, Motion=X)  # -> Geometry, Transform
ln = Line(StartPoint=divide.Points, EndPoint=move_3.Geometry)
extr = Extrude(Base=ln, Direction=Z)
brep = Brep(extr)
extr_2 = Extrude(Base=brep, Direction=Y_2)
move_4 = Move(Geometry=extr_2, Motion=Y)  # -> Geometry, Transform
preview = CustomPreview(Geometry=move_4.Geometry, Material=gradient)
