# Grasshopper definition 总电池（0704实时交互）.gh (Grasshopper 1.0.7)
# plug-ins: RhinoCodePluginGH, BodyAnalytics, Pufferfish

# ---- group: sever开启
# 这颗电池负责按一定刷新率激活
# 每次激活将最新数据传递给后面的gh电池。
boolean_toggle = BooleanToggle(False)
number_slider = Slider(250, range=100..5000)
serverconnector = ServerConnector(Host="127.0.0.1", Port="8899", Run=boolean_toggle)
receive = Receive(Interval=number_slider)  # -> Timestamp, Body, PyMessage, RCSLocation
panel = Panel(receive.Timestamp)
panel_2 = Panel(receive.PyMessage)

# ----
point = Point(receive.RCSLocation)

# ---- group: 判断谁有权限
# 动作一地贴
point_2 = Point(<point referenced from the Rhino model>)

# 动作三地贴
point_3 = Point(<point referenced from the Rhino model>)

# 动作二地贴
point_4 = Point(<point referenced from the Rhino model>)

# 动作四地贴
point_5 = Point(<point referenced from the Rhino model>)

# ---- group: 动作二
# #决定序列规模（单位时间抽几帧）
回溯多少毫秒之前的帧数 = Slider(1000, range=0..10000)
division = Division(A=回溯多少毫秒之前的帧数, B=number_slider)

# ---- group: 动作二 / 获取帷幔序列
brep = Brep([<brep referenced from the Rhino model> x5])
list_length = ListLength(List=brep)
起始号 = Slider(1, range=0..1)
步数 = Slider(1, range=0..1)
series = Series(Start=起始号, Step=步数, Count=list_length)

# ----
py3 = Python3Script()  # -> out, A
# ---------- py3: Python ----------
import scriptcontext as sc
A=sc.sticky["global_curves"]
print(A)
# ---------- end py3 ----------
py3_2 = Python3Script()  # -> out, A
# ---------- py3_2: Python ----------
import scriptcontext as sc
A=sc.sticky["global_curves"]
print(A)
if "aaaaa" not in sc.sticky:
    sc.sticky["aaaaa"]=0
print(sc.sticky["aaaaa"])
# ---------- end py3_2 ----------
py3_3 = Python3Script(x=<missing>)  # -> out, a; inputs x: list
# ---------- py3_3: Python ----------
import scriptcontext as sc
import Rhino.Geometry as rg
# 假设 new_curves 是你新的曲线列表
sc.sticky["global_curves"] = x
a=sc.sticky["global_curves"]
print(x)
sc.sticky["aaaaa"]+=1

print(sc.sticky["global_curves"])
# ---------- end py3_3 ----------

# ---- group: 判断谁有权限
# 第一个人的触发半径
deconstruct_body = DeconstructBody(Body=receive.Body)  # -> Id, UniqueObjectId, ActionState, Position, Velocity, PositionCovariance, Confidence, HeadPosition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
panel_3 = Panel(deconstruct_body.Position)
number_slider_2 = Slider(0.6, range=0..10)

# 第一个人
# 第二个人
list_item = ListItem(List=deconstruct_body.Position, Index=0, Wrap=True)  # -> Item, Item1

distance = Distance(PointA=list_item.Item, PointB=point_2)
distance_2 = Distance(PointA=list_item.Item1, PointB=point_5)
distance_3 = Distance(PointA=list_item.Item1, PointB=point_2)
distance_4 = Distance(PointA=list_item.Item, PointB=point_5)
distance_5 = Distance(PointA=list_item.Item, PointB=point_4)
distance_6 = Distance(PointA=list_item.Item1, PointB=point_3)
distance_7 = Distance(PointA=list_item.Item, PointB=point_3)
distance_8 = Distance(PointA=list_item.Item1, PointB=point_4)
smaller_than = SmallerThan(FirstNumber=distance, SecondNumber=number_slider_2)  # -> SmallerThan, OrEqualTo
smaller_than_2 = SmallerThan(FirstNumber=distance_3, SecondNumber=number_slider_2)  # -> SmallerThan, OrEqualTo
smaller_than_3 = SmallerThan(FirstNumber=distance_5, SecondNumber=number_slider_2)  # -> SmallerThan, OrEqualTo
smaller_than_4 = SmallerThan(FirstNumber=distance_6, SecondNumber=number_slider_2)  # -> SmallerThan, OrEqualTo
smaller_than_5 = SmallerThan(FirstNumber=distance_4, SecondNumber=number_slider_2)  # -> SmallerThan, OrEqualTo
smaller_than_6 = SmallerThan(FirstNumber=distance_2, SecondNumber=number_slider_2)  # -> SmallerThan, OrEqualTo
smaller_than_7 = SmallerThan(FirstNumber=distance_8, SecondNumber=number_slider_2)  # -> SmallerThan, OrEqualTo
smaller_than_8 = SmallerThan(FirstNumber=distance_7, SecondNumber=number_slider_2)  # -> SmallerThan, OrEqualTo
script = Script(DistanceA=distance, DistanceB=distance_3, BoolA=smaller_than.SmallerThan, BoolB=smaller_than_2.SmallerThan)  # -> out, result; inputs DistanceA: Double, DistanceB: Double, BoolA: Boolean, BoolB: Boolean
# ---------- script: Python ----------
def compare_distances(boolA, boolB, distanceA, distanceB):
    """
    根据布尔值和距离值的组合条件返回对应文本：
    - 两个布尔值均为True时：比较distanceA和distanceB
      - distanceA < distanceB → "{0;0;0}"
      - distanceB < distanceA → "{0;0;1}"
    - 一个True一个False时：
      - boolA为True → "{0;0;0}"
      - boolB为True → "{0;0;1}"
    - 两个均为False时 → None（不输出）
    """
    if boolA and boolB:  # 两个布尔值均为True
        if distanceA <= distanceB:
            return "{0;0;0}"
        elif distanceB < distanceA:
            return "{0;0;1}"
        else:
            return "{0;0;0}"  # 相等时默认返回
    elif boolA and not boolB:  # 仅boolA为True
        return "{0;0;0}"
    elif boolB and not boolA:  # 仅boolB为True
        return "{0;0;1}"
    else:  # 两个均为False
        return None  # 返回None表示不输出任何结果

# 主执行逻辑
try:
    # 获取输入参数（需与Grasshopper组件中设置的名称一致）
    bool_a = BoolA
    bool_b = BoolB
    dist_a = DistanceA
    dist_b = DistanceB
    
    # 执行比较并获取结果
    result = compare_distances(bool_a, bool_b, dist_a, dist_b)
    
except Exception as e:
    # 错误处理
    result = "错误: " + str(e)
    print(result)

# 输出结果
result
# ---------- end script ----------
script_2 = Script(DistanceA=distance_4, DistanceB=distance_2, BoolA=smaller_than_5.SmallerThan, BoolB=smaller_than_6.SmallerThan)  # -> out, result; inputs DistanceA: Double, DistanceB: Double, BoolA: Boolean, BoolB: Boolean; same code as script
script_3 = Script(DistanceA=distance_5, DistanceB=distance_8, BoolA=smaller_than_3.SmallerThan, BoolB=smaller_than_7.SmallerThan)  # -> out, result; inputs DistanceA: Double, DistanceB: Double, BoolA: Boolean, BoolB: Boolean; same code as script
script_4 = Script(DistanceA=distance_7, DistanceB=distance_6, BoolA=smaller_than_8.SmallerThan, BoolB=smaller_than_4.OrEqualTo)  # -> out, result; inputs DistanceA: Double, DistanceB: Double, BoolA: Boolean, BoolB: Boolean; same code as script
panel_4 = Panel(script.result)
split_tree = SplitTree(Data=deconstruct_body.Keypoints, Masks=flatten(script.result))  # -> Positive, Negative
panel_5 = Panel(split_tree.Positive)

# ---- group: 动作三（Y轴）
split_tree_2 = SplitTree(Data=deconstruct_body.Keypoints, Masks=flatten(script_4.result))  # -> Positive, Negative
panel_6 = Panel(split_tree_2.Positive)
deconstructkeypoints34 = DeconstructKeypoints34(Keypoints=split_tree_2.Positive)  # -> PELVIS, NAVAL_SPINE, CHEST_SPINE, NECK, LEFT_CLAVICLE, LEFT_SHOULDER, LEFT_ELBOW, LEFT_WRIST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
unit_z = UnitZ(Factor=1)
vector_2pt = Vector2Pt(PointA=deconstructkeypoints34.LEFT_ELBOW, PointB=deconstructkeypoints34.LEFT_WRIST, Unitize=False)  # -> Vector, Length
vector_2pt_2 = Vector2Pt(PointA=deconstructkeypoints34.RIGHT_ELBOW, PointB=deconstructkeypoints34.RIGHT_WRIST, Unitize=False)  # -> Vector, Length
number_slider_3 = Slider(1.5, range=0..10)
number_slider_4 = Slider(1, range=0..1)
angle = Angle(VectorA=vector_2pt_2.Vector, VectorB=unit_z)  # -> Angle, Reflex
panel_7 = Panel(angle.Angle)
angle_2 = Angle(VectorA=vector_2pt.Vector, VectorB=unit_z)  # -> Angle, Reflex
vector_2pt_3 = Vector2Pt(PointA=deconstructkeypoints34.RIGHT_ELBOW, PointB=deconstructkeypoints34.RIGHT_HANDTIP, Unitize=False)  # -> Vector, Length
larger_than = LargerThan(FirstNumber=angle.Angle, SecondNumber=number_slider_4)  # -> LargerThan, OrEqualTo
larger_than_2 = LargerThan(FirstNumber=angle_2.Angle, SecondNumber=number_slider_4)  # -> LargerThan, OrEqualTo
smaller_than_9 = SmallerThan(FirstNumber=angle.Angle, SecondNumber=number_slider_3)  # -> SmallerThan, OrEqualTo
smaller_than_10 = SmallerThan(FirstNumber=angle_2.Angle, SecondNumber=number_slider_3)  # -> SmallerThan, OrEqualTo
panel_8 = Panel(angle_2.Angle)
gate_and = GateAnd(A=larger_than_2.LargerThan, B=larger_than.LargerThan, C=smaller_than_10.SmallerThan, D=smaller_than_9.SmallerThan)
两手指尖距离 = Vector2Pt(PointA=deconstructkeypoints34.LEFT_HANDTIP, PointB=deconstructkeypoints34.RIGHT_HANDTIP, Unitize=False)  # -> Vector, Length
panel_10 = Panel(gate_and)
panel_11 = Panel(两手指尖距离.Length)
list_item_2 = ListItem(List=两手指尖距离.Length, Index=0, Wrap=True)
panel_12 = Panel(list_item_2)
number_slider_5 = Slider(8, range=0..10)
dataqueue = DataQueue(Data=list_item_2, RecordCount=number_slider_5)  # -> flatten(OutputData), OldestPath, NewestPath
script_5 = Script(z_values=dataqueue.OutputData)  # -> out, result; inputs z_values: list of Double
# ---------- script_5: Python ----------
def calculate_differences(z_values):
    """
    计算数列绝对值的差分（后一个元素减去前一个元素）
    输入：包含12个数值的列表
    输出：包含11个差分结果的列表
    """
    if len(z_values) < 2:
        return []  # 处理输入不足的情况
    
    # 先对所有元素取绝对值，再计算差分
    abs_values = [abs(z) for z in z_values]
    return [abs_values[i+1] - abs_values[i] for i in range(len(abs_values)-1)]

# 主执行逻辑
try:
    # 获取输入参数
    z = z_values
    
    # 计算绝对值差分
    result = calculate_differences(z)
    
except Exception as e:
    # 错误处理
    result = "错误: " + str(e)
    print(result)

# 输出结果
result
# ---------- end script_5 ----------
subtraction = Subtraction(A=number_slider_5, B=Slider(1, range=0..1))
absolute = Absolute(Value=script_5.result)
mass_addition = MassAddition(Input=absolute)  # -> Result, PartialResults
division_2 = Division(A=mass_addition.Result, B=subtraction)
subtraction_2 = Subtraction(A=absolute, B=division_2)
panel_13 = Panel(absolute)
square = Square(Value=subtraction_2)
mass_addition_2 = MassAddition(Input=square)  # -> Result, PartialResults
division_3 = Division(A=mass_addition_2.Result, B=subtraction)
square_root = SquareRoot(Value=division_3)
smaller_than_11 = SmallerThan(FirstNumber=square_root, SecondNumber=Slider(0.08, range=0..0.1))  # -> SmallerThan, OrEqualTo
panel_15 = Panel(square_root)
panel_16 = Panel(smaller_than_11.SmallerThan)
gate_and_2 = GateAnd(A=smaller_than_11.SmallerThan, B=gate_and)
panel_17 = Panel(gate_and_2)

# ---- group: 动作四（Z轴）
split_tree_3 = SplitTree(Data=deconstruct_body.Keypoints, Masks=flatten(script_2.result))  # -> Positive, Negative
panel_18 = Panel(split_tree_3.Positive)
deconstructkeypoints34_2 = DeconstructKeypoints34(Keypoints=split_tree_3.Positive)  # -> PELVIS, NAVAL_SPINE, CHEST_SPINE, NECK, LEFT_CLAVICLE, LEFT_SHOULDER, LEFT_ELBOW, LEFT_WRIST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
unit_z_2 = UnitZ(Factor=1)
unit_z_3 = UnitZ(Factor=1)
vector_2pt_4 = Vector2Pt(PointA=deconstructkeypoints34_2.LEFT_ELBOW, PointB=deconstructkeypoints34_2.LEFT_WRIST, Unitize=False)  # -> Vector, Length
vector_2pt_5 = Vector2Pt(PointA=deconstructkeypoints34_2.RIGHT_ELBOW, PointB=deconstructkeypoints34_2.RIGHT_WRIST, Unitize=False)  # -> Vector, Length
angle_3 = Angle(VectorA=vector_2pt_5.Vector, VectorB=unit_z_3)  # -> Angle, Reflex
angle_4 = Angle(VectorA=vector_2pt_4.Vector, VectorB=unit_z_2)  # -> Angle, Reflex
vector_2pt_6 = Vector2Pt(PointA=deconstructkeypoints34_2.RIGHT_ELBOW, PointB=deconstructkeypoints34_2.RIGHT_HANDTIP, Unitize=False)  # -> Vector, Length
larger_than_3 = LargerThan(FirstNumber=angle_4.Angle, SecondNumber=Slider(1, range=0..1))  # -> LargerThan, OrEqualTo
smaller_than_12 = SmallerThan(FirstNumber=angle_4.Angle, SecondNumber=Slider(1.5, range=0..10))  # -> SmallerThan, OrEqualTo
smaller_than_13 = SmallerThan(FirstNumber=angle_3.Angle, SecondNumber=Slider(0.2, range=0..1))  # -> SmallerThan, OrEqualTo
panel_19 = Panel(angle_4.Angle)
panel_20 = Panel(angle_3.Angle)
gate_and_3 = GateAnd(A=larger_than_3.LargerThan, B=smaller_than_13.SmallerThan, C=smaller_than_12.SmallerThan)
deconstruct = Deconstruct(Point=deconstructkeypoints34_2.RIGHT_HANDTIP)  # -> XComponent, YComponent, ZComponent
deconstruct_2 = Deconstruct(Point=deconstructkeypoints34_2.LEFT_HANDTIP)  # -> XComponent, YComponent, ZComponent
number_slider_6 = Slider(0, range=0..10)
panel_21 = Panel(gate_and_3)
subtraction_3 = Subtraction(A=deconstruct.ZComponent, B=deconstruct_2.ZComponent)
absolute_2 = Absolute(Value=subtraction_3)
list_item_3 = ListItem(List=absolute_2, Index=0, Wrap=True)
panel_22 = Panel(absolute_2)
number_slider_7 = Slider(8, range=0..10)
dataqueue_2 = DataQueue(Data=list_item_3, RecordCount=number_slider_7)  # -> flatten(OutputData), OldestPath, NewestPath
script_6 = Script(z_values=dataqueue_2.OutputData)  # -> out, result; inputs z_values: list of Double; same code as script_5
subtraction_4 = Subtraction(A=number_slider_7, B=Slider(1, range=0..1))
absolute_3 = Absolute(Value=script_6.result)
deconstruct_3 = Deconstruct(Point=point_5)  # -> XComponent, YComponent, ZComponent
mass_addition_3 = MassAddition(Input=absolute_3)  # -> Result, PartialResults
division_4 = Division(A=mass_addition_3.Result, B=subtraction_4)
subtraction_5 = Subtraction(A=absolute_3, B=division_4)
panel_23 = Panel(absolute_3)
square_2 = Square(Value=subtraction_5)
mass_addition_4 = MassAddition(Input=square_2)  # -> Result, PartialResults
division_5 = Division(A=mass_addition_4.Result, B=subtraction_4)
square_root_2 = SquareRoot(Value=division_5)
smaller_than_14 = SmallerThan(FirstNumber=square_root_2, SecondNumber=Slider(0.03, range=0..1))  # -> SmallerThan, OrEqualTo
panel_25 = Panel(square_root_2)
gate_and_4 = GateAnd(A=smaller_than_14.SmallerThan, B=gate_and_3)
panel_26 = Panel(smaller_than_14.SmallerThan)
panel_27 = Panel(gate_and_4)

# ---- group: 动作二
# 右脚踝z轴在某时间内位移超过某值，
# 且xy平面位移小于某值，
# 触发单元选择切换
# 替换成左上方的length
# 输出跺脚后选中的序列号
# ##不存在触发两次的问题：
# 点【22】坐标变化很快时（跺脚），
# 第二个布尔门会从False变成True（变换一次，第三个布尔门变True），
# 并且可能会连着输出好几个True
# 但此时没发生布尔变换），所以第三个布尔门变回False
# 
# 当跺脚结束，第二个布尔门变False（变换一次）
# 但不满足前一个点【22】坐标变化的条件
# 所以第三个布尔门还是False
split_tree_4 = SplitTree(Data=deconstruct_body.Keypoints, Masks=flatten(script_3.result))  # -> Positive, Negative
deconstructkeypoints34_3 = DeconstructKeypoints34(Keypoints=split_tree_4.Positive)  # -> PELVIS, NAVAL_SPINE, CHEST_SPINE, NECK, LEFT_CLAVICLE, LEFT_SHOULDER, LEFT_ELBOW, LEFT_WRIST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
左手指尖 = ListItem(List=deconstructkeypoints34_3.RIGHT_ANKLE, Index=0, Wrap=True)
deconstruct_4 = Deconstruct(Point=左手指尖)  # -> XComponent, YComponent, ZComponent

# ---- group: 动作一
# （2）9、16点在3秒内位置变动小于X
# （1）9、16的高度超过18，触发单元尺寸修改
# b为每一小片单元的宽度
deconstructkeypoints34_4 = DeconstructKeypoints34(Keypoints=split_tree.Positive)  # -> PELVIS, NAVAL_SPINE, CHEST_SPINE, NECK, LEFT_CLAVICLE, LEFT_SHOULDER, LEFT_ELBOW, LEFT_WRIST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
unit_z_4 = UnitZ(Factor=1)
unit_z_5 = UnitZ(Factor=1)
division_6 = Division(A=Slider(3000, range=0..10000), B=number_slider)
number_slider_8 = Slider(2, range=0..4)

# 右腕
右手指尖 = ListItem(List=deconstructkeypoints34_4.RIGHT_WRIST, Index=0, Wrap=True)

# 左肘
list_item_4 = ListItem(List=deconstructkeypoints34_4.LEFT_ELBOW, Index=0, Wrap=True)

# 左腕
右手指尖_2 = ListItem(List=deconstructkeypoints34_4.LEFT_WRIST, Index=0, Wrap=True)

# 右肘
list_item_5 = ListItem(List=deconstructkeypoints34_4.RIGHT_ELBOW, Index=0, Wrap=True)

# 脊椎（胸部）
右髋 = ListItem(List=deconstructkeypoints34_4.NAVAL_SPINE, Index=0, Wrap=True)

deconstruct_5 = Deconstruct(Point=右手指尖_2)  # -> XComponent, YComponent, ZComponent
vector_2pt_7 = Vector2Pt(PointA=右手指尖_2, PointB=list_item_4, Unitize=False)  # -> Vector, Length
deconstruct_6 = Deconstruct(Point=右髋)  # -> XComponent, YComponent, ZComponent
deconstruct_7 = Deconstruct(Point=右手指尖)  # -> XComponent, YComponent, ZComponent
vector_2pt_8 = Vector2Pt(PointA=右手指尖, PointB=list_item_5, Unitize=False)  # -> Vector, Length
angle_5 = Angle(VectorA=vector_2pt_7.Vector, VectorB=unit_z_4)  # -> Angle, Reflex
angle_6 = Angle(VectorA=vector_2pt_8.Vector, VectorB=unit_z_5)  # -> Angle, Reflex
larger_than_4 = LargerThan(FirstNumber=deconstruct_7.ZComponent, SecondNumber=deconstruct_6.ZComponent)  # -> LargerThan, OrEqualTo
larger_than_5 = LargerThan(FirstNumber=deconstruct_5.ZComponent, SecondNumber=deconstruct_6.ZComponent)  # -> LargerThan, OrEqualTo
smaller_than_15 = SmallerThan(FirstNumber=angle_5.Angle, SecondNumber=Slider(0.3, range=0..1))  # -> SmallerThan, OrEqualTo
smaller_than_16 = SmallerThan(FirstNumber=angle_6.Angle, SecondNumber=Slider(0.3, range=0..1))  # -> SmallerThan, OrEqualTo
panel_28 = Panel(larger_than_5.LargerThan)
dataqueue_3 = DataQueue(Data=右手指尖_2, RecordCount=division_6)  # -> flatten(OutputData), OldestPath, NewestPath
deconstruct_8 = Deconstruct(Point=dataqueue_3.OutputData)  # -> XComponent, YComponent, ZComponent
script_7 = Script(input_list=deconstruct_8.ZComponent)  # -> out, result; inputs input_list: list of Double
# ---------- script_7: Python ----------
# 直接计算12元素列表的首尾差值绝对值
data = input_list

# 确保输入是包含12个元素的列表
if data is not None and len(data) == 12:
    result = abs(data[11] - data[0])  # 使用固定索引11（第12个元素）
else:
    result = None  # 不符合条件时返回None，表示不输出

# 输出结果
result
# ---------- end script_7 ----------
smaller_than_17 = SmallerThan(FirstNumber=script_7.result, SecondNumber=Slider(0.02, range=0..1))  # -> SmallerThan, OrEqualTo
script_8 = Script(Result=smaller_than_17.SmallerThan)  # -> out, result; inputs Result: Boolean
# ---------- script_8: Python ----------
# 初始化历史记录列表（使用全局变量保持状态）
if 'history' not in globals():
    history = []

# 获取当前帧的布尔值
current_value = Result

# 添加当前值到历史记录
if current_value is not None:
    history.append(current_value)

# 检查是否存在连续两个及以上的True
result = False
if len(history) >= 2:
    for i in range(len(history) - 1):
        if history[i] and history[i+1]:
            result = True
            break

# 输出结果
result
# ---------- end script_8 ----------
gate_and_5 = GateAnd(A=larger_than_5.LargerThan, B=larger_than_4.LargerThan, C=smaller_than_15.SmallerThan, D=smaller_than_16.SmallerThan)
gate_and_6 = GateAnd(A=script_8.result, B=gate_and_5)
data_recorder = DataRecorder(gate_and_6, DataLimit=-10, RecordData=True)
panel_29 = Panel(data_recorder)
distance_9 = Distance(PointA=右手指尖_2, PointB=右手指尖)
script_9 = Script(Result=gate_and_6)  # -> out, result; inputs Result: Boolean
# ---------- script_9: Python ----------
# 初始化存储历史结果的列表（使用全局变量保持状态）
if 'history' not in globals():
    history = []

# 获取当前帧的布尔值
current_value = Result

# 添加当前值到历史记录
if current_value is not None:
    history.append(current_value)

# 确保历史记录至少有两个值
if len(history) >= 2:
    # 获取最后两个值
    last_value = history[-1]
    second_last_value = history[-2]
    
    # 判断是否一个为True，另一个为False
    result = (last_value != second_last_value)
else:
    # 历史记录不足时返回False
    result = False

# 输出结果
result
# ---------- end script_9 ----------
script_10 = Script(distance=distance_9)  # -> out, result; inputs distance: Double
# ---------- script_10: Python ----------
def limit_min_distance(distance):
    """
    限制距离的最小值为0.2：
    - 若distance ≤ 0.2，返回0.2
    - 若distance > 0.2，返回原数
    """
    return max(0.2, distance)

# 主执行逻辑
try:
    # 获取输入参数
    d = distance
    
    # 应用最小值限制
    result = limit_min_distance(d)
    
except Exception as e:
    # 错误处理
    result = "错误: " + str(e)
    print(result)

# 输出结果
result
# ---------- end script_10 ----------
gate_and_7 = GateAnd(A=gate_and_6, B=script_9.result)
data_recorder_2 = DataRecorder(gate_and_7, DataLimit=-10, RecordData=True)
script_11 = Script(Distance=script_10.result, Result=gate_and_7)  # -> a, b; inputs Distance: Double, Result: Boolean
# ---------- script_11: Python ----------
# 导入必要的库
import rhinoscriptsyntax as rs

# 获取输入参数
result = Result  # 前一个电池组的布尔输出
distance = Distance  # 距离值

# 根据result的值决定是否输出distance
if result:
    b = distance  # 将distance赋值给输出参数a
else:
    b = None  # 不输出任何值
# ---------- end script_11 ----------
panel_30 = Panel(data_recorder_2)
script_12 = Script(InputB=script_11.b)  # -> out, result
# ---------- script_12: Python ----------
# 初始化存储上一个有效值的变量
if 'last_valid_value' not in globals():
    last_valid_value = None

# 获取当前输入值
b = InputB

# 如果输入不为空，则更新上一个有效值
if b is not None:
    last_valid_value = b

# 输出上一个有效值（可能为None，取决于初始状态）
result = last_valid_value

# 输出结果
result
# ---------- end script_12 ----------
script_13 = Script(b=script_12.result)  # -> out, a; inputs b: Double
# ---------- script_13: Python ----------
import math

# 输入参数
b = float(b)  # 将输入转换为浮点数

# 执行计算
if b == 0:
    a = 0  # 处理除以零的情况
else:
    result = 8 / b
    if result.is_integer():
        a = int(result)
    else:
        a = math.floor(result) + 1

# 输出结果
a = a
# ---------- end script_13 ----------
data_recorder_3 = DataRecorder(script_12.result, DataLimit=-10, RecordData=True)
panel_31 = Panel(script_13.a)
panel_32 = Panel(data_recorder_3)
series_2 = Series(Start=Slider(0, range=0..1), Step=script_12.result, Count=script_13.a)
panel_33 = Panel(series_2)

# ---- group: 改变b后生成新线
series_3 = Series(Start=Slider(0, range=0..100), Step=script_12.result, Count=script_13.a)
panel_34 = Panel(series_3)
vector_xyz = VectorXYZ(XComponent=series_3, YComponent=Slider(0, range=0..100), ZComponent=Slider(0, range=0..100))  # -> Vector, Length
move = Move(Motion=vector_xyz.Vector)  # -> Geometry, Transform

# ----
panel_35 = Panel(move.Geometry)

# ---- group: 动作二
# x坐标幅度满足要求
# #缓存右脚踝的历史x坐标序列
# #波动幅度判断
dataqueue_4 = DataQueue(Data=deconstruct_4.XComponent, RecordCount=division)  # -> OutputData, OldestPath, NewestPath

# y坐标幅度满足要求
dataqueue_5 = DataQueue(Data=deconstruct_4.YComponent, RecordCount=division)  # -> OutputData, OldestPath, NewestPath

# y坐标幅度满足要求
# #求极差
# z坐移动是否大于某值？
dataqueue_6 = DataQueue(Data=deconstruct_4.ZComponent, RecordCount=division)  # -> OutputData, OldestPath, NewestPath

split_tree_5 = SplitTree(Data=dataqueue_4.OutputData, Masks=dataqueue_4.OldestPath)  # -> Positive, Negative
split_tree_6 = SplitTree(Data=dataqueue_4.OutputData, Masks=dataqueue_4.NewestPath)  # -> Positive, Negative
split_tree_7 = SplitTree(Data=dataqueue_5.OutputData, Masks=dataqueue_5.NewestPath)  # -> Positive, Negative
split_tree_8 = SplitTree(Data=dataqueue_5.OutputData, Masks=dataqueue_5.OldestPath)  # -> Positive, Negative
split_tree_9 = SplitTree(Data=dataqueue_6.OutputData, Masks=dataqueue_6.NewestPath)  # -> Positive, Negative
split_tree_10 = SplitTree(Data=dataqueue_6.OldestPath, Masks=dataqueue_6.OldestPath)  # -> Positive, Negative

subtraction_6 = Subtraction(A=split_tree_9.Positive, B=split_tree_10.Positive)

subtraction_7 = Subtraction(A=split_tree_7.Positive, B=split_tree_8.Positive)

subtraction_8 = Subtraction(A=split_tree_6.Positive, B=split_tree_5.Positive)

absolute_4 = Absolute(Value=subtraction_6)
absolute_5 = Absolute(Value=subtraction_7)
absolute_6 = Absolute(Value=subtraction_8)

larger_than_6 = LargerThan(FirstNumber=absolute_4, SecondNumber=Slider(0.05, range=0..1))  # -> LargerThan, OrEqualTo

smaller_than_18 = SmallerThan(FirstNumber=absolute_5, SecondNumber=Slider(0.023, range=0..1))  # -> SmallerThan, OrEqualTo

smaller_than_19 = SmallerThan(FirstNumber=absolute_6, SecondNumber=Slider(0.023, range=0..1))  # -> SmallerThan, OrEqualTo

gate_and_8 = GateAnd(A=smaller_than_19.SmallerThan, B=smaller_than_18.SmallerThan)
gate_and_9 = GateAnd(A=gate_and_8, B=larger_than_6.LargerThan)

# ---- group: 动作二 / 布尔脉冲
script_14 = Script(Result=gate_and_9)  # -> out, result; inputs Result: Boolean; same code as script_9

# ---- group: 动作二
# #同时满足点【22】坐标变化，
# 和一次布尔脉冲，
# 才可触发切换选择
gate_and_10 = GateAnd(A=gate_and_9, B=script_14.result)

script_15 = Script(UnitCount=script_13.a, Toggle=gate_and_10)  # -> out, flatten(result); inputs UnitCount: Int32, Toggle: Boolean
# ---------- script_15: Python ----------
# 初始化当前选中的单元序号（从1开始）
if 'current_index' not in globals():
    current_index = 0

# 获取输入参数
unit_count = UnitCount  # 单元总数
toggle = Toggle         # True/False输入

# 确保单元数量有效
if unit_count is not None and unit_count > 0:
    # 当接收到True时，增加选中的单元序号
    if toggle is True:
        current_index += 1
        
        # 处理循环：当超过总数时从头开始
        if current_index > unit_count:
            current_index = (current_index - 1) % unit_count + 1
    
    # 输出当前选中的单元序号
    result = current_index
else:
    # 单元数量无效时返回None
    result = None

# 输出结果
result
# ---------- end script_15 ----------
data_recorder_4 = DataRecorder(gate_and_10, DataLimit=-10, RecordData=True)
script_16 = Script(InputB=script_15.result)  # -> out, result; same code as script_12
data_recorder_5 = DataRecorder(script_16.result, DataLimit=-10, RecordData=True)
panel_36 = Panel(data_recorder_4)
panel_37 = Panel(data_recorder_5)

# ---- group: 动作二 / 分流，赋颜色
equality = Equality(FirstNumber=series, SecondNumber=script_16.result)  # -> Equality, Inequality
选中_未选中 = Dispatch(List=brep, DispatchPattern=equality.Equality)  # -> ListA, ListB
被选中 = ColourSwatch(SwatchColor=RGB(255, 43, 43))
未被选中 = ColourSwatch(SwatchColor=RGB(237, 237, 237))
mesh_colours = MeshColours(Mesh=选中_未选中.ListA, Colours=被选中)
mesh_colours_2 = MeshColours(Mesh=选中_未选中.ListB, Colours=未被选中)

# ---- group: 动作二 (continued)
relay = Relay([mesh_colours_2, mesh_colours])

# ---- group: 点位移动
# 中点向Z轴方向位移
# 最右点向Y轴方向位移
script_17 = Script(LineIndex=script_16.result)  # -> out, A; inputs LineIndex: Int32
# ---------- script_17: Python ----------
import csv
import Rhino.Geometry as rg

# 参数设置
csv_file = r"E:\研究生\研1\28 Digital feature\建模\curve_points.csv"  # CSV文件路径
curve_index = LineIndex  # 要提取的曲线序号

# 初始化结果列表
points = []

try:
    # 打开并读取CSV文件
    with open(csv_file, 'r', encoding='utf-8') as file:
        reader = csv.DictReader(file)
        
        # 按行读取并筛选指定CurveIndex的点
        for row in reader:
            current_curve = int(row['CurveIndex'])
            point_index = int(row['PointIndex'])
            
            # 检查是否是目标曲线的点(0,1,2)
            if current_curve == curve_index and point_index in (0, 1, 2):
                # 提取坐标值并转换为Rhino点
                x = float(row['X'])
                y = float(row['Y'])
                z = float(row['Z'])
                point = rg.Point3d(x, y, z)
                
                # 按PointIndex顺序添加到结果列表
                points.append((point_index, point))
    
    # 按PointIndex排序（确保顺序为0,1,2）
    points.sort(key=lambda p: p[0])
    
    # 提取排序后的点
    A = [p[1] for p in points]
    
    # 验证是否找到了3个点
    if len(A) != 3:
        print(f"警告：为曲线 {curve_index} 找到 {len(A)} 个点（需要3个）")
        if len(A) > 0:
            # 如果找到了一些点，仍输出它们
            print(f"输出可用的 {len(A)} 个点")
        else:
            # 如果没有找到任何点，返回空列表
            A = []
            print(f"错误：未找到曲线 {curve_index} 的点数据")
    
except FileNotFoundError:
    A = []
    print(f"错误：找不到CSV文件 - {csv_file}")
except Exception as e:
    A = []
    print(f"错误：读取CSV文件时发生异常 - {str(e)}")
# ---------- end script_17 ----------
vector_xyz_2 = VectorXYZ(XComponent=0, YComponent=0, ZComponent=0.5)  # -> Vector, Length
vector_xyz_3 = VectorXYZ(XComponent=0, YComponent=1, ZComponent=0)  # -> Vector, Length
list_item_6 = ListItem(List=flatten(script_17.A), Index=Slider(2, range=0..10), Wrap=True)
list_item_7 = ListItem(List=flatten(script_17.A), Index=Slider(1, range=0..10), Wrap=True)
list_item_8 = ListItem(List=flatten(script_17.A), Index=Slider(0, range=0..10), Wrap=True)
move_2 = Move(Geometry=list_item_7, Motion=vector_xyz_2.Vector)  # -> flatten(Geometry), Transform
deconstruct_9 = Deconstruct(Point=list_item_7)  # -> XComponent, YComponent, ZComponent
move_3 = Move(Geometry=list_item_6, Motion=vector_xyz_3.Vector)  # -> flatten(Geometry), Transform
deconstruct_10 = Deconstruct(Point=list_item_6)  # -> XComponent, YComponent, ZComponent
deconstruct_11 = Deconstruct(Point=list_item_8)  # -> XComponent, YComponent, ZComponent
subtraction_9 = Subtraction(A=deconstruct_10.YComponent, B=deconstruct_9.YComponent)
panel_38 = Panel(subtraction_9)
merge = Merge(Data1=list_item_8, Data2=move_2.Geometry, Data3=move_3.Geometry)
script_18 = Script(NewPts=merge)  # -> out, A; inputs NewPts: list of Point3d
# ---------- script_18: Python ----------
import csv
import os
import Rhino.Geometry as rg

# 参数设置
csv_file = r"E:\研究生\研1\28 Digital feature\建模\curve_points.csv"  # CSV文件路径
new_points = NewPts          # 修改后的点集

try:
    # 检查文件是否存在
    if not os.path.exists(csv_file):
        raise FileNotFoundError(f"CSV文件不存在: {csv_file}")
    
    # 检查输入有效性
    if not new_points or len(new_points) != 3:
        raise ValueError("需要提供3个有效的新点")
    
    # 提取第一个新点的X坐标作为匹配键
    first_x = float(new_points[0].X)
    
    # 读取并修改数据
    temp_file = csv_file + ".temp"
    updated_rows = []
    points_updated = 0
    target_curve_index = None
    curve_points_found = 0
    
    with open(csv_file, 'r', encoding='utf-8') as file:
        reader = csv.DictReader(file)
        headers = reader.fieldnames
        
        for row in reader:
            current_x = float(row['X'])
            current_curve = int(row['CurveIndex'])
            point_index = int(row['PointIndex'])
            
            # 如果是第一次遇到匹配X坐标的点，记录CurveIndex
            if current_x == first_x and target_curve_index is None:
                target_curve_index = current_curve
                print(f"找到匹配的曲线，CurveIndex={target_curve_index}")
            
            # 如果是目标曲线的点
            if current_curve == target_curve_index:
                # 确保有对应的新点
                if curve_points_found < len(new_points):
                    new_point = new_points[curve_points_found]
                    
                    # 转换为Rhino点
                    if isinstance(new_point, rg.Point3d):
                        rhino_point = new_point
                    elif isinstance(new_point, gh_t.GH_Point):
                        rhino_point = new_point.Value
                    else:
                        # 尝试解析其他类型
                        try:
                            rhino_point = rg.Point3d(
                                float(new_point.X), 
                                float(new_point.Y), 
                                float(new_point.Z)
                            )
                        except:
                            print(f"警告：无法转换点 {new_point}，使用原始值")
                            rhino_point = None
                    
                    # 更新行数据（仅更新Y和Z坐标）
                    if rhino_point:
                        row['Y'] = str(rhino_point.Y)
                        row['Z'] = str(rhino_point.Z)
                        points_updated += 1
                        print(f"已更新曲线 {target_curve_index} 的点 {point_index}")
                
                curve_points_found += 1
            
            updated_rows.append(row)
    
    # 检查是否找到了所有三个点
    if target_curve_index is None:
        raise ValueError(f"未找到X坐标为 {first_x} 的点")
    
    if curve_points_found != 3:
        print(f"警告：为曲线 {target_curve_index} 找到 {curve_points_found} 个点（需要3个）")
    
    # 写入更新后的文件
    with open(temp_file, 'w', newline='', encoding='utf-8') as file:
        writer = csv.DictWriter(file, fieldnames=headers)
        writer.writeheader()
        writer.writerows(updated_rows)
    
    # 替换原文件
    os.replace(temp_file, csv_file)
    print(f"CSV文件已成功更新: {csv_file}")
    
    # 输出成功标志
    A = points_updated > 0
    
except FileNotFoundError as e:
    A = False
    print(f"错误：{str(e)}")
except ValueError as e:
    A = False
    print(f"错误：{str(e)}")
except Exception as e:
    A = False
    print(f"错误：更新CSV文件时发生异常 - {str(e)}")
# ---------- end script_18 ----------
panel_39 = Panel(script_18.A)

# ---- group: 动作四（Z轴） (continued)
subtraction_10 = Subtraction(A=deconstruct_11.ZComponent, B=deconstruct_3.ZComponent)
construct_domain = ConstructDomain(DomainStart=Slider(0, range=0..100), DomainEnd=subtraction_10)
remap_numbers = RemapNumbers(Value=absolute_2, Source=vector_2pt_6.Length, Target=construct_domain)  # -> Mapped, Clipped
panel_40 = Panel(remap_numbers.Mapped)
script_19 = Script(x=remap_numbers.Mapped, trigger=gate_and_4)  # -> out, a; inputs x: Double, trigger: Boolean
# ---------- script_19: Python ----------
# 使用全局字典实现持久化存储
if "position_tracker" not in globals():
    global position_tracker
    position_tracker = {}

# 获取当前组件的唯一ID
comp_id = str(ghenv.Component.InstanceGuid)

# 初始化存储值（仅在第一次运行时执行）
if comp_id not in position_tracker:
    position_tracker[comp_id] = 0.0  # 初始值设为0.0

# 主逻辑处理
if trigger:
    # 布尔值为True：使用新值并更新存储
    position_tracker[comp_id] = x
    a = x
else:
    # 布尔值为False：使用存储的上一个值
    a = position_tracker[comp_id]
# ---------- end script_19 ----------
negative = Negative(Value=script_19.a)
panel_42 = Panel(script_19.a)
unit_z_6 = UnitZ(Factor=negative)

# ---- group: 动作三（Y轴） (continued)
construct_domain_2 = ConstructDomain(DomainStart=Slider(0, range=0..100), DomainEnd=subtraction_9)
remap_numbers_2 = RemapNumbers(Value=两手指尖距离.Length, Source=vector_2pt_3.Length, Target=construct_domain_2)  # -> Mapped, Clipped
panel_43 = Panel(remap_numbers_2.Mapped)
script_20 = Script(x=remap_numbers_2.Mapped, trigger=gate_and_2)  # -> out, a; inputs x: Double, trigger: Boolean; same code as script_19
negative_2 = Negative(Value=script_20.a)
panel_44 = Panel(script_20.a)
unit_y = UnitY(Factor=negative_2)

# ---- group: 主模块（生成初始状态的线集合）
pt = ConstructPoint(XCoordinate=Slider(0, range=0..10), YCoordinate=Slider(5, range=0..10), ZCoordinate=Slider(1.422, range=0..10))  # -> flatten(Point)
pt_2 = ConstructPoint(XCoordinate=Slider(0, range=0..10), YCoordinate=Slider(7.422, range=0..10), ZCoordinate=Slider(2, range=0..10))  # -> flatten(Point)
pt_3 = ConstructPoint(XCoordinate=Slider(0, range=0..10), YCoordinate=Slider(10.154, range=0..20), ZCoordinate=Slider(7.077, range=0..20))  # -> flatten(Point)
unit_vector = UnitVector(Vector=Vector(10, 0, 0))
merge_2 = Merge(Data1=pt, Data2=pt_2, Data3=pt_3)
multiplication = Multiplication(A=unit_vector, B=series_2)
move_4 = Move(Geometry=graft(merge_2), Motion=multiplication)  # -> Geometry, Transform
flip = FlipMatrix(Data=move_4.Geometry)
points = PointList(Points=flip)
boolean_toggle_2 = BooleanToggle(True)

# ---- group: 成线成面成体
trigger = Trigger(Interval=500, TimerInterval=500)
script_21 = Script(x=script_18.A)  # -> out, A
# ---------- script_21: Python ----------
import Grasshopper.Kernel.Data as gh_d
import Grasshopper.Kernel.Types as gh_t
import Rhino.Geometry as rg
import csv
import os

# 参数设置
csv_file = r"E:\研究生\研1\28 Digital feature\建模\curve_points.csv"  # CSV文件路径

# 创建一个新的树状结构
tree = gh_d.GH_Structure[gh_t.GH_Point]()

try:
    # 检查文件是否存在
    if not os.path.exists(csv_file):
        raise FileNotFoundError(f"CSV文件不存在: {csv_file}")
    
    # 读取CSV文件
    with open(csv_file, 'r', encoding='utf-8') as file:
        reader = csv.DictReader(file)
        
        # 按CurveIndex分组存储点
        curve_points = {}
        
        for row in reader:
            curve_index = int(row['CurveIndex'])
            point_index = int(row['PointIndex'])
            x = float(row['X'])
            y = float(row['Y'])
            z = float(row['Z'])
            
            # 创建Rhino点
            point = rg.Point3d(x, y, z)
            
            # 将点添加到对应的CurveIndex组
            if curve_index not in curve_points:
                curve_points[curve_index] = []
            
            # 按PointIndex顺序添加点
            curve_points[curve_index].append((point_index, point))
    
    # 将分组的点转换为树状结构
    for curve_index in sorted(curve_points.keys()):
        points = curve_points[curve_index]
        
        # 按PointIndex排序
        points.sort(key=lambda p: p[0])
        
        # 创建路径
        path = gh_d.GH_Path(curve_index)
        
        # 将点添加到树状结构
        for _, point in points:
            tree.Append(gh_t.GH_Point(point), path)
    
    print(f"成功从CSV文件读取并重建了 {len(curve_points)} 条曲线的点集")
    
    # 输出树状结构
    A = tree
    
except FileNotFoundError as e:
    A = None
    print(f"错误：{str(e)}")
except Exception as e:
    A = None
    print(f"错误：处理CSV文件时发生异常 - {str(e)}")
# ---------- end script_21 ----------
panel_45 = Panel(script_21.A)
interpolate = Interpolate(Vertices=script_21.A, Degree=3, Periodic=False, KnotStyle=1)  # -> Curve, Length, Domain
X = UnitX(Factor=script_12.result)
divide = DivideCurve(Curve=interpolate.Curve, Count=Slider(30, range=0..100), Kinks=False)  # -> Points, Tangents, Parameters
move_5 = Move(Geometry=divide.Points, Motion=X)  # -> Geometry, Transform
multiplication_2 = Multiplication(A=divide.Parameters, B=Slider(3, range=0..10))
panel_46 = Panel(divide.Points)
ln = Line(StartPoint=divide.Points, EndPoint=move_5.Geometry)
Z = UnitZ(Factor=Slider(0.3, range=0..1))
bounds = Bounds(Numbers=multiplication_2)
extr = Extrude(Base=ln, Direction=Z)
brep_2 = Brep(extr)
deconstruct_domain = DeconstructDomain(Domain=bounds)  # -> Start, End
Y = UnitY(Factor=Slider(0.01, range=0..1))
Y_2 = UnitY(Factor=Slider(0, range=0..0.1))
extr_2 = Extrude(Base=brep_2, Direction=Y)
panel_47 = Panel(bounds)
gradient = Gradient(
    LowerLimit=deconstruct_domain.Start,
    UpperLimit=deconstruct_domain.End,
    Parameter=multiplication_2,
    stops=[0: RGB(243, 57, 0), 0.1: RGB(236, 27, 60), 0.2: RGB(210, 0, 118), 0.3: RGB(103, 0, 120), 0.4: RGB(39, 72, 161), 0.5: RGB(1, 192, 229), 0.6: RGB(18, 178, 90), 0.7: RGB(79, 186, 8), 0.8: RGB(220, 237, 32), 0.9: RGB(247, 159, 20), 1: RGB(243, 57, 0)])
move_6 = Move(Geometry=extr_2, Motion=Y_2)  # -> Geometry, Transform
panel_48 = Panel(move_6.Geometry)
move_to_point = MoveToPoint(Geometry=move_6.Geometry, PointA=pt, PointB=point)  # -> Moved, Vector, Transform
preview = CustomPreview(Geometry=move_to_point.Moved, Material=gradient)

# ----
# 全局变量
script_22 = Script(pts_tree=flip, Reset=boolean_toggle_2)  # -> out, A; inputs pts_tree: tree, Reset: Boolean
# ---------- script_22: Python ----------
import Grasshopper.Kernel.Data as gh_d
import Grasshopper.Kernel.Types as gh_t
import Rhino.Geometry as rg
import System.Data as sd
import System.IO as io
import csv
import System

# 创建数据表结构
def create_table():
    table = sd.DataTable("CurvePoints")
    
    # 添加列
    table.Columns.Add("CurveIndex", System.Int32)
    table.Columns.Add("PointIndex", System.Int32)
    table.Columns.Add("X", System.Double)
    table.Columns.Add("Y", System.Double)
    table.Columns.Add("Z", System.Double)
    
    return table

# 将点树转换为表格
def points_to_table(points_tree):
    table = create_table()
    
    # 遍历DataTree的每个分支
    for curve_index in range(points_tree.BranchCount):
        path = points_tree.Paths[curve_index]
        points = points_tree.Branch(path)
        
        # 确保每个曲线有3个点
        if len(points) == 3:
            for point_index, point in enumerate(points):
                try:
                    # 处理不同类型的点对象
                    if isinstance(point, gh_t.GH_Point):
                        rhino_point = point.Value
                    elif isinstance(point, rg.Point3d):
                        rhino_point = point
                    else:
                        # 尝试解析字符串格式的点
                        if isinstance(point, str):
                            parts = point.split(',')
                            if len(parts) == 3:
                                x = float(parts[0])
                                y = float(parts[1])
                                z = float(parts[2])
                                rhino_point = rg.Point3d(x, y, z)
                            else:
                                raise ValueError(f"无法解析点字符串: {point}")
                        else:
                            rhino_point = point.Value  # 尝试提取值属性
                    
                    # 添加行到数据表
                    row = table.NewRow()
                    row["CurveIndex"] = System.Convert.ToInt32(curve_index)
                    row["PointIndex"] = System.Convert.ToInt32(point_index)
                    row["X"] = System.Convert.ToDouble(rhino_point.X)
                    row["Y"] = System.Convert.ToDouble(rhino_point.Y)
                    row["Z"] = System.Convert.ToDouble(rhino_point.Z)
                    table.Rows.Add(row)
                    
                except Exception as e:
                    print(f"警告：无法处理点 {point} - 错误：{str(e)}")
        else:
            print(f"警告：曲线 {curve_index} 包含 {len(points)} 个点（需要3个）")
    
    return table

# 使用Python的csv模块保存表格
def save_table_to_csv(table, file_path):
    try:
        # 确保目录存在
        directory = io.Path.GetDirectoryName(file_path)
        if not io.Directory.Exists(directory):
            io.Directory.CreateDirectory(directory)
            
        # 使用Python内置的csv模块写入文件
        with open(file_path, 'w', newline='', encoding='utf-8') as csvfile:
            writer = csv.writer(csvfile)
            
            # 写入表头
            headers = [col.ColumnName for col in table.Columns]
            writer.writerow(headers)
            
            # 写入数据行
            for row in table.Rows:
                values = []
                for col in table.Columns:
                    values.append(str(row[col]))
                writer.writerow(values)
        
        print(f"表格已成功保存到: {file_path}")
        return True
    except Exception as e:
        print(f"错误：保存表格失败 - {str(e)}")
        return False

# 主逻辑
if Reset:
    # 转换点树为表格
    point_table = points_to_table(pts_tree)
    
    # 保存表格到指定路径
    save_path = r"E:\研究生\研1\28 Digital feature\建模\curve_points.csv"
    save_successful = save_table_to_csv(point_table, save_path)
    
    # 输出保存结果
    A = save_successful
else:
    A = False
    print("未执行任何操作。将Reset设为True以保存表格")
# ---------- end script_22 ----------

# ---- group: 主模块（生成初始状态的线集合） (continued)
panel_49 = Panel(script_22.A)

# ---- group: 头显输出
brep_3 = Brep(move_to_point.Moved)
mesh_brep = MeshBrep(
    Brep=brep_3,
    Settings={GridMaxCount=0, GridMinCount=16, JaggedSeams=False, MaxEdgeLength=0, MinEdgeLength=0.0001, MinTolerance=0, Refine=True, RefineAngle=0, RelativeTolerance=0.65, SimplePlanes=True, Tolerance=0})
brep_4 = Brep(<brep referenced from the Rhino model>)
brep_5 = Brep(<brep referenced from the Rhino model>)
brep_6 = Brep(<brep referenced from the Rhino model>)
brep_7 = Brep(<brep referenced from the Rhino model>)
mesh_colours_3 = MeshColours(Mesh=graft(mesh_brep), Colours=graft(gradient))
mesh_brep_2 = MeshBrep(
    Brep=brep_5,
    Settings={GridMaxCount=0, GridMinCount=16, JaggedSeams=False, MaxEdgeLength=0, MinEdgeLength=0.0001, MinTolerance=0, Refine=True, RefineAngle=0, RelativeTolerance=0.65, SimplePlanes=True, Tolerance=0})
mesh_brep_3 = MeshBrep(
    Brep=brep_4,
    Settings={GridMaxCount=0, GridMinCount=16, JaggedSeams=False, MaxEdgeLength=0, MinEdgeLength=0.0001, MinTolerance=0, Refine=True, RefineAngle=0, RelativeTolerance=0.65, SimplePlanes=True, Tolerance=0})
mesh_brep_4 = MeshBrep(
    Brep=brep_6,
    Settings={GridMaxCount=0, GridMinCount=16, JaggedSeams=False, MaxEdgeLength=0, MinEdgeLength=0.0001, MinTolerance=0, Refine=True, RefineAngle=0, RelativeTolerance=0.65, SimplePlanes=True, Tolerance=0})
mesh_brep_5 = MeshBrep(
    Brep=brep_7,
    Settings={GridMaxCount=0, GridMinCount=16, JaggedSeams=False, MaxEdgeLength=0, MinEdgeLength=0.0001, MinTolerance=0, Refine=True, RefineAngle=0, RelativeTolerance=0.65, SimplePlanes=True, Tolerance=0})
send = Send(Timestamp=receive.Timestamp, Meshes=flatten([relay, mesh_colours_3, mesh_brep_3, mesh_brep_2, mesh_brep_4, mesh_brep_5]))
