# Grasshopper definition 总电池（轻量化改写).gh (Grasshopper 1.0.7)
# plug-ins: RhinoCodePluginGH, BodyAnalytics, Pufferfish

# ---- group: sever开启
# 这颗电池负责按一定刷新率激活
# 每次激活将最新数据传递给后面的gh电池。
boolean_toggle = BooleanToggle(False)
number_slider = Slider(250, range=100..5000)
serverconnector = ServerConnector(Host="127.0.0.1", Port="8899", Run=boolean_toggle)
receive = Receive(Interval=number_slider)  # -> Timestamp, Body, PyMessage, RCSLocation
panel = Panel(receive.Timestamp)
panel_2 = Panel(receive.PyMessage)

# ----
point = Point(receive.RCSLocation)
number_slider_2 = Slider(1000, range=0..1000)

# ---- group: 判断谁有权限
# 动作一地贴
point_2 = Point(<point referenced from the Rhino model>)

# 动作三地贴
point_3 = Point(<point referenced from the Rhino model>)

# 动作二地贴
point_4 = Point(<point referenced from the Rhino model>)

# 动作四地贴
point_5 = Point(<point referenced from the Rhino model>)

# ---- group: 动作二
# #决定序列规模（单位时间抽几帧）
回溯多少毫秒之前的帧数 = Slider(1000, range=0..10000)
division = Division(A=回溯多少毫秒之前的帧数, B=number_slider)

# ---- group: 动作二 / 获取帷幔序列
brep = Brep([<brep referenced from the Rhino model> x5])
list_length = ListLength(List=brep)
起始号 = Slider(1, range=0..1)
步数 = Slider(1, range=0..1)
series = Series(Start=起始号, Step=步数, Count=list_length)

# ----
csharp_script = CSharpScript()  # -> out, a
# ---------- csharp_script: C# ----------
// Grasshopper Script Instance
using System;
using System.Collections;
using System.Collections.Generic;
using System.Drawing;

using Rhino;
using Rhino.Geometry;

using Grasshopper;
using Grasshopper.Kernel;
using Grasshopper.Kernel.Data;
using Grasshopper.Kernel.Types;

public class Script_Instance : GH_ScriptInstance
{
  /* 
    Members:
      RhinoDoc RhinoDocument
      GH_Document GrasshopperDocument
      IGH_Component Component
      int Iteration

    Methods (Virtual & overridable):
      Print(string text)
      Print(string format, params object[] args)
      Reflect(object obj)
      Reflect(object obj, string method_name)
  */
  
  private void RunScript(object x, object y, ref object a)
  {
    // Write your logic here
    a = null;
  }
}
# ---------- end csharp_script ----------
number = Number()
number_2 = Number()

# ---- group: 点位移动
# 中点向Z轴方向位移
# 最右点向Y轴方向位移
number_slider_3 = Slider(0, range=0..10)
vector_xyz = VectorXYZ(XComponent=0, YComponent=0, ZComponent=0.5)  # -> Vector, Length
vector_xyz_2 = VectorXYZ(XComponent=0, YComponent=1, ZComponent=0)  # -> Vector, Length
list_item = ListItem(Index=Slider(2, range=0..10), Wrap=True)
list_item_2 = ListItem(Index=Slider(1, range=0..10), Wrap=True)
list_item_3 = ListItem(Index=number_slider_3, Wrap=True)
move = Move(Geometry=list_item_2, Motion=vector_xyz.Vector)  # -> flatten(Geometry), Transform
deconstruct = Deconstruct(Point=list_item_2)  # -> XComponent, YComponent, ZComponent
move_2 = Move(Geometry=list_item, Motion=vector_xyz_2.Vector)  # -> flatten(Geometry), Transform
deconstruct_2 = Deconstruct(Point=list_item)  # -> XComponent, YComponent, ZComponent
deconstruct_3 = Deconstruct(Point=list_item_3)  # -> XComponent, YComponent, ZComponent
subtraction = Subtraction(A=deconstruct_2.YComponent, B=deconstruct.YComponent)
panel_3 = Panel(subtraction)
merge = Merge(Data1=list_item_3, Data2=move.Geometry, Data3=move_2.Geometry)
script = Script(NewPts=merge)  # -> out, A; inputs NewPts: list of Point3d
# ---------- script: Python ----------
import csv
import os
import Rhino.Geometry as rg

# 参数设置
csv_file = r"E:\研究生\研1\28 Digital feature\建模\curve_points.csv"  # CSV文件路径
new_points = NewPts          # 修改后的点集

try:
    # 检查文件是否存在
    if not os.path.exists(csv_file):
        raise FileNotFoundError(f"CSV文件不存在: {csv_file}")
    
    # 检查输入有效性
    if not new_points or len(new_points) != 3:
        raise ValueError("需要提供3个有效的新点")
    
    # 提取第一个新点的X坐标作为匹配键
    first_x = float(new_points[0].X)
    
    # 读取并修改数据
    temp_file = csv_file + ".temp"
    updated_rows = []
    points_updated = 0
    target_curve_index = None
    curve_points_found = 0
    
    with open(csv_file, 'r', encoding='utf-8') as file:
        reader = csv.DictReader(file)
        headers = reader.fieldnames
        
        for row in reader:
            current_x = float(row['X'])
            current_curve = int(row['CurveIndex'])
            point_index = int(row['PointIndex'])
            
            # 如果是第一次遇到匹配X坐标的点，记录CurveIndex
            if current_x == first_x and target_curve_index is None:
                target_curve_index = current_curve
                print(f"找到匹配的曲线，CurveIndex={target_curve_index}")
            
            # 如果是目标曲线的点
            if current_curve == target_curve_index:
                # 确保有对应的新点
                if curve_points_found < len(new_points):
                    new_point = new_points[curve_points_found]
                    
                    # 转换为Rhino点
                    if isinstance(new_point, rg.Point3d):
                        rhino_point = new_point
                    elif isinstance(new_point, gh_t.GH_Point):
                        rhino_point = new_point.Value
                    else:
                        # 尝试解析其他类型
                        try:
                            rhino_point = rg.Point3d(
                                float(new_point.X), 
                                float(new_point.Y), 
                                float(new_point.Z)
                            )
                        except:
                            print(f"警告：无法转换点 {new_point}，使用原始值")
                            rhino_point = None
                    
                    # 更新行数据（仅更新Y和Z坐标）
                    if rhino_point:
                        row['Y'] = str(rhino_point.Y)
                        row['Z'] = str(rhino_point.Z)
                        points_updated += 1
                        print(f"已更新曲线 {target_curve_index} 的点 {point_index}")
                
                curve_points_found += 1
            
            updated_rows.append(row)
    
    # 检查是否找到了所有三个点
    if target_curve_index is None:
        raise ValueError(f"未找到X坐标为 {first_x} 的点")
    
    if curve_points_found != 3:
        print(f"警告：为曲线 {target_curve_index} 找到 {curve_points_found} 个点（需要3个）")
    
    # 写入更新后的文件
    with open(temp_file, 'w', newline='', encoding='utf-8') as file:
        writer = csv.DictWriter(file, fieldnames=headers)
        writer.writeheader()
        writer.writerows(updated_rows)
    
    # 替换原文件
    os.replace(temp_file, csv_file)
    print(f"CSV文件已成功更新: {csv_file}")
    
    # 输出成功标志
    A = points_updated > 0
    
except FileNotFoundError as e:
    A = False
    print(f"错误：{str(e)}")
except ValueError as e:
    A = False
    print(f"错误：{str(e)}")
except Exception as e:
    A = False
    print(f"错误：更新CSV文件时发生异常 - {str(e)}")
# ---------- end script ----------
panel_4 = Panel(script.A)

# ----
csharp_script_2 = CSharpScript(FilePath="E:\\研究生\\研1\\28 Digital feature\\建模\\curve_points.csv")  # -> PointTree, Status
# ---------- csharp_script_2: C# ----------
using System;
using System.Collections.Generic;
using System.IO;
using System.Linq;
using Grasshopper.Kernel;
using Grasshopper.Kernel.Data;
using Grasshopper.Kernel.Types;
using Rhino.Geometry;

public class ReadCurvePointsFromCsvComponent : GH_Component
{
    public ReadCurvePointsFromCsvComponent()
        : base("Read Curve Points from CSV", "ReadCurvePointsCSV",
              "Reads point data from CSV and builds a GH point tree",
              "Data", "IO")
    { }

    protected override void RegisterInputParams(GH_InputParamManager pManager)
    {
        pManager.AddTextParameter("FilePath", "FP", "Full path to the CSV file", GH_ParamAccess.item);
    }

    protected override void RegisterOutputParams(GH_OutputParamManager pManager)
    {
        pManager.AddGenericParameter("PointTree", "Tree", "GH point tree structure", GH_ParamAccess.tree);
        pManager.AddTextParameter("Status", "S", "Operation status message", GH_ParamAccess.item);
    }

    protected override void SolveInstance(IGH_DataAccess DA)
    {
        // 获取输入数据
        string filePath = string.Empty;
        if (!DA.GetData(0, ref filePath)) return;

        // 初始化输出变量
        var tree = new GH_Structure<GH_Point>();
        string statusMessage = "";

        try
        {
            // 检查文件是否存在
            if (!File.Exists(filePath))
            {
                throw new FileNotFoundException($"CSV文件不存在: {filePath}");
            }

            // 按CurveIndex分组存储点
            var curvePoints = new Dictionary<int, List<Tuple<int, Point3d>>>();

            // 读取CSV文件
            using (var reader = new StreamReader(filePath))
            {
                // 读取标题行
                string headerLine = reader.ReadLine();
                if (headerLine == null || !headerLine.Contains("CurveIndex"))
                {
                    throw new InvalidDataException("CSV文件缺少必要的表头");
                }

                // 处理数据行
                while (!reader.EndOfStream)
                {
                    string line = reader.ReadLine();
                    if (string.IsNullOrWhiteSpace(line)) continue;

                    string[] values = line.Split(',');
                    if (values.Length < 5) continue;

                    // 解析数据
                    if (int.TryParse(values[0], out int curveIndex) &&
                        int.TryParse(values[1], out int pointIndex) &&
                        double.TryParse(values[2], out double x) &&
                        double.TryParse(values[3], out double y) &&
                        double.TryParse(values[4], out double z))
                    {
                        // 创建点
                        var point = new Point3d(x, y, z);
                        
                        // 添加到对应曲线
                        if (!curvePoints.ContainsKey(curveIndex))
                        {
                            curvePoints[curveIndex] = new List<Tuple<int, Point3d>>();
                        }
                        
                        curvePoints[curveIndex].Add(Tuple.Create(pointIndex, point));
                    }
                }
            }

            // 构建点树结构
            foreach (var curve in curvePoints)
            {
                // 按PointIndex排序
                var sortedPoints = curve.Value.OrderBy(p => p.Item1).ToList();
                
                // 创建路径
                var path = new GH_Path(curve.Key);
                
                // 添加点到树
                foreach (var pointTuple in sortedPoints)
                {
                    tree.Append(new GH_Point(pointTuple.Item2), path);
                }
            }

            statusMessage = $"成功从CSV文件读取并重建了 {curvePoints.Count} 条曲线的点集";
        }
        catch (FileNotFoundException ex)
        {
            tree = new GH_Structure<GH_Point>();
            statusMessage = $"错误: {ex.Message}";
            AddRuntimeMessage(GH_RuntimeMessageLevel.Error, ex.Message);
        }
        catch (InvalidDataException ex)
        {
            tree = new GH_Structure<GH_Point>();
            statusMessage = $"错误: {ex.Message}";
            AddRuntimeMessage(GH_RuntimeMessageLevel.Error, ex.Message);
        }
        catch (Exception ex)
        {
            tree = new GH_Structure<GH_Point>();
            statusMessage = $"错误: 处理CSV文件时发生异常 - {ex.Message}";
            AddRuntimeMessage(GH_RuntimeMessageLevel.Error, ex.Message);
        }

        // 设置输出
        DA.SetDataTree(0, tree);
        DA.SetData(1, statusMessage);
    }

    public override Guid ComponentGuid => new Guid("C4D5E6F7-89AB-4CDE-F012-3456789ABCDE");
    protected override System.Drawing.Bitmap Icon => null;
}
# ---------- end csharp_script_2 ----------

# ---- group: 判断谁有权限
# 第一个人的触发半径
deconstruct_body = DeconstructBody(Body=receive.Body)  # -> Id, UniqueObjectId, ActionState, Position, Velocity, PositionCovariance, Confidence, HeadPosition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
panel_5 = Panel(deconstruct_body.Position)
number_slider_4 = Slider(0.6, range=0..10)

# 第一个人
# 第二个人
list_item_4 = ListItem(List=deconstruct_body.Position, Index=0, Wrap=True)  # -> Item, Item1

distance = Distance(PointA=list_item_4.Item, PointB=point_2)
distance_2 = Distance(PointA=list_item_4.Item1, PointB=point_5)
distance_3 = Distance(PointA=list_item_4.Item1, PointB=point_2)
distance_4 = Distance(PointA=list_item_4.Item, PointB=point_5)
distance_5 = Distance(PointA=list_item_4.Item, PointB=point_4)
distance_6 = Distance(PointA=list_item_4.Item1, PointB=point_3)
distance_7 = Distance(PointA=list_item_4.Item, PointB=point_3)
distance_8 = Distance(PointA=list_item_4.Item1, PointB=point_4)
smaller_than = SmallerThan(FirstNumber=distance, SecondNumber=number_slider_2)  # -> SmallerThan, OrEqualTo
smaller_than_2 = SmallerThan(FirstNumber=distance_3, SecondNumber=number_slider_2)  # -> SmallerThan, OrEqualTo
smaller_than_3 = SmallerThan(FirstNumber=distance_5, SecondNumber=number_slider_2)  # -> SmallerThan, OrEqualTo
smaller_than_4 = SmallerThan(FirstNumber=distance_6, SecondNumber=number_slider_2)  # -> SmallerThan, OrEqualTo
smaller_than_5 = SmallerThan(FirstNumber=distance_4, SecondNumber=number_slider_2)  # -> SmallerThan, OrEqualTo
smaller_than_6 = SmallerThan(FirstNumber=distance_2, SecondNumber=number_slider_2)  # -> SmallerThan, OrEqualTo
smaller_than_7 = SmallerThan(FirstNumber=distance_8, SecondNumber=number_slider_2)  # -> SmallerThan, OrEqualTo
smaller_than_8 = SmallerThan(FirstNumber=distance_7, SecondNumber=number_slider_2)  # -> SmallerThan, OrEqualTo

# ----
script_2 = Script(DistanceA=distance, DistanceB=distance_3, BoolA=smaller_than.SmallerThan, BoolB=smaller_than_2.SmallerThan)  # -> out, result
# ---------- script_2: C# ----------
using System;
using Grasshopper.Kernel;
using Rhino.Geometry;

public class CompareDistancesComponent : GH_Component
{
    public CompareDistancesComponent()
        : base("Compare Distances", "CompDist", 
              "Compares distances based on boolean conditions", 
              "YourCategory", "YourSubcategory") 
    { }

    protected override void RegisterInputParams(GH_InputParamManager pManager)
    {
        pManager.AddBooleanParameter("BoolA", "A", "First boolean condition", GH_ParamAccess.item);
        pManager.AddBooleanParameter("BoolB", "B", "Second boolean condition", GH_ParamAccess.item);
        pManager.AddNumberParameter("DistanceA", "DistA", "First distance value", GH_ParamAccess.item);
        pManager.AddNumberParameter("DistanceB", "DistB", "Second distance value", GH_ParamAccess.item);
    }

    protected override void RegisterOutputParams(GH_OutputParamManager pManager)
    {
        pManager.AddTextParameter("Result", "R", "Comparison result pattern", GH_ParamAccess.item);
    }

    protected override void SolveInstance(IGH_DataAccess DA)
    {
        // 初始化输入变量
        bool boolA = false;
        bool boolB = false;
        double distanceA = 0.0;
        double distanceB = 0.0;

        // 获取输入数据
        if (!DA.GetData(0, ref boolA)) return;
        if (!DA.GetData(1, ref boolB)) return;
        if (!DA.GetData(2, ref distanceA)) return;
        if (!DA.GetData(3, ref distanceB)) return;

        try
        {
            // 执行比较逻辑
            string result = CompareDistances(boolA, boolB, distanceA, distanceB);
            
            // 仅当结果非空时设置输出
            if (result != null)
            {
                DA.SetData(0, result);
            }
        }
        catch (Exception e)
        {
            AddRuntimeMessage(GH_RuntimeMessageLevel.Error, "Error: " + e.Message);
        }
    }

    private string CompareDistances(bool boolA, bool boolB, double distanceA, double distanceB)
    {
        if (boolA && boolB)
        {
            return distanceA <= distanceB 
                ? "{0;0;0}" 
                : "{0;0;1}";
        }
        else if (boolA)
        {
            return "{0;0;0}";
        }
        else if (boolB)
        {
            return "{0;0;1}";
        }
        else
        {
            return null; // 都不满足时不输出
        }
    }

    public override Guid ComponentGuid => 
        new Guid("替换为你的唯一GUID"); // 生成新GUID: Guid.NewGuid()
    
    protected override System.Drawing.Bitmap Icon => 
        null; // 可添加图标资源
}
# ---------- end script_2 ----------
script_3 = Script(DistanceA=distance_5, DistanceB=distance_8, BoolA=smaller_than_3.SmallerThan, BoolB=smaller_than_7.SmallerThan)  # -> out, result; same code as script_2
script_4 = Script(DistanceA=distance_4, DistanceB=distance_2, BoolA=smaller_than_5.SmallerThan, BoolB=smaller_than_6.SmallerThan)  # -> out, result; same code as script_2
script_5 = Script(DistanceA=distance_7, DistanceB=distance_6, BoolA=smaller_than_8.SmallerThan, BoolB=smaller_than_4.OrEqualTo)  # -> out, result; same code as script_2

# ---- group: 判断谁有权限 (continued)
panel_6 = Panel(script_2.result)
split_tree = SplitTree(Data=deconstruct_body.Keypoints, Masks=flatten(script_2.result))  # -> Positive, Negative
panel_7 = Panel(split_tree.Positive)

# ---- group: 动作三（Y轴）
split_tree_2 = SplitTree(Data=deconstruct_body.Keypoints, Masks=flatten(script_5.result))  # -> Positive, Negative
panel_8 = Panel(split_tree_2.Positive)
deconstructkeypoints34 = DeconstructKeypoints34(Keypoints=split_tree_2.Positive)  # -> PELVIS, NAVAL_SPINE, CHEST_SPINE, NECK, LEFT_CLAVICLE, LEFT_SHOULDER, LEFT_ELBOW, LEFT_WRIST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
unit_z = UnitZ(Factor=1)
vector_2pt = Vector2Pt(PointA=deconstructkeypoints34.LEFT_ELBOW, PointB=deconstructkeypoints34.LEFT_WRIST, Unitize=False)  # -> Vector, Length
vector_2pt_2 = Vector2Pt(PointA=deconstructkeypoints34.RIGHT_ELBOW, PointB=deconstructkeypoints34.RIGHT_WRIST, Unitize=False)  # -> Vector, Length
number_slider_5 = Slider(1.5, range=0..10)
number_slider_6 = Slider(1, range=0..1)
angle = Angle(VectorA=vector_2pt_2.Vector, VectorB=unit_z)  # -> Angle, Reflex
panel_9 = Panel(angle.Angle)
angle_2 = Angle(VectorA=vector_2pt.Vector, VectorB=unit_z)  # -> Angle, Reflex
vector_2pt_3 = Vector2Pt(PointA=deconstructkeypoints34.RIGHT_ELBOW, PointB=deconstructkeypoints34.RIGHT_HANDTIP, Unitize=False)  # -> Vector, Length
larger_than = LargerThan(FirstNumber=angle.Angle, SecondNumber=number_slider_6)  # -> LargerThan, OrEqualTo
larger_than_2 = LargerThan(FirstNumber=angle_2.Angle, SecondNumber=number_slider_6)  # -> LargerThan, OrEqualTo
smaller_than_9 = SmallerThan(FirstNumber=angle.Angle, SecondNumber=number_slider_5)  # -> SmallerThan, OrEqualTo
smaller_than_10 = SmallerThan(FirstNumber=angle_2.Angle, SecondNumber=number_slider_5)  # -> SmallerThan, OrEqualTo
panel_10 = Panel(angle_2.Angle)
gate_and = GateAnd(A=larger_than_2.LargerThan, B=larger_than.LargerThan, C=smaller_than_10.SmallerThan, D=smaller_than_9.SmallerThan)
两手指尖距离 = Vector2Pt(PointA=deconstructkeypoints34.LEFT_HANDTIP, PointB=deconstructkeypoints34.RIGHT_HANDTIP, Unitize=False)  # -> Vector, Length
panel_12 = Panel(gate_and)
panel_13 = Panel(两手指尖距离.Length)
list_item_5 = ListItem(List=两手指尖距离.Length, Index=0, Wrap=True)
panel_14 = Panel(list_item_5)
number_slider_7 = Slider(8, range=0..10)
dataqueue = DataQueue(Data=list_item_5, RecordCount=number_slider_7)  # -> flatten(OutputData), OldestPath, NewestPath
subtraction_2 = Subtraction(A=number_slider_7, B=Slider(1, range=0..1))
absolute = Absolute(Value=number)
mass_addition = MassAddition(Input=absolute)  # -> Result, PartialResults
division_2 = Division(A=mass_addition.Result, B=subtraction_2)
subtraction_3 = Subtraction(A=absolute, B=division_2)
panel_15 = Panel(absolute)
square = Square(Value=subtraction_3)
mass_addition_2 = MassAddition(Input=square)  # -> Result, PartialResults
division_3 = Division(A=mass_addition_2.Result, B=subtraction_2)
square_root = SquareRoot(Value=division_3)
smaller_than_11 = SmallerThan(FirstNumber=square_root, SecondNumber=Slider(0.08, range=0..0.1))  # -> SmallerThan, OrEqualTo
panel_17 = Panel(square_root)
panel_18 = Panel(smaller_than_11.SmallerThan)
gate_and_2 = GateAnd(A=smaller_than_11.SmallerThan, B=gate_and)
construct_domain = ConstructDomain(DomainStart=Slider(0, range=0..100), DomainEnd=subtraction)
panel_19 = Panel(gate_and_2)
remap_numbers = RemapNumbers(Value=两手指尖距离.Length, Source=vector_2pt_3.Length, Target=construct_domain)  # -> Mapped, Clipped
panel_20 = Panel(remap_numbers.Mapped)
script_6 = Script(x=remap_numbers.Mapped, trigger=gate_and_2)  # -> out, a; inputs x: Double, trigger: Boolean
# ---------- script_6: Python ----------
# 使用全局字典实现持久化存储
if "position_tracker" not in globals():
    global position_tracker
    position_tracker = {}

# 获取当前组件的唯一ID
comp_id = str(ghenv.Component.InstanceGuid)

# 初始化存储值（仅在第一次运行时执行）
if comp_id not in position_tracker:
    position_tracker[comp_id] = 0.0  # 初始值设为0.0

# 主逻辑处理
if trigger:
    # 布尔值为True：使用新值并更新存储
    position_tracker[comp_id] = x
    a = x
else:
    # 布尔值为False：使用存储的上一个值
    a = position_tracker[comp_id]
# ---------- end script_6 ----------
negative = Negative(Value=script_6.a)
panel_21 = Panel(script_6.a)
unit_y = UnitY(Factor=negative)

# ---- group: 动作四（Z轴）
split_tree_3 = SplitTree(Data=deconstruct_body.Keypoints, Masks=flatten(script_4.result))  # -> Positive, Negative
panel_22 = Panel(split_tree_3.Positive)
deconstructkeypoints34_2 = DeconstructKeypoints34(Keypoints=split_tree_3.Positive)  # -> PELVIS, NAVAL_SPINE, CHEST_SPINE, NECK, LEFT_CLAVICLE, LEFT_SHOULDER, LEFT_ELBOW, LEFT_WRIST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
unit_z_2 = UnitZ(Factor=1)
unit_z_3 = UnitZ(Factor=1)
vector_2pt_4 = Vector2Pt(PointA=deconstructkeypoints34_2.LEFT_ELBOW, PointB=deconstructkeypoints34_2.LEFT_WRIST, Unitize=False)  # -> Vector, Length
vector_2pt_5 = Vector2Pt(PointA=deconstructkeypoints34_2.RIGHT_ELBOW, PointB=deconstructkeypoints34_2.RIGHT_WRIST, Unitize=False)  # -> Vector, Length
angle_3 = Angle(VectorA=vector_2pt_5.Vector, VectorB=unit_z_3)  # -> Angle, Reflex
angle_4 = Angle(VectorA=vector_2pt_4.Vector, VectorB=unit_z_2)  # -> Angle, Reflex
vector_2pt_6 = Vector2Pt(PointA=deconstructkeypoints34_2.RIGHT_ELBOW, PointB=deconstructkeypoints34_2.RIGHT_HANDTIP, Unitize=False)  # -> Vector, Length
larger_than_3 = LargerThan(FirstNumber=angle_4.Angle, SecondNumber=Slider(1, range=0..1))  # -> LargerThan, OrEqualTo
smaller_than_12 = SmallerThan(FirstNumber=angle_4.Angle, SecondNumber=Slider(1.5, range=0..10))  # -> SmallerThan, OrEqualTo
smaller_than_13 = SmallerThan(FirstNumber=angle_3.Angle, SecondNumber=Slider(0.2, range=0..1))  # -> SmallerThan, OrEqualTo
panel_23 = Panel(angle_4.Angle)
panel_24 = Panel(angle_3.Angle)
gate_and_3 = GateAnd(A=larger_than_3.LargerThan, B=smaller_than_13.SmallerThan, C=smaller_than_12.SmallerThan)
deconstruct_4 = Deconstruct(Point=deconstructkeypoints34_2.RIGHT_HANDTIP)  # -> XComponent, YComponent, ZComponent
deconstruct_5 = Deconstruct(Point=deconstructkeypoints34_2.LEFT_HANDTIP)  # -> XComponent, YComponent, ZComponent
number_slider_8 = Slider(0, range=0..10)
panel_25 = Panel(gate_and_3)
subtraction_4 = Subtraction(A=deconstruct_4.ZComponent, B=deconstruct_5.ZComponent)
absolute_2 = Absolute(Value=subtraction_4)
list_item_6 = ListItem(List=absolute_2, Index=0, Wrap=True)
panel_26 = Panel(absolute_2)
number_slider_9 = Slider(8, range=0..10)
dataqueue_2 = DataQueue(Data=list_item_6, RecordCount=number_slider_9)  # -> flatten(OutputData), OldestPath, NewestPath
subtraction_5 = Subtraction(A=number_slider_9, B=Slider(1, range=0..1))
absolute_3 = Absolute(Value=number_2)
deconstruct_6 = Deconstruct(Point=point_5)  # -> XComponent, YComponent, ZComponent
mass_addition_3 = MassAddition(Input=absolute_3)  # -> Result, PartialResults
division_4 = Division(A=mass_addition_3.Result, B=subtraction_5)
subtraction_6 = Subtraction(A=absolute_3, B=division_4)
panel_27 = Panel(absolute_3)
square_2 = Square(Value=subtraction_6)
mass_addition_4 = MassAddition(Input=square_2)  # -> Result, PartialResults
division_5 = Division(A=mass_addition_4.Result, B=subtraction_5)
square_root_2 = SquareRoot(Value=division_5)
smaller_than_14 = SmallerThan(FirstNumber=square_root_2, SecondNumber=Slider(0.03, range=0..1))  # -> SmallerThan, OrEqualTo
panel_29 = Panel(square_root_2)
subtraction_7 = Subtraction(A=deconstruct_3.ZComponent, B=deconstruct_6.ZComponent)
gate_and_4 = GateAnd(A=smaller_than_14.SmallerThan, B=gate_and_3)
panel_30 = Panel(smaller_than_14.SmallerThan)
panel_31 = Panel(gate_and_4)
construct_domain_2 = ConstructDomain(DomainStart=Slider(0, range=0..100), DomainEnd=subtraction_7)
remap_numbers_2 = RemapNumbers(Value=absolute_2, Source=vector_2pt_6.Length, Target=construct_domain_2)  # -> Mapped, Clipped
panel_32 = Panel(remap_numbers_2.Mapped)
script_7 = Script(x=remap_numbers_2.Mapped, trigger=gate_and_4)  # -> out, a; inputs x: Double, trigger: Boolean; same code as script_6
negative_2 = Negative(Value=script_7.a)
panel_34 = Panel(script_7.a)
unit_z_4 = UnitZ(Factor=negative_2)

# ----
csharp_script_3 = CSharpScript(Values=dataqueue.OutputData)  # -> Differences
# ---------- csharp_script_3: C# ----------
using System;
using System.Collections.Generic;
using Grasshopper.Kernel;

public class AbsoluteDifferenceComponent : GH_Component
{
    public AbsoluteDifferenceComponent()
        : base("Absolute Differences", "AbsDiff",
              "Calculates differences between absolute values of consecutive numbers",
              "Math", "Sequence")
    { }

    protected override void RegisterInputParams(GH_InputParamManager pManager)
    {
        pManager.AddNumberParameter("Values", "V", "List of values to process", GH_ParamAccess.list);
    }

    protected override void RegisterOutputParams(GH_OutputParamManager pManager)
    {
        pManager.AddNumberParameter("Differences", "D", "List of absolute differences between consecutive values", GH_ParamAccess.list);
    }

    protected override void SolveInstance(IGH_DataAccess DA)
    {
        // 初始化输入变量
        List<double> inputValues = new List<double>();

        // 获取输入数据
        if (!DA.GetDataList(0, inputValues)) return;
        
        try
        {
            // 处理输入不足的情况
            if (inputValues.Count < 2)
            {
                DA.SetDataList(0, new List<double>());
                return;
            }

            // 计算绝对值
            List<double> absValues = new List<double>();
            foreach (double val in inputValues)
            {
                absValues.Add(Math.Abs(val));
            }

            // 计算差分
            List<double> differences = new List<double>();
            for (int i = 0; i < absValues.Count - 1; i++)
            {
                differences.Add(absValues[i + 1] - absValues[i]);
            }

            // 输出结果
            DA.SetDataList(0, differences);
        }
        catch (Exception e)
        {
            AddRuntimeMessage(GH_RuntimeMessageLevel.Error, "Error: " + e.Message);
        }
    }

    // 生成唯一组件ID
    public override Guid ComponentGuid => new Guid("E8A2C4B1-3D7F-4A8D-BF3A-9C3D5F1E8B2A");
    
    // 可选的图标资源
    protected override System.Drawing.Bitmap Icon => null;
}
# ---------- end csharp_script_3 ----------
csharp_script_4 = CSharpScript(Values=dataqueue_2.OutputData)  # -> Differences; same code as csharp_script_3

# ---- group: 动作二
# 右脚踝z轴在某时间内位移超过某值，
# 且xy平面位移小于某值，
# 触发单元选择切换
# 替换成左上方的length
# 输出跺脚后选中的序列号
# ##不存在触发两次的问题：
# 点【22】坐标变化很快时（跺脚），
# 第二个布尔门会从False变成True（变换一次，第三个布尔门变True），
# 并且可能会连着输出好几个True
# 但此时没发生布尔变换），所以第三个布尔门变回False
# 
# 当跺脚结束，第二个布尔门变False（变换一次）
# 但不满足前一个点【22】坐标变化的条件
# 所以第三个布尔门还是False
split_tree_4 = SplitTree(Data=deconstruct_body.Keypoints, Masks=flatten(script_3.result))  # -> Positive, Negative
deconstructkeypoints34_3 = DeconstructKeypoints34(Keypoints=split_tree_4.Positive)  # -> PELVIS, NAVAL_SPINE, CHEST_SPINE, NECK, LEFT_CLAVICLE, LEFT_SHOULDER, LEFT_ELBOW, LEFT_WRIST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
左手指尖 = ListItem(List=deconstructkeypoints34_3.RIGHT_ANKLE, Index=0, Wrap=True)
deconstruct_7 = Deconstruct(Point=左手指尖)  # -> XComponent, YComponent, ZComponent

# ---- group: 动作一
# （2）9、16点在3秒内位置变动小于X
# （1）9、16的高度超过18，触发单元尺寸修改
# b为每一小片单元的宽度
deconstructkeypoints34_4 = DeconstructKeypoints34(Keypoints=split_tree.Positive)  # -> PELVIS, NAVAL_SPINE, CHEST_SPINE, NECK, LEFT_CLAVICLE, LEFT_SHOULDER, LEFT_ELBOW, LEFT_WRIST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
unit_z_5 = UnitZ(Factor=1)
unit_z_6 = UnitZ(Factor=1)
division_6 = Division(A=Slider(3000, range=0..10000), B=number_slider)
number_slider_10 = Slider(2, range=0..4)

# 右腕
右手指尖 = ListItem(List=deconstructkeypoints34_4.RIGHT_WRIST, Index=0, Wrap=True)

# 左肘
list_item_7 = ListItem(List=deconstructkeypoints34_4.LEFT_ELBOW, Index=0, Wrap=True)

# 左腕
右手指尖_2 = ListItem(List=deconstructkeypoints34_4.LEFT_WRIST, Index=0, Wrap=True)

# 右肘
list_item_8 = ListItem(List=deconstructkeypoints34_4.RIGHT_ELBOW, Index=0, Wrap=True)

# 脊椎（胸部）
右髋 = ListItem(List=deconstructkeypoints34_4.NAVAL_SPINE, Index=0, Wrap=True)

deconstruct_8 = Deconstruct(Point=右手指尖_2)  # -> XComponent, YComponent, ZComponent
vector_2pt_7 = Vector2Pt(PointA=右手指尖_2, PointB=list_item_7, Unitize=False)  # -> Vector, Length
deconstruct_9 = Deconstruct(Point=右髋)  # -> XComponent, YComponent, ZComponent
deconstruct_10 = Deconstruct(Point=右手指尖)  # -> XComponent, YComponent, ZComponent
vector_2pt_8 = Vector2Pt(PointA=右手指尖, PointB=list_item_8, Unitize=False)  # -> Vector, Length
angle_5 = Angle(VectorA=vector_2pt_7.Vector, VectorB=unit_z_5)  # -> Angle, Reflex
angle_6 = Angle(VectorA=vector_2pt_8.Vector, VectorB=unit_z_6)  # -> Angle, Reflex
larger_than_4 = LargerThan(FirstNumber=deconstruct_10.ZComponent, SecondNumber=deconstruct_9.ZComponent)  # -> LargerThan, OrEqualTo
larger_than_5 = LargerThan(FirstNumber=deconstruct_8.ZComponent, SecondNumber=deconstruct_9.ZComponent)  # -> LargerThan, OrEqualTo
smaller_than_15 = SmallerThan(FirstNumber=angle_5.Angle, SecondNumber=Slider(0.3, range=0..1))  # -> SmallerThan, OrEqualTo
smaller_than_16 = SmallerThan(FirstNumber=angle_6.Angle, SecondNumber=Slider(0.3, range=0..1))  # -> SmallerThan, OrEqualTo
panel_35 = Panel(larger_than_5.LargerThan)
dataqueue_3 = DataQueue(Data=右手指尖_2, RecordCount=division_6)  # -> flatten(OutputData), OldestPath, NewestPath
deconstruct_11 = Deconstruct(Point=dataqueue_3.OutputData)  # -> XComponent, YComponent, ZComponent
script_8 = Script(input_list=deconstruct_11.ZComponent)  # -> out, result; inputs input_list: list of Double
# ---------- script_8: Python ----------
# 直接计算12元素列表的首尾差值绝对值
data = input_list

# 确保输入是包含12个元素的列表
if data is not None and len(data) == 12:
    result = abs(data[11] - data[0])  # 使用固定索引11（第12个元素）
else:
    result = None  # 不符合条件时返回None，表示不输出

# 输出结果
result
# ---------- end script_8 ----------
smaller_than_17 = SmallerThan(FirstNumber=script_8.result, SecondNumber=Slider(0.02, range=0..1))  # -> SmallerThan, OrEqualTo
script_9 = Script(Result=smaller_than_17.SmallerThan)  # -> out, result; inputs Result: Boolean
# ---------- script_9: Python ----------
# 初始化历史记录列表（使用全局变量保持状态）
if 'history' not in globals():
    history = []

# 获取当前帧的布尔值
current_value = Result

# 添加当前值到历史记录
if current_value is not None:
    history.append(current_value)

# 检查是否存在连续两个及以上的True
result = False
if len(history) >= 2:
    for i in range(len(history) - 1):
        if history[i] and history[i+1]:
            result = True
            break

# 输出结果
result
# ---------- end script_9 ----------
gate_and_5 = GateAnd(A=larger_than_5.LargerThan, B=larger_than_4.LargerThan, C=smaller_than_15.SmallerThan, D=smaller_than_16.SmallerThan)
gate_and_6 = GateAnd(A=script_9.result, B=gate_and_5)
data_recorder = DataRecorder(gate_and_6, DataLimit=-10, RecordData=True)
panel_36 = Panel(data_recorder)
distance_9 = Distance(PointA=右手指尖_2, PointB=右手指尖)
script_10 = Script(Result=gate_and_6)  # -> out, result; inputs Result: Boolean
# ---------- script_10: Python ----------
# 初始化存储历史结果的列表（使用全局变量保持状态）
if 'history' not in globals():
    history = []

# 获取当前帧的布尔值
current_value = Result

# 添加当前值到历史记录
if current_value is not None:
    history.append(current_value)

# 确保历史记录至少有两个值
if len(history) >= 2:
    # 获取最后两个值
    last_value = history[-1]
    second_last_value = history[-2]
    
    # 判断是否一个为True，另一个为False
    result = (last_value != second_last_value)
else:
    # 历史记录不足时返回False
    result = False

# 输出结果
result
# ---------- end script_10 ----------
script_11 = Script(distance=distance_9)  # -> out, result; inputs distance: Double
# ---------- script_11: Python ----------
def limit_min_distance(distance):
    """
    限制距离的最小值为0.2：
    - 若distance ≤ 0.2，返回0.2
    - 若distance > 0.2，返回原数
    """
    return max(0.2, distance)

# 主执行逻辑
try:
    # 获取输入参数
    d = distance
    
    # 应用最小值限制
    result = limit_min_distance(d)
    
except Exception as e:
    # 错误处理
    result = "错误: " + str(e)
    print(result)

# 输出结果
result
# ---------- end script_11 ----------
gate_and_7 = GateAnd(A=gate_and_6, B=script_10.result)
data_recorder_2 = DataRecorder(gate_and_7, DataLimit=-10, RecordData=True)
script_12 = Script(Distance=script_11.result, Result=gate_and_7)  # -> a, b; inputs Distance: Double, Result: Boolean
# ---------- script_12: Python ----------
# 导入必要的库
import rhinoscriptsyntax as rs

# 获取输入参数
result = Result  # 前一个电池组的布尔输出
distance = Distance  # 距离值

# 根据result的值决定是否输出distance
if result:
    b = distance  # 将distance赋值给输出参数a
else:
    b = None  # 不输出任何值
# ---------- end script_12 ----------
panel_37 = Panel(data_recorder_2)
script_13 = Script(InputB=script_12.b)  # -> out, result
# ---------- script_13: Python ----------
# 初始化存储上一个有效值的变量
if 'last_valid_value' not in globals():
    last_valid_value = None

# 获取当前输入值
b = InputB

# 如果输入不为空，则更新上一个有效值
if b is not None:
    last_valid_value = b

# 输出上一个有效值（可能为None，取决于初始状态）
result = last_valid_value

# 输出结果
result
# ---------- end script_13 ----------
script_14 = Script(b=script_13.result)  # -> out, a; inputs b: Double
# ---------- script_14: Python ----------
import math

# 输入参数
b = float(b)  # 将输入转换为浮点数

# 执行计算
if b == 0:
    a = 0  # 处理除以零的情况
else:
    result = 8 / b
    if result.is_integer():
        a = int(result)
    else:
        a = math.floor(result) + 1

# 输出结果
a = a
# ---------- end script_14 ----------
data_recorder_3 = DataRecorder(script_13.result, DataLimit=-10, RecordData=True)
panel_38 = Panel(script_14.a)
panel_39 = Panel(data_recorder_3)
series_2 = Series(Start=Slider(0, range=0..1), Step=script_13.result, Count=script_14.a)
panel_40 = Panel(series_2)

# ---- group: 主模块（生成初始状态的线集合）
pt = ConstructPoint(XCoordinate=Slider(0, range=0..10), YCoordinate=Slider(5, range=0..10), ZCoordinate=Slider(1.422, range=0..10))  # -> flatten(Point)
pt_2 = ConstructPoint(XCoordinate=Slider(0, range=0..10), YCoordinate=Slider(7.422, range=0..10), ZCoordinate=Slider(2, range=0..10))  # -> flatten(Point)
pt_3 = ConstructPoint(XCoordinate=Slider(0, range=0..10), YCoordinate=Slider(10.154, range=0..20), ZCoordinate=Slider(7.077, range=0..20))  # -> flatten(Point)
unit_vector = UnitVector(Vector=Vector(10, 0, 0))
merge_2 = Merge(Data1=pt, Data2=pt_2, Data3=pt_3)
multiplication = Multiplication(A=unit_vector, B=series_2)
move_3 = Move(Geometry=graft(merge_2), Motion=multiplication)  # -> Geometry, Transform
flip = FlipMatrix(Data=move_3.Geometry)
points = PointList(Points=flip)
boolean_toggle_2 = BooleanToggle(True)
panel_41 = Panel("{0;1}")

# ---- group: 成线成面成体
trigger = Trigger(Interval=500, TimerInterval=500)
script_15 = Script()  # -> out, A
# ---------- script_15: Python ----------
import Grasshopper.Kernel.Data as gh_d
import Grasshopper.Kernel.Types as gh_t
import Rhino.Geometry as rg
import csv
import os

# 参数设置
csv_file = r"E:\研究生\研1\28 Digital feature\建模\curve_points.csv"  # CSV文件路径

# 创建一个新的树状结构
tree = gh_d.GH_Structure[gh_t.GH_Point]()

try:
    # 检查文件是否存在
    if not os.path.exists(csv_file):
        raise FileNotFoundError(f"CSV文件不存在: {csv_file}")
    
    # 读取CSV文件
    with open(csv_file, 'r', encoding='utf-8') as file:
        reader = csv.DictReader(file)
        
        # 按CurveIndex分组存储点
        curve_points = {}
        
        for row in reader:
            curve_index = int(row['CurveIndex'])
            point_index = int(row['PointIndex'])
            x = float(row['X'])
            y = float(row['Y'])
            z = float(row['Z'])
            
            # 创建Rhino点
            point = rg.Point3d(x, y, z)
            
            # 将点添加到对应的CurveIndex组
            if curve_index not in curve_points:
                curve_points[curve_index] = []
            
            # 按PointIndex顺序添加点
            curve_points[curve_index].append((point_index, point))
    
    # 将分组的点转换为树状结构
    for curve_index in sorted(curve_points.keys()):
        points = curve_points[curve_index]
        
        # 按PointIndex排序
        points.sort(key=lambda p: p[0])
        
        # 创建路径
        path = gh_d.GH_Path(curve_index)
        
        # 将点添加到树状结构
        for _, point in points:
            tree.Append(gh_t.GH_Point(point), path)
    
    print(f"成功从CSV文件读取并重建了 {len(curve_points)} 条曲线的点集")
    
    # 输出树状结构
    A = tree
    
except FileNotFoundError as e:
    A = None
    print(f"错误：{str(e)}")
except Exception as e:
    A = None
    print(f"错误：处理CSV文件时发生异常 - {str(e)}")
# ---------- end script_15 ----------
interpolate = Interpolate(Degree=3, Periodic=False, KnotStyle=1)  # -> Curve, Length, Domain
X = UnitX(Factor=script_13.result)
divide = DivideCurve(Curve=interpolate.Curve, Count=Slider(30, range=0..100), Kinks=False)  # -> Points, Tangents, Parameters
move_4 = Move(Geometry=divide.Points, Motion=X)  # -> Geometry, Transform
multiplication_2 = Multiplication(A=divide.Parameters, B=Slider(3, range=0..10))
panel_42 = Panel(divide.Points)
ln = Line(StartPoint=divide.Points, EndPoint=move_4.Geometry)
Z = UnitZ(Factor=Slider(0.3, range=0..1))
bounds = Bounds(Numbers=multiplication_2)
extr = Extrude(Base=ln, Direction=Z)
brep_2 = Brep(extr)
deconstruct_domain = DeconstructDomain(Domain=bounds)  # -> Start, End
Y = UnitY(Factor=Slider(0.01, range=0..1))
Y_2 = UnitY(Factor=Slider(0, range=0..0.1))
extr_2 = Extrude(Base=brep_2, Direction=Y)
panel_43 = Panel(bounds)
gradient = Gradient(
    LowerLimit=deconstruct_domain.Start,
    UpperLimit=deconstruct_domain.End,
    Parameter=multiplication_2,
    stops=[0: RGB(243, 57, 0), 0.1: RGB(236, 27, 60), 0.2: RGB(210, 0, 118), 0.3: RGB(103, 0, 120), 0.4: RGB(39, 72, 161), 0.5: RGB(1, 192, 229), 0.6: RGB(18, 178, 90), 0.7: RGB(79, 186, 8), 0.8: RGB(220, 237, 32), 0.9: RGB(247, 159, 20), 1: RGB(243, 57, 0)])
move_5 = Move(Geometry=extr_2, Motion=Y_2)  # -> Geometry, Transform
panel_44 = Panel(move_5.Geometry)
move_to_point = MoveToPoint(Geometry=move_5.Geometry, PointA=pt, PointB=point)  # -> Moved, Vector, Transform
preview = CustomPreview(Geometry=move_to_point.Moved, Material=gradient)

# ----
# 全局变量
csharp_script_5 = CSharpScript(P=flip, FP="E:\\研究生\\研1\\28 Digital feature\\建模\\curve_points.csv", E=boolean_toggle_2)  # -> S, St
# ---------- csharp_script_5: C# ----------
using System;
using System.Collections.Generic;
using System.Data;
using System.IO;
using System.Linq;
using Grasshopper.Kernel;
using Grasshopper.Kernel.Types;
using Grasshopper.Kernel.Data;
using Rhino;
using Rhino.Geometry;

public class ExportPointsToCsvComponent : GH_Component
{
    public ExportPointsToCsvComponent()
        : base("Export Points to CSV", "ExportPointsCSV",
              "Exports point tree data to CSV file with CurveIndex and PointIndex",
              "Export", "Data")
    { }

    protected override void RegisterInputParams(GH_InputParamManager pManager)
    {
        pManager.AddGenericParameter("Points", "P", "Point tree (3 points per curve)", GH_ParamAccess.tree);
        pManager.AddTextParameter("FilePath", "FP", "Full path to save CSV file", GH_ParamAccess.item);
        pManager.AddBooleanParameter("Export", "E", "Set to True to export", GH_ParamAccess.item);
    }

    protected override void RegisterOutputParams(GH_OutputParamManager pManager)
    {
        pManager.AddBooleanParameter("Success", "S", "Export success status", GH_ParamAccess.item);
        pManager.AddTextParameter("Status", "St", "Export status message", GH_ParamAccess.item);
    }

    protected override void SolveInstance(IGH_DataAccess DA)
    {
        // 获取输入数据
        GH_Structure<IGH_Goo> pointsTree = null;
        string filePath = "";
        bool export = false;

        if (!DA.GetDataTree(0, out pointsTree)) return;
        if (!DA.GetData(1, ref filePath)) return;
        if (!DA.GetData(2, ref export)) return;

        // 检查是否需要执行
        if (!export)
        {
            DA.SetData(0, false);
            DA.SetData(1, "未执行导出操作。将Export设为True以保存表格");
            return;
        }

        // 创建数据表
        DataTable table = CreateTable();
        
        try
        {
            // 处理点树数据
            int processedPoints = ProcessPointTree(pointsTree, table);
            
            // 保存到CSV
            bool success = SaveTableToCsv(table, filePath);
            string message = success 
                ? $"成功导出 {processedPoints} 个点 ({table.Rows.Count} 行) 到: {filePath}"
                : "导出失败";
            
            // 输出结果
            DA.SetData(0, success);
            DA.SetData(1, message);
        }
        catch (Exception ex)
        {
            AddRuntimeMessage(GH_RuntimeMessageLevel.Error, $"导出失败: {ex.Message}");
            DA.SetData(0, false);
            DA.SetData(1, $"错误: {ex.Message}");
        }
    }

    private DataTable CreateTable()
    {
        DataTable table = new DataTable("CurvePoints");
        
        // 添加列
        table.Columns.Add("CurveIndex", typeof(int));
        table.Columns.Add("PointIndex", typeof(int));
        table.Columns.Add("X", typeof(double));
        table.Columns.Add("Y", typeof(double));
        table.Columns.Add("Z", typeof(double));
        
        return table;
    }

    private int ProcessPointTree(GH_Structure<IGH_Goo> pointsTree, DataTable table)
    {
        int pointCount = 0;
        int branchCount = pointsTree.Branches.Count;
        
        for (int curveIndex = 0; curveIndex < branchCount; curveIndex++)
        {
            var branch = pointsTree.Branches[curveIndex];
            var points = branch.Select(goo => ExtractPoint3d(goo)).ToList();

            // 跳过无效分支
            if (points == null || points.Count == 0)
            {
                AddRuntimeMessage(GH_RuntimeMessageLevel.Warning, 
                    $"分支 {curveIndex} 没有有效点");
                continue;
            }

            // 添加点到表格
            for (int pointIndex = 0; pointIndex < points.Count; pointIndex++)
            {
                Point3d pt = points[pointIndex];
                DataRow row = table.NewRow();
                row["CurveIndex"] = curveIndex;
                row["PointIndex"] = pointIndex;
                row["X"] = pt.X;
                row["Y"] = pt.Y;
                row["Z"] = pt.Z;
                table.Rows.Add(row);
                pointCount++;
            }
            
            // 检查点数
            if (points.Count != 3)
            {
                AddRuntimeMessage(GH_RuntimeMessageLevel.Warning, 
                    $"曲线 {curveIndex} 有 {points.Count} 个点 (推荐3个)");
            }
        }
        
        return pointCount;
    }

    private Point3d ExtractPoint3d(IGH_Goo goo)
    {
        // 处理各种点类型
        if (goo is GH_Point ghPoint)
        {
            return ghPoint.Value;
        }
        else if (goo.CastTo<Point3d>(out Point3d point))
        {
            return point;
        }
        else if (goo is GH_String str)
        {
            // 尝试解析字符串格式的点
            string[] parts = str.Value.Split(',');
            if (parts.Length == 3)
            {
                if (double.TryParse(parts[0], out double x) &&
                    double.TryParse(parts[1], out double y) &&
                    double.TryParse(parts[2], out double z))
                {
                    return new Point3d(x, y, z);
                }
            }
        }
        
        // 尝试直接获取值
        var value = goo.ScriptVariable();
        if (value is Point3d pt)
        {
            return pt;
        }
        else if (value is Point pointGeom)
        {
            return pointGeom.Location;
        }

        throw new InvalidOperationException($"无法转换类型为 {goo.TypeName} 的对象到点");
    }

    private bool SaveTableToCsv(DataTable table, string filePath)
    {
        try
        {
            // 检查文件路径是否有效
            if (string.IsNullOrWhiteSpace(filePath))
            {
                throw new ArgumentException("文件路径不能为空");
            }
            
            // 确保文件扩展名正确
            if (!filePath.EndsWith(".csv", StringComparison.OrdinalIgnoreCase))
            {
                filePath += ".csv";
            }

            // 确保目录存在
            string directory = Path.GetDirectoryName(filePath);
            if (!Directory.Exists(directory))
            {
                Directory.CreateDirectory(directory);
            }

            // 写入CSV文件
            using (StreamWriter writer = new StreamWriter(filePath, false, System.Text.Encoding.UTF8))
            {
                // 写入表头
                writer.WriteLine(string.Join(",", table.Columns.Cast<DataColumn>().Select(c => c.ColumnName)));

                // 写入数据行
                foreach (DataRow row in table.Rows)
                {
                    string line = string.Join(",", 
                        row.ItemArray.Select(item => Convert.ToString(item, System.Globalization.CultureInfo.InvariantCulture)));
                    writer.WriteLine(line);
                }
            }

            return true;
        }
        catch (Exception ex)
        {
            AddRuntimeMessage(GH_RuntimeMessageLevel.Error, $"保存CSV失败: {ex.Message}");
            return false;
        }
    }

    public override Guid ComponentGuid => new Guid("B3C4D5E6-F7A8-49B0-C1D2-E3F4A5B6C7D8");
    protected override System.Drawing.Bitmap Icon => null;
}
# ---------- end csharp_script_5 ----------

# ---- group: 改变b后生成新线
series_3 = Series(Start=Slider(0, range=0..100), Step=script_13.result, Count=script_14.a)
panel_45 = Panel(series_3)
vector_xyz_3 = VectorXYZ(XComponent=series_3, YComponent=Slider(0, range=0..100), ZComponent=Slider(0, range=0..100))  # -> Vector, Length
move_6 = Move(Motion=vector_xyz_3.Vector)  # -> Geometry, Transform

# ----
panel_46 = Panel(move_6.Geometry)

# ---- group: 动作二
# x坐标幅度满足要求
# #缓存右脚踝的历史x坐标序列
# #波动幅度判断
dataqueue_4 = DataQueue(Data=deconstruct_7.XComponent, RecordCount=division)  # -> OutputData, OldestPath, NewestPath

# y坐标幅度满足要求
dataqueue_5 = DataQueue(Data=deconstruct_7.YComponent, RecordCount=division)  # -> OutputData, OldestPath, NewestPath

# y坐标幅度满足要求
# #求极差
# z坐移动是否大于某值？
dataqueue_6 = DataQueue(Data=deconstruct_7.ZComponent, RecordCount=division)  # -> OutputData, OldestPath, NewestPath

split_tree_5 = SplitTree(Data=dataqueue_4.OutputData, Masks=dataqueue_4.OldestPath)  # -> Positive, Negative
split_tree_6 = SplitTree(Data=dataqueue_4.OutputData, Masks=dataqueue_4.NewestPath)  # -> Positive, Negative
split_tree_7 = SplitTree(Data=dataqueue_5.OutputData, Masks=dataqueue_5.NewestPath)  # -> Positive, Negative
split_tree_8 = SplitTree(Data=dataqueue_5.OutputData, Masks=dataqueue_5.OldestPath)  # -> Positive, Negative
split_tree_9 = SplitTree(Data=dataqueue_6.OutputData, Masks=dataqueue_6.NewestPath)  # -> Positive, Negative
split_tree_10 = SplitTree(Data=dataqueue_6.OldestPath, Masks=dataqueue_6.OldestPath)  # -> Positive, Negative

subtraction_8 = Subtraction(A=split_tree_6.Positive, B=split_tree_5.Positive)

subtraction_9 = Subtraction(A=split_tree_9.Positive, B=split_tree_10.Positive)

subtraction_10 = Subtraction(A=split_tree_7.Positive, B=split_tree_8.Positive)

absolute_4 = Absolute(Value=subtraction_9)
absolute_5 = Absolute(Value=subtraction_10)
absolute_6 = Absolute(Value=subtraction_8)

larger_than_6 = LargerThan(FirstNumber=absolute_4, SecondNumber=Slider(0.05, range=0..1))  # -> LargerThan, OrEqualTo

smaller_than_18 = SmallerThan(FirstNumber=absolute_6, SecondNumber=Slider(0.023, range=0..1))  # -> SmallerThan, OrEqualTo

smaller_than_19 = SmallerThan(FirstNumber=absolute_5, SecondNumber=Slider(0.023, range=0..1))  # -> SmallerThan, OrEqualTo

gate_and_8 = GateAnd(A=smaller_than_18.SmallerThan, B=smaller_than_19.SmallerThan)
gate_and_9 = GateAnd(A=gate_and_8, B=larger_than_6.LargerThan)

# ---- group: 动作二 / 布尔脉冲
script_16 = Script(Result=gate_and_9)  # -> out, result; inputs Result: Boolean; same code as script_10

# ---- group: 动作二
# #同时满足点【22】坐标变化，
# 和一次布尔脉冲，
# 才可触发切换选择
gate_and_10 = GateAnd(A=gate_and_9, B=script_16.result)

script_17 = Script(UnitCount=script_14.a, Toggle=gate_and_10)  # -> out, flatten(result); inputs UnitCount: Int32, Toggle: Boolean
# ---------- script_17: Python ----------
# 初始化当前选中的单元序号（从1开始）
if 'current_index' not in globals():
    current_index = 0

# 获取输入参数
unit_count = UnitCount  # 单元总数
toggle = Toggle         # True/False输入

# 确保单元数量有效
if unit_count is not None and unit_count > 0:
    # 当接收到True时，增加选中的单元序号
    if toggle is True:
        current_index += 1
        
        # 处理循环：当超过总数时从头开始
        if current_index > unit_count:
            current_index = (current_index - 1) % unit_count + 1
    
    # 输出当前选中的单元序号
    result = current_index
else:
    # 单元数量无效时返回None
    result = None

# 输出结果
result
# ---------- end script_17 ----------
data_recorder_4 = DataRecorder(gate_and_10, DataLimit=-10, RecordData=True)
script_18 = Script(InputB=script_17.result)  # -> out, result; same code as script_13
data_recorder_5 = DataRecorder(script_18.result, DataLimit=-10, RecordData=True)
panel_47 = Panel(data_recorder_4)
panel_48 = Panel(data_recorder_5)

# ---- group: 动作二 / 分流，赋颜色
equality = Equality(FirstNumber=series, SecondNumber=script_18.result)  # -> Equality, Inequality
选中_未选中 = Dispatch(List=brep, DispatchPattern=equality.Equality)  # -> ListA, ListB
被选中 = ColourSwatch(SwatchColor=RGB(255, 43, 43))
未被选中 = ColourSwatch(SwatchColor=RGB(237, 237, 237))
mesh_colours = MeshColours(Mesh=选中_未选中.ListA, Colours=被选中)
mesh_colours_2 = MeshColours(Mesh=选中_未选中.ListB, Colours=未被选中)

# ---- group: 动作二 (continued)
relay = Relay([mesh_colours_2, mesh_colours])

# ----
csharp_script_6 = CSharpScript(CurveIndex=script_18.result, FilePath="E:\\研究生\\研1\\28 Digital feature\\建模\\curve_points.csv")  # -> Points
# ---------- csharp_script_6: C# ----------
using System;
using System.Collections.Generic;
using System.IO;
using System.Linq;
using Grasshopper.Kernel;
using Rhino.Geometry;

public class ReadCurvePointsComponent : GH_Component
{
    public ReadCurvePointsComponent()
        : base("Read Curve Points", "ReadCurvePts",
              "Reads points for a specific curve from CSV file",
              "Data", "IO")
    { }

    protected override void RegisterInputParams(GH_InputParamManager pManager)
    {
        pManager.AddIntegerParameter("CurveIndex", "CI", "Index of curve to extract points for", GH_ParamAccess.item);
        pManager.AddTextParameter("FilePath", "FP", "Full path to the CSV file", GH_ParamAccess.item);
    }

    protected override void RegisterOutputParams(GH_OutputParamManager pManager)
    {
        pManager.AddPointParameter("Points", "Pts", "Extracted points (0,1,2 in order)", GH_ParamAccess.list);
    }

    protected override void SolveInstance(IGH_DataAccess DA)
    {
        // 初始化输入变量
        int curveIndex = 0;
        string filePath = string.Empty;

        // 获取输入数据
        if (!DA.GetData(0, ref curveIndex)) return;
        if (!DA.GetData(1, ref filePath)) return;

        try
        {
            // 检查文件是否存在
            if (!File.Exists(filePath))
            {
                AddRuntimeMessage(GH_RuntimeMessageLevel.Error, $"File not found: {filePath}");
                return;
            }

            // 读取CSV文件
            var points = new List<Point3d>();
            var pointRecords = new List<Tuple<int, Point3d>>();

            using (var reader = new StreamReader(filePath))
            {
                // 读取标题行
                var headers = reader.ReadLine()?.Split(',');
                if (headers == null || headers.Length < 4)
                {
                    AddRuntimeMessage(GH_RuntimeMessageLevel.Error, "Invalid CSV format or missing headers");
                    return;
                }

                // 处理数据行
                while (!reader.EndOfStream)
                {
                    var line = reader.ReadLine();
                    if (string.IsNullOrWhiteSpace(line)) continue;

                    var values = line.Split(',');
                    if (values.Length < 4) continue;

                    // 尝试解析数据
                    if (int.TryParse(values[0], out int currentCurve) &&
                        int.TryParse(values[1], out int pointIndex) &&
                        double.TryParse(values[2], out double x) &&
                        double.TryParse(values[3], out double y) &&
                        double.TryParse(values[4], out double z))
                    {
                        // 检查是否为目标曲线且点索引为0,1,2
                        if (currentCurve == curveIndex && (pointIndex == 0 || pointIndex == 1 || pointIndex == 2))
                        {
                            var point = new Point3d(x, y, z);
                            pointRecords.Add(Tuple.Create(pointIndex, point));
                        }
                    }
                }
            }

            // 按点索引排序并提取点
            var sortedPoints = pointRecords
                .OrderBy(p => p.Item1)
                .Select(p => p.Item2)
                .ToList();

            // 验证点数并输出
            if (sortedPoints.Count == 0)
            {
                AddRuntimeMessage(GH_RuntimeMessageLevel.Warning, 
                    $"No points found for curve {curveIndex}");
            }
            else if (sortedPoints.Count < 3)
            {
                AddRuntimeMessage(GH_RuntimeMessageLevel.Warning, 
                    $"Only {sortedPoints.Count} points found for curve {curveIndex} (3 required)");
            }

            // 输出结果
            DA.SetDataList(0, sortedPoints);
        }
        catch (Exception ex)
        {
            AddRuntimeMessage(GH_RuntimeMessageLevel.Error, $"Error reading CSV: {ex.Message}");
        }
    }

    // 生成唯一组件ID
    public override Guid ComponentGuid => new Guid("A3B4C5D6-7E8F-90A1-B2C3-D4E5F6A7B8C9");
    
    // 可选的图标资源
    protected override System.Drawing.Bitmap Icon => null;
}
# ---------- end csharp_script_6 ----------

# ---- group: 头显输出
brep_3 = Brep(move_to_point.Moved)
mesh_brep = MeshBrep(
    Brep=brep_3,
    Settings={GridMaxCount=0, GridMinCount=16, JaggedSeams=False, MaxEdgeLength=0, MinEdgeLength=0.0001, MinTolerance=0, Refine=True, RefineAngle=0, RelativeTolerance=0.65, SimplePlanes=True, Tolerance=0})
brep_4 = Brep(<brep referenced from the Rhino model>)
brep_5 = Brep(<brep referenced from the Rhino model>)
brep_6 = Brep(<brep referenced from the Rhino model>)
brep_7 = Brep(<brep referenced from the Rhino model>)
mesh_colours_3 = MeshColours(Mesh=graft(mesh_brep), Colours=graft(gradient))
mesh_brep_2 = MeshBrep(
    Brep=brep_5,
    Settings={GridMaxCount=0, GridMinCount=16, JaggedSeams=False, MaxEdgeLength=0, MinEdgeLength=0.0001, MinTolerance=0, Refine=True, RefineAngle=0, RelativeTolerance=0.65, SimplePlanes=True, Tolerance=0})
mesh_brep_3 = MeshBrep(
    Brep=brep_4,
    Settings={GridMaxCount=0, GridMinCount=16, JaggedSeams=False, MaxEdgeLength=0, MinEdgeLength=0.0001, MinTolerance=0, Refine=True, RefineAngle=0, RelativeTolerance=0.65, SimplePlanes=True, Tolerance=0})
mesh_brep_4 = MeshBrep(
    Brep=brep_6,
    Settings={GridMaxCount=0, GridMinCount=16, JaggedSeams=False, MaxEdgeLength=0, MinEdgeLength=0.0001, MinTolerance=0, Refine=True, RefineAngle=0, RelativeTolerance=0.65, SimplePlanes=True, Tolerance=0})
mesh_brep_5 = MeshBrep(
    Brep=brep_7,
    Settings={GridMaxCount=0, GridMinCount=16, JaggedSeams=False, MaxEdgeLength=0, MinEdgeLength=0.0001, MinTolerance=0, Refine=True, RefineAngle=0, RelativeTolerance=0.65, SimplePlanes=True, Tolerance=0})
send = Send(Timestamp=receive.Timestamp, Meshes=flatten([relay, mesh_colours_3, mesh_brep_3, mesh_brep_2, mesh_brep_4, mesh_brep_5]))
